# Dynamo graph FamilyInstanceBygeometry.dyn (Dynamo 2.13.1.3887)
# packages: spring nodes 210.1.1, Synthesize toolkit 11.9.6

ꟿ_directshape_bygeometry = Custom[ꟿ DirectShape.ByGeometry]()  # package spring nodes; Convert the input geometry to DirectShape element inside the Revit document. It supports solids or surfaces. It is based on an alternative process that uses a SAT import and can produce smooth surfaces. Each created DS will have a unique type. Make sure that each input geometry has a unique name. You can either feed a single category for all geometries or a unique category for each geometry - the node's lacing is set to longest by default. The default category is Generic Models.; unwired: geometry, name
ꟿ_familyinstance_bygeometry = Custom[ꟿ FamilyInstance.ByGeometry]()  # package spring nodes; You must provide a valid family template path that will be used for all input geometry objects. The project units(and not the templates) will be used to determine the size of the output geometry. The provided category will be used only if the family template supports it. If not, the default template category will be used instead. Likewise, the family material(provided as a string) will be set only if a material with that name exists in the template. If not, the default material will be used instead ("By Category"). For void cuts, the material settings will be ignored. The Subcategory name is an optional input. If you'd like to skip assigning a Subcategory to any new instance, simply use null. The node expects a unique family name for each geometry object. The rest of the input lists will be processed as if the node lacing is set to longest.; unwired: geometry, familyTemplatePath, familyName
code_block = CodeBlock(a=ꟿ_familyinstance_bygeometry.instance) { a; }
select_model_element = DSModelElementSelection()  # 1 picked in the model
geometry = Element.Geometry(element=select_model_element)
file_path = Filename("C:\ProgramData\Autodesk\RVT 2023\Family Templates\English\Metric Generic Model.rft")
code_block_2 = CodeBlock { "Machin"; }
categories = Categories("OST_GenericModel")
byGeometry = Custom[SP.FamilyInstance.ByGeometry](VARgeometry=geometry, VARfamilyTemplatePath=file_path, VARfamilyName=code_block_2, VARcategory=categories)  # package Synthesize toolkit; You must provide a valid family template path that will be used for all input geometry objects. The project units(and not the templates) will be used to determine the size of the output geometry. The provided category will be used only if the family template supports it. If not, the default template category will be used instead. Likewise, the family material(provided as a string) will be set only if a material with that name exists in the template. If not, the default material will be used instead ("By Category"). For void cuts, the material settings will be ignored. The Subcategory name is an optional input. If you'd like to skip assigning a Subcategory to any new instance, simply use null. The node expects a unique family name for each geometry object. The rest of the input lists will be processed as if the node lacing is set to longest.
