# Dynamo graph OBC_ANA_Auto Analytical for Slab.dyn "Run - Auto Analytical for Slab" (Dynamo 2.13.1.3887)
# Create anaylical by slect  faces (tạo sơ đồ tính cho sàn bằng cách lựa chọn các bề mặt sàn)
# packages: GenerativeDesign.Revit 2.0.10.0

n1_select_multiple_model_elements = DSModelElementMutlipleSelection()  # "1. Select Multiple Model Elements"; 22 picked in the model; graph input
code_block = CodeBlock(Ele=n1_select_multiple_model_elements)
# ---------- code_block.designscript (10 lines) ----------
parameter1 = Revit.Element.Parameters(Ele);
Count_Para = List.Count(parameter1@L2<1>);
All_Ele = Count_Para <= 10 ? null : Ele;
Fill_Ele = List.Flatten(List.Clean(All_Ele,false),-1);
Get_Cate = Revit.Element.GetParameterValueByName(Fill_Ele, "Category");
Get_Ele = Get_Cate+"" == "Floors" ? Fill_Ele : null;
The_Ele = List.Flatten(List.Clean(Get_Ele, false),-1);
Get_Thickness = Revit.Element.GetParameterValueByName(The_Ele, "Thickness");
Get_The_Ele = Get_Thickness > 0 ? The_Ele : null;
The_All_Ele = List.Flatten(List.Clean(Get_The_Ele, false),-1);
# ----------------------------------------
floor_slop = DoubleInput(0.999)
n2_structural_roles_floor = StructuralRoleComboBox("Floor")  # "2. Structural Roles Floor"; graph input
code_block_2 = CodeBlock(Get_floors=code_block.The_All_Ele, SL=floor_slop, Role=n2_structural_roles_floor)
# ---------- code_block_2.designscript (12 lines) ----------
Get_ID = Revit.Element.Id(Get_floors);
All_Floors = Get_floors;
Get_surfaces_all = Revit.Element.Faces(Get_floors);
vector1 = Autodesk.Surface.NormalAtParameter(Get_surfaces_all, 0.5, 0.5);
Vector_Z = Autodesk.Vector.Z(vector1);
Math_round_Z = Math.Round(Vector_Z, 3);
Filter_Surface = List.FilterByBoolMask(Get_surfaces_all, Math_round_Z >= SL);
Get_surfaces = Dictionary.ValueAtKey(Filter_Surface, "in");
Surfacefill = List.Clean(Get_surfaces, false);
geometry1 = Autodesk.Geometry.Translate(Surfacefill, Autodesk.Vector.ZAxis(),-1* Revit.Element.GetParameterValueByName(Get_floors, "Height Offset From Level"));
analyticalpanel1 = AnalyticalPanel.BySurface(geometry1, true);
analyticalpanel2 = AnalyticalPanel.SetStructuralRole(analyticalpanel1, Role);
# ----------------------------------------
code_block_3 = CodeBlock(Get_floors=code_block_2.All_Floors, analyticalpanel2=code_block_2.analyticalpanel2)
# ---------- code_block_3.designscript (4 lines) ----------
Get_thickness = Revit.Element.GetParameterValueByName(Get_floors, "Thickness");
Thickness1 = 200;
Thickness_all = ((Get_thickness == "" ? Thickness1 : Get_thickness));
element1 = Revit.Element.SetParameterByName(analyticalpanel2, "Thickness", Thickness_all);
# ----------------------------------------
code_block_4 = CodeBlock(t1=code_block_2.All_Floors)
# ---------- code_block_4.designscript (3 lines) ----------
elementtype1 = Revit.Element.ElementType(t1);
t2 = Revit.Element.GetParameterValueByName(elementtype1, "Structural Material");
str2 = Material.Name(t2);
# ----------------------------------------
code_block_5 = CodeBlock(Get_floors=code_block_2.All_Floors, Material_normal=code_block_4.str2, analyticalpanel2=code_block_2.analyticalpanel2)
# ---------- code_block_5.designscript (5 lines) ----------
elementtype1 = Revit.Element.ElementType(Get_floors);
Get_material = Revit.Element.GetParameterValueByName(elementtype1, "Structural Material");
material1 = Material.ByName(Material_normal);
MTR = ((Get_material == "" ? material1 : Get_material));
element1 = Revit.Element.SetParameterByName(analyticalpanel2, "Structural Material", MTR);
# ----------------------------------------
