# Dynamo graph OBC_ANA_Create Area Load.dyn "Run - Create Area Load" (Dynamo 2.13.1.3887)
# author: Thach Toan Trung
# Create the new load by select load in model (Tạo mới tải trọng bằng cách lựa chọn các tải trọng trong mô hình)
# packages: Structural Design 2021.9.23, GenerativeDesign.Revit 2.0.10.0, Structural Design 2022.4.17

n1_slect_model_element = DSModelElementMutlipleSelection()  # "1. Slect model element"; 178 picked in the model; graph input
code_block = CodeBlock(All_Analytical=n1_slect_model_element)
# ---------- code_block.designscript (2 lines) ----------
Role = Revit.Element.GetParameterValueByName(All_Analytical, "Structural Role");
List.Clean(Role==5?All_Analytical:null,false);
# ----------------------------------------
code_block_2 = CodeBlock { false; }
clean = List.Clean(list=code_block.out1, preserveIndices=code_block_2)
ZAxis = Vector.ZAxis()
n2_area_load_type = RevitAreaLoadType("Area Load 1")  # "2. Area Load Type"; graph input
assign_area_load_python_script = Python(IN[0]=clean, IN[1]=ZAxis, IN[2]=n2_area_load_type)  # IronPython2
# ---------- assign_area_load_python_script.python (39 lines) ----------
import clr
clr.AddReference('ProtoGeometry')
from Autodesk.DesignScript.Geometry import *
#Import ToDSType(bool) extension method
clr.AddReference('RevitNodes')
import Revit
clr.ImportExtensions(Revit.GeometryConversion)
#Import DocumentManager and TransactionManager
clr.AddReference('RevitServices')
import RevitServices
from RevitServices.Persistence import DocumentManager
from RevitServices.Transactions import TransactionManager
from System.Collections.Generic import *
#import RevitAPI
clr.AddReference('RevitAPI')
import Autodesk
from Autodesk.Revit.DB import *
from Autodesk.Revit.DB.Structure import *
from System.Collections.Generic import *

def UwList(x):  # Cach 2
    return UnwrapElement(x if hasattr(x, "__iter__") else [x])
doc = DocumentManager.Instance.CurrentDBDocument
#The inputs to this node will be stored as a list in the IN variables.
Host=UwList(IN[0])
F=UnwrapElement(IN[1]).ToXyz()
loadtype=UnwrapElement(IN[2])
loads=[]
TransactionManager.Instance.EnsureInTransaction(doc)

for i in Host:
	a= AreaLoad.Create(doc,i.Id,F,loadtype)
	loads.append(a)
	
#End Transaction
TransactionManager.Instance.TransactionTaskDone()
	
#Assign your output to the OUT variable.
OUT = loads
# ----------------------------------------
code_block_3 = CodeBlock { "Load Case"; }
n3_set_load_case = RevitLoadCase("Full load")  # "3. Set Load Case"; graph input
setParameterByName = Element.SetParameterByName(element=assign_area_load_python_script, parameterName=code_block_3, value=n3_set_load_case)
n4_local_direction = StringInput("Fz 1")  # "4. Local Direction"; graph input
n5_load_value_kn_msq = DoubleInput(0)  # "5. Load Value (kN/msq)"; graph input
setParameterByName_2 = Element.SetParameterByName(element=setParameterByName, parameterName=n4_local_direction, value=n5_load_value_kn_msq)
