# Dynamo graph OBC_ANA_Delete Duplicate Element.dyn "Run - Delete Duplicate Element" (Dynamo 2.13.1.3887)
# author: Thach Toan Trung
# Delete duplitcate model (Xoá cấu kiện trùng nhau)
# packages: GenerativeDesign.Revit 2.0.10.0, archi-lab.net 2023.213.1523

select_multiple_model_elements = DSModelElementMutlipleSelection()  # 195 picked in the model; graph input
code_block = CodeBlock { "Category"; }
getParameterValueByName = Element.GetParameterValueByName(element=select_multiple_model_elements, parameterName=code_block)
code_block_2 = CodeBlock(IN0=getParameterValueByName, Get_IN1=select_multiple_model_elements) { List.Clean(IN0+""=="Structural Columns"?Get_IN1:null,false); }
getActualLocation = AnalyticalAutomation.RevitElements.Element.GetActualLocation(element=code_block_2)
string_from_object = FromObject(object=getActualLocation)
uniqueItems = List.UniqueItems(list=string_from_object)
indexOf = List.IndexOf(list=string_from_object, element=uniqueItems)
removeItemAtIndex = List.RemoveItemAtIndex(list=code_block_2, indices=indexOf)
delete = archilab.Revit.Elements.Elements.Delete(element=removeItemAtIndex)
code_block_3 = CodeBlock { "Category"; }
getParameterValueByName_2 = Element.GetParameterValueByName(element=select_multiple_model_elements, parameterName=code_block_3)
code_block_4 = CodeBlock(IN0=getParameterValueByName_2, Get_IN1=select_multiple_model_elements) { List.Clean(IN0+""=="Structural Framing"?Get_IN1:null,false); }
getLocation = Element.GetLocation(element=code_block_4)
string_from_object_2 = FromObject(object=getLocation)
uniqueItems_2 = List.UniqueItems(list=string_from_object_2)
indexOf_2 = List.IndexOf(list=string_from_object_2, element=uniqueItems_2)
removeItemAtIndex_2 = List.RemoveItemAtIndex(list=code_block_4, indices=indexOf_2)
delete_2 = archilab.Revit.Elements.Elements.Delete(element=removeItemAtIndex_2)
