# Dynamo graph OBC_ANA_Physical to Analytical for Panel.dyn "Run - Physical to Analytical for Walls" (Dynamo 2.13.1.3887)
# author: Autodesk
# Generate Structural Analytical Model based on selected physical elements. Once the model built, it can be updated based on physical model changes.

n1_rectangle_by_3_points = BoolSelector(false)  # "1. Rectangle by 3 points"; graph input
boolean = BoolSelector(true)
python_script_slect_anlytical = Python(IN[0]=boolean)  # "Python Script_Slect anlytical nodes"; IronPython2
# ---------- python_script_slect_anlytical.python (40 lines) ----------
""" Get Analytical Nodes """
import clr
clr.AddReference("RevitAPIUI")
from  Autodesk.Revit.UI.Selection import ObjectType, ISelectionFilter

clr.AddReference("RevitNodes")
import Revit
clr.ImportExtensions(Revit.Elements)

clr.AddReference("RevitServices")
import RevitServices
from RevitServices.Persistence import DocumentManager
doc = DocumentManager.Instance.CurrentDBDocument
uidoc = DocumentManager.Instance.CurrentUIApplication.ActiveUIDocument

# Code
def ListOrItems(lst):
    return lst[0] if len(lst) == 1 else lst
    
class RefPoint(ISelectionFilter):
    def __init__(self, category):
        self.category = category
    
    def AllowElement(self, element):
        if element.Category.Name == self.category:
            return True
        else:
            return False
    def AllowReference(self, reference, position):
        return False
flag = True
element_anlytical_nodes = []
while flag:
    try:
        ref_anlytical_nodes = uidoc.Selection.PickObject(ObjectType.Element, RefPoint("Analytical Nodes"), "Please Select Analytical Nodes")
        element_anlytical_nodes.append(doc.GetElement(ref_anlytical_nodes).ToDSType(True))
    except:
        flag = False
    
OUT = ListOrItems(element_anlytical_nodes)
# ----------------------------------------
geometry = Element.Geometry(element=python_script_slect_anlytical)
flatten = List.Flatten(list=geometry)
code_block = CodeBlock { false; }
clean = List.Clean(list=flatten, preserveIndices=code_block)
code_block_2 = CodeBlock(P=clean) { P[0]; }
code_block_3 = CodeBlock(P=clean) { P[1]; }
byStartPointEndPoint = Line.ByStartPointEndPoint(startPoint=code_block_2, endPoint=code_block_3)
code_block_4 = CodeBlock(P=clean) { P[2]; }
byTwoPoints = Vector.ByTwoPoints(start=code_block_3, end=code_block_4)
distanceTo = Geometry.DistanceTo(geometry=code_block_3, other=code_block_4)
extrude = Curve.Extrude(curve=byStartPointEndPoint, direction=byTwoPoints, distance=distanceTo)
byPerimeterPoints = Surface.ByPerimeterPoints(points=clean)
code_block_5 = CodeBlock(A=n1_rectangle_by_3_points, T=extrude, F=byPerimeterPoints) { A==true?T:F; }
bySurface = AnalyticalAutomation.AnalyticalElements.AnalyticalPanel.BySurface(surface=code_block_5)
n2_structural_roles = StructuralRoleComboBox("Wall")  # "2. Structural Roles"; graph input
setStructuralRole = AnalyticalAutomation.AnalyticalElements.AnalyticalPanel.SetStructuralRole(analyticalPanel=bySurface, structuralRole=n2_structural_roles)
code_block_6 = CodeBlock { "Thickness"; }
n3_thickness = DoubleInput(200)  # "3. Thickness"; graph input
setParameterByName = Element.SetParameterByName(element=setStructuralRole, parameterName=code_block_6, value=n3_thickness)
code_block_7 = CodeBlock { "Structural Material"; }
n4_material = StringInput("Concrete - В20")  # "4. Material"; graph input
byName = Material.ByName(name=n4_material)
setParameterByName_2 = Element.SetParameterByName(element=setParameterByName, parameterName=code_block_7, value=byName)
