# Dynamo graph OBC_ANA_Set Area Load.dyn "Run - Set Area Load" (Dynamo 2.13.1.3887)
# Create of modife load by select load in model (Tạo mới hoặc chỉnh sửa tải trọng của mô hình)
# packages: GenerativeDesign.Revit 2.0.10.0, Structural Design 2022.4.17

n5_create_new_load_false_or = BoolSelector(true)  # "5. Create new load (False) or Modified (True)"; graph input
n1_select_multiple_model_elements = DSModelElementMutlipleSelection()  # "1. Select Multiple Model Elements"; 2 picked in the model; graph input
code_block = CodeBlock(t1=n1_select_multiple_model_elements)
# ---------- code_block.designscript (3 lines) ----------
t2 = Revit.Element.GetParameterValueByName(t1, "Category");
t3 = t2+""=="Structural Loads - Area Loads"?t1:null;
t4 = List.Flatten(List.Clean(t3,false),-1);
# ----------------------------------------
n2_dynamo_area_load = StringInput("Dynamo Area Load 1")  # "2. Dynamo Area Load"; graph input
code_block_2 = CodeBlock(Element1=code_block.t4, DynamoAreaLoad=n2_dynamo_area_load) { Ele=Element1; Load1 = Revit.Element.GetParameterValueByName(Element1,DynamoAreaLoad); Load_1 = Load1 == ""?0:Load1; }
ZAxis = Vector.ZAxis()
copyElement = StructuralDesign.Model.Geometry.CopyElement(element=code_block_2.Ele, vector=ZAxis)
flatten = List.Flatten(list=copyElement)
code_block_3 = CodeBlock(A=n5_create_new_load_false_or, B=code_block_2.Ele, C=flatten) { A==true?B:C; }
flatten_2 = List.Flatten(list=code_block_3)
n3_load_case = RevitLoadCase()  # "3. Load Case"; nothing selected; graph input
n4_location_direction = StringInput("Fz 1")  # "4. Location Direction"; graph input
code_block_4 = CodeBlock(Element1=flatten_2, Load_Case=n3_load_case, Vec=n4_location_direction, Number1=code_block_2.Load_1)
# ---------- code_block_4.designscript (2 lines) ----------
Load1 = Revit.Element.SetParameterByName(Element1, "Load Case", Load_Case);
Load2 = Revit.Element.SetParameterByName(Element1, Vec, Number1);
# ----------------------------------------
code_block_5 = CodeBlock(A=n5_create_new_load_false_or, B=flatten) { A==true?B:null; }
deleteElement = StructuralDesign.Model.Geometry.DeleteElement(element=code_block_5)
