# Dynamo graph OBC_ANA_Set Clanding Wind load.dyn "Run - Set Clanding Wind load" (Dynamo 2.13.1.3887)
# author: Thach Toan Trung
# Select point to create uniform load for panel by TCVN 2737-1995 (Tạo tải trọng gió theo TCVN 2737-1995 lên bề mặt khi lựa chọn các nút)
# packages: Structural Design 2021.9.23

n1_rectangle_by_3_points = BoolSelector(false)  # "1. Rectangle by 3 points"; graph input
boolean = BoolSelector(true)
python_script_slect_anlytical = Python(IN[0]=boolean)  # "Python Script_Slect anlytical nodes"; IronPython2
# ---------- python_script_slect_anlytical.python (40 lines) ----------
""" Get Analytical Nodes """
import clr
clr.AddReference("RevitAPIUI")
from  Autodesk.Revit.UI.Selection import ObjectType, ISelectionFilter

clr.AddReference("RevitNodes")
import Revit
clr.ImportExtensions(Revit.Elements)

clr.AddReference("RevitServices")
import RevitServices
from RevitServices.Persistence import DocumentManager
doc = DocumentManager.Instance.CurrentDBDocument
uidoc = DocumentManager.Instance.CurrentUIApplication.ActiveUIDocument

# Code
def ListOrItems(lst):
    return lst[0] if len(lst) == 1 else lst
    
class RefPoint(ISelectionFilter):
    def __init__(self, category):
        self.category = category
    
    def AllowElement(self, element):
        if element.Category.Name == self.category:
            return True
        else:
            return False
    def AllowReference(self, reference, position):
        return False
flag = True
element_anlytical_nodes = []
while flag:
    try:
        ref_anlytical_nodes = uidoc.Selection.PickObject(ObjectType.Element, RefPoint("Analytical Nodes"), "Please Select Analytical Nodes")
        element_anlytical_nodes.append(doc.GetElement(ref_anlytical_nodes).ToDSType(True))
    except:
        flag = False
    
OUT = ListOrItems(element_anlytical_nodes)
# ----------------------------------------
geometry = Element.Geometry(element=python_script_slect_anlytical)
flatten = List.Flatten(list=geometry)
code_block = CodeBlock { false; }
clean = List.Clean(list=flatten, preserveIndices=code_block)
byPerimeterPoints = Surface.ByPerimeterPoints(points=clean)
code_block_2 = CodeBlock(A=n1_rectangle_by_3_points, F=byPerimeterPoints) { A==true?T:F; }  # unwired: T
bySurface = AnalyticalAutomation.AnalyticalElements.AnalyticalPanel.BySurface(surface=code_block_2)
code_block_3 = CodeBlock { 0.5; }
normalAtParameter = Surface.NormalAtParameter(surface=code_block_2, u=code_block_3, v=code_block_3)
n3_3_area_load = RevitAreaLoadType()  # "3.3. Area Load"; nothing selected; graph input
assign_area_load_python_script = Python(IN[0]=bySurface, IN[1]=normalAtParameter, IN[2]=n3_3_area_load)  # IronPython2
# ---------- assign_area_load_python_script.python (39 lines) ----------
import clr
clr.AddReference('ProtoGeometry')
from Autodesk.DesignScript.Geometry import *
#Import ToDSType(bool) extension method
clr.AddReference('RevitNodes')
import Revit
clr.ImportExtensions(Revit.GeometryConversion)
#Import DocumentManager and TransactionManager
clr.AddReference('RevitServices')
import RevitServices
from RevitServices.Persistence import DocumentManager
from RevitServices.Transactions import TransactionManager
from System.Collections.Generic import *
#import RevitAPI
clr.AddReference('RevitAPI')
import Autodesk
from Autodesk.Revit.DB import *
from Autodesk.Revit.DB.Structure import *
from System.Collections.Generic import *

def UwList(x):  # Cach 2
    return UnwrapElement(x if hasattr(x, "__iter__") else [x])
doc = DocumentManager.Instance.CurrentDBDocument
#The inputs to this node will be stored as a list in the IN variables.
Host=UwList(IN[0])
F=UnwrapElement(IN[1]).ToXyz()
loadtype=UnwrapElement(IN[2])
loads=[]
TransactionManager.Instance.EnsureInTransaction(doc)

for i in Host:
	a= AreaLoad.Create(doc,i.Id,F,loadtype)
	loads.append(a)
	
#End Transaction
TransactionManager.Instance.TransactionTaskDone()
	
#Assign your output to the OUT variable.
OUT = loads
# ----------------------------------------
code_block_4 = CodeBlock { "Load Case"; }
n3_3_set_for_clanding_external = BoolSelector(true)  # "3.3. Set for clanding External"; graph input
n3_1_set_wind_load_c = RevitLoadCase()  # "3.1. Set "Wind load C+""; nothing selected; graph input
n3_2_set_wind_load_c = RevitLoadCase()  # "3.2. Set "Wind load C-""; nothing selected; graph input
code_block_5 = CodeBlock(A=n3_3_set_for_clanding_external, WL1=n3_1_set_wind_load_c, WL2=n3_2_set_wind_load_c) { A==true?WL1:WL2; }
setParameterByName = Element.SetParameterByName(element=assign_area_load_python_script, parameterName=code_block_4, value=code_block_5)
Y = Vector.Y(vector=normalAtParameter)
code_block_6 = CodeBlock(Y=Y) { Y==0?"Fx 1":"Fy 1"; }
n2_3_wind_load_w_kn_msq = DoubleInput(0.95)  # "2.3. Wind load W (kN/msq)"; graph input
Z = Point.Z(point=clean)
maximumItem = List.MaximumItem(list=Z)
n2_1_hight_offset_from_earth_plan = DoubleInput(300)  # "2.1. Hight offset from Earth plan"; graph input
code_block_7 = CodeBlock(A=maximumItem, B=n2_1_hight_offset_from_earth_plan) { A-B; }
n2_2_catergory_a_b_or_c = StringInput("A")  # "2.2. Catergory: A,B or C"; graph input
code_block_8 = CodeBlock(A=n2_2_catergory_a_b_or_c) { A=="A"?250:A=="B"?300:400; A=="A"?0.07:A=="B"?0.09:0.14; }
code_block_9 = CodeBlock(z=code_block_7, Beta=code_block_8.out0) { (z/1000)/Beta; }
code_block_10 = CodeBlock(m1=code_block_8.out1) { 2*m1; }
pow = Math.Pow(number=code_block_9, power=code_block_10)
code_block_11 = CodeBlock(A=pow) { 1.844*A; }
n2_4_factor_c = DoubleInput(0.8)  # "2.4. Factor C+"; graph input
n2_6_factor_n = DoubleInput(1.2)  # "2.6. Factor n"; graph input
code_block_12 = CodeBlock(W=n2_3_wind_load_w_kn_msq, kz=code_block_11, c=n2_4_factor_c, n=n2_6_factor_n) { W*kz*c*n; }
code_block_13 = CodeBlock(A=n3_3_set_for_clanding_external, D=code_block_12) { A==true?D:D*-1; }
setParameterByName_2 = Element.SetParameterByName(element=setParameterByName, parameterName=code_block_6, value=code_block_13)
assign_area_load_python_script_2 = Python(IN[0]=bySurface, IN[1]=normalAtParameter, IN[2]=n3_3_area_load)  # IronPython2; same code as assign_area_load_python_script
code_block_14 = CodeBlock { "Load Case"; }
code_block_15 = CodeBlock(A=n3_3_set_for_clanding_external, WL2=n3_2_set_wind_load_c, WL1=n3_1_set_wind_load_c) { A==true?WL2:WL1; }
setParameterByName_3 = Element.SetParameterByName(element=assign_area_load_python_script_2, parameterName=code_block_14, value=code_block_15)
Y_2 = Vector.Y(vector=normalAtParameter)
code_block_16 = CodeBlock(Y=Y_2) { Y==0?"Fx 1":"Fy 1"; }
n2_5_factor_c = DoubleInput(-0.6)  # "2.5. Factor C-"; graph input
code_block_17 = CodeBlock(W=n2_3_wind_load_w_kn_msq, kz=code_block_11, c=n2_5_factor_c, n=n2_6_factor_n) { W*kz*c*n; }
code_block_18 = CodeBlock(A=n3_3_set_for_clanding_external, D=code_block_17) { A==true?D:D*-1; }
setParameterByName_4 = Element.SetParameterByName(element=setParameterByName_3, parameterName=code_block_16, value=code_block_18)
code_block_19 = CodeBlock(Z=code_block_7, kz=code_block_9, WLA=code_block_13, WLB=code_block_18)
# ---------- code_block_19.designscript (6 lines) ----------
A = "Z = " + Z +" (mm)";
B = "kz = "+ kz;
C = "TCVN 2737:1995 Wind load = W.kz.C.n";
D = "Wind load C+ = " + WLA +" (kN/msq)";
E = "Wind load C- = " + WLB +" (kN/msq)";
[A,B,C,D,E];
# ----------------------------------------
n4_output_data = Watch(code_block_19.out5)  # "4. Output data"; graph output
