# Dynamo graph OBC_ANA_Update Analysis Memeber section to Model.dyn "Run - Update Analysis Memeber section to Model" (Dynamo 2.16.1.2727)
# author: Thach Toan Trung
# packages: Structural Design 2022.12.15

n1_categories = Categories("OST_AnalyticalMember")  # "1. Categories"; graph input
all_elements_of_category = ElementsOfCategory(Category=n1_categories)
associatedElement = StructuralDesign.Model.AnalyticalToPhysicalAssociation.AssociatedElement(element=all_elements_of_category)
code_block = CodeBlock(t1=associatedElement) { List.Clean(t1==null?null:t1,false); }
code_block_2 = CodeBlock { "Type"; }
code_block_3 = CodeBlock(t1=associatedElement, Get_t1=all_elements_of_category) { List.Clean(t1==null?null:Get_t1,false); }
code_block_4 = CodeBlock { "Section Type"; }
getParameterValueByName = Element.GetParameterValueByName(element=code_block_3, parameterName=code_block_4)
setParameterByName = Element.SetParameterByName(element=code_block, parameterName=code_block_2, value=getParameterValueByName)
