# Dynamo graph OBC_ANA_Update section and material for analytical beam.dyn "Run - Update section and material for analytical beam" (Dynamo 2.16.1.2727)
# author: Thach Toan Trung
# Select multil model elements and analytical before run finish (Quét chọn đối tượng cấu kiện dầm và sơ đồ tính trước khi bấm Run)
# packages: GenerativeDesign.Revit 3.0.16.0, Structural Design 2022.12.15

n1_select_multiple_model_elements = DSModelElementMutlipleSelection()  # "1. Select Multiple Model Elements"; 249 picked in the model; graph input
code_block = CodeBlock(All_Elements=n1_select_multiple_model_elements)
# ---------- code_block.designscript (3 lines) ----------
Get_category=Revit.Element.GetParameterValueByName(All_Elements,"Category");
Get_Framing = Get_category+""=="Analytical Members"?All_Elements:null;
All_members=List.Clean(Get_Framing,false);
# ----------------------------------------
geometry = Element.Geometry(element=code_block.All_members)
flatten = List.Flatten(list=geometry)
flatten_2 = List.Flatten(list=flatten)
startPoint = Curve.StartPoint(curve=flatten_2)
endPoint = Curve.EndPoint(curve=flatten_2)
byTwoPoints = Vector.ByTwoPoints(start=startPoint, end=endPoint)
XAxis = Vector.XAxis()
ZAxis = Vector.ZAxis()
angleAboutAxis = Vector.AngleAboutAxis(vector=byTwoPoints, otherVector=XAxis, rotationAxis=ZAxis)
code_block_2 = CodeBlock(num5=angleAboutAxis) { t1 = num5 >= 45; t2 = num5 <= 135; t3 = t1 && t2; t4 = num5 >= 225; t5 = num5 <= 315; t6 = t4 && t5; t7 = t3 || t6; }
filterByBoolMask = List.FilterByBoolMask(list=code_block.All_members, mask=code_block_2.t7)
filterByBoolMask_2 = List.FilterByBoolMask(list=flatten, mask=code_block_2.t7)
code_block_3 = CodeBlock { 0.2..0.8..0.2; }
pointAtParameter = Curve.PointAtParameter(curve=filterByBoolMask_2.out, param=code_block_3, lacing=CrossProduct)
byPoints = NurbsCurve.ByPoints(points=pointAtParameter)
startPoint_2 = Curve.StartPoint(curve=byPoints)
n3_intersect_mm = DoubleInput(25)  # "3. Intersect (mm)"; graph input
endPoint_2 = Curve.EndPoint(curve=byPoints)
byTwoPoints_2 = Vector.ByTwoPoints(start=startPoint_2, end=endPoint_2)
byCenterPointRadiusNormal = Circle.ByCenterPointRadiusNormal(centerPoint=startPoint_2, radius=n3_intersect_mm, normal=byTwoPoints_2)
bySweep = Solid.BySweep(profile=byCenterPointRadiusNormal, path=byPoints)
code_block_4 = CodeBlock(All_Elements=n1_select_multiple_model_elements)
# ---------- code_block_4.designscript (7 lines) ----------
Get_category=Revit.Element.GetParameterValueByName(All_Elements,"Category");
Get_Framing = Get_category+""=="Structural Framing"?All_Elements:null;
All_members=List.Clean(Get_Framing,false);
Line_Frames = Revit.Element.GetLocation(All_members);
str1 = List.Flatten(String.Split(Line_Frames+"", ["Line"]));
str2 = List.Flatten(String.Split(str1, ["Arc"]));
re = List.Clean(Line_Frames+""==str2?null:All_members,false);
# ----------------------------------------
getLocation = Element.GetLocation(element=code_block_4.re)
startPoint_3 = Curve.StartPoint(curve=getLocation)
endPoint_3 = Curve.EndPoint(curve=getLocation)
byTwoPoints_3 = Vector.ByTwoPoints(start=startPoint_3, end=endPoint_3)
XAxis_2 = Vector.XAxis()
ZAxis_2 = Vector.ZAxis()
angleAboutAxis_2 = Vector.AngleAboutAxis(vector=byTwoPoints_3, otherVector=XAxis_2, rotationAxis=ZAxis_2)
code_block_5 = CodeBlock(num5=angleAboutAxis_2) { t1 = num5 >= 45; t2 = num5 <= 135; t3 = t1 && t2; t4 = num5 >= 225; t5 = num5 <= 315; t6 = t4 && t5; t7 = t3 || t6; }
filterByBoolMask_3 = List.FilterByBoolMask(list=code_block_4.re, mask=code_block_5.t7)
code_block_6 = CodeBlock { "y Justification"; }
getParameterValueByName = Element.GetParameterValueByName(element=filterByBoolMask_3.out, parameterName=code_block_6)
getLocation_2 = Element.GetLocation(element=filterByBoolMask_3.out)
code_block_7 = CodeBlock { 0.2..0.8..0.2; }
pointAtParameter_2 = Curve.PointAtParameter(curve=getLocation_2, param=code_block_7, lacing=CrossProduct)
byPoints_2 = NurbsCurve.ByPoints(points=pointAtParameter_2)
type = Python(IN[0]=filterByBoolMask_3.out)  # "Element.Type"; CPython3
# ---------- type.python (9 lines) ----------
import clr
clr.AddReference('DSCoreNodes')
from DSCore import List
clr.AddReference("RevitNodes")
def UwList(x):  # Cach 2
    return x if hasattr(x, "__iter__") else [x]
from Revit.Elements import Element

OUT = List.Flatten([item.ElementType for item in UwList(IN[0])])
# ----------------------------------------
n2_width_of_frame_string = StringInput("b")  # "2. Width of frame (string)"; graph input
code_block_8 = CodeBlock { ","; }
split = String.Split(string=n2_width_of_frame_string, separator0=code_block_8)
getParameterValueByName_2 = Element.GetParameterValueByName(element=type, parameterName=split, lacing=CrossProduct)
code_block_9 = CodeBlock(IN0=getParameterValueByName_2) { List.Flatten(List.Clean(IN0==""?null:IN0,false)); }
code_block_10 = CodeBlock(y=getParameterValueByName, b=code_block_9) { y==0?b:y==3?-b:b; }
extrude = Curve.Extrude(curve=byPoints_2, distance=code_block_10)
code_block_11 = CodeBlock { 0.5; }
pointAtParameter_3 = Curve.PointAtParameter(curve=byPoints_2, param=code_block_11)
code_block_12 = CodeBlock { 0.5; }
pointAtParameter_4 = Surface.PointAtParameter(surface=extrude, u=code_block_12, v=code_block_12)
byTwoPoints_4 = Vector.ByTwoPoints(start=pointAtParameter_3, end=pointAtParameter_4)
code_block_13 = CodeBlock(b=code_block_10) { b/2; }
translate = Geometry.Translate(geometry=byPoints_2, direction=byTwoPoints_4, distance=code_block_13)
reverse = Vector.Reverse(vector=byTwoPoints_4)
extrude_2 = Curve.Extrude(curve=translate, direction=reverse, distance=code_block_9)
code_block_14 = CodeBlock(y=getParameterValueByName, LineA=extrude, LineB=extrude_2) { y==0||y==3?LineA:LineB; }
code_block_15 = CodeBlock { 300; }
thicken = Surface.Thicken(surface=code_block_14, thickness=code_block_15)
join = List.Join(list0=thicken, list1=bySweep)
flatten_3 = List.Flatten(list=join)
doesIntersect = Geometry.DoesIntersect(geometry=flatten_3, other=flatten_3, lacing=CrossProduct)
boolean = BoolSelector(true)
allIndicesOf = List.AllIndicesOf(list=doesIntersect@L2, item=boolean)
sort = List.Sort(list=allIndicesOf)
python_script = Python(IN[0]=sort)  # IronPython2
# ---------- python_script.python (19 lines) ----------
intersections = IN[0]

out = []
while len(intersections) > 0:
	first, rest = intersections[0], intersections[1:]
	first = set(first)
	lf = -1
	while len(first) > lf:
		lf = len(first)
		rest2 = []
		for r in rest:
			if len(first.intersection(set(r))) > 0:
				first |= set(r)
			else:
				rest2.append(r)     
		rest = rest2
	out.append(first)
	intersections = rest
OUT = out
# ----------------------------------------
getItemAtIndex = List.GetItemAtIndex(list=flatten_3, index=python_script)
count = List.Count(list=getItemAtIndex@L2)
code_block_16 = CodeBlock(IN0=count, IN1=getItemAtIndex) { List.Clean(IN0>1?IN1:null,false); }
indexOf = List.IndexOf(list=bySweep, element=code_block_16)
code_block_17 = CodeBlock(IN0=indexOf) { List.Clean(IN0==-1?null:IN0,false); }
getItemAtIndex_2 = List.GetItemAtIndex(list=bySweep, index=code_block_17)
indexOf_2 = List.IndexOf(list=bySweep, element=getItemAtIndex_2)
getItemAtIndex_3 = List.GetItemAtIndex(list=filterByBoolMask.out, index=indexOf_2)
code_block_18 = CodeBlock { "Section Type"; "Structural Material"; "Comments"; }
indexOf_3 = List.IndexOf(list=thicken, element=code_block_16)
code_block_19 = CodeBlock(IN0=indexOf_3) { List.Clean(IN0==-1?null:IN0,false); }
getItemAtIndex_4 = List.GetItemAtIndex(list=thicken, index=code_block_19)
firstItem = List.FirstItem(list=getItemAtIndex_4@L2)
indexOf_4 = List.IndexOf(list=thicken, element=firstItem)
getItemAtIndex_5 = List.GetItemAtIndex(list=filterByBoolMask_3.out, index=indexOf_4)
code_block_20 = CodeBlock { "Type"; }
getParameterValueByName_3 = Element.GetParameterValueByName(element=getItemAtIndex_5, parameterName=code_block_20)
setParameterByName = Element.SetParameterByName(element=getItemAtIndex_3, parameterName=code_block_18.out0, value=getParameterValueByName_3)
getMaterials = Element.GetMaterials(element=getItemAtIndex_5)
flatten_4 = List.Flatten(list=getMaterials)
setParameterByName_2 = Element.SetParameterByName(element=setParameterByName, parameterName=code_block_18.out1, value=flatten_4)
id = Element.Id(element=getItemAtIndex_5)
code_block_21 = CodeBlock(ID=id) { ID+""; }
setParameterByName_3 = Element.SetParameterByName(element=setParameterByName_2, parameterName=code_block_18.out2, value=code_block_21)
associateElement = StructuralDesign.Model.AnalyticalModel.AnalyticalMember.AssociateElement(analyticalMember=setParameterByName_3, physicalMember=getItemAtIndex_5)
code_block_22 = CodeBlock { 0.2..0.8..0.2; }
pointAtParameter_5 = Curve.PointAtParameter(curve=filterByBoolMask_2.in, param=code_block_22, lacing=CrossProduct)
byPoints_3 = NurbsCurve.ByPoints(points=pointAtParameter_5)
startPoint_4 = Curve.StartPoint(curve=byPoints_3)
endPoint_4 = Curve.EndPoint(curve=byPoints_3)
byTwoPoints_5 = Vector.ByTwoPoints(start=startPoint_4, end=endPoint_4)
byCenterPointRadiusNormal_2 = Circle.ByCenterPointRadiusNormal(centerPoint=startPoint_4, radius=n3_intersect_mm, normal=byTwoPoints_5)
bySweep_2 = Solid.BySweep(profile=byCenterPointRadiusNormal_2, path=byPoints_3)
code_block_23 = CodeBlock { "y Justification"; }
getParameterValueByName_4 = Element.GetParameterValueByName(element=filterByBoolMask_3.in, parameterName=code_block_23)
getLocation_3 = Element.GetLocation(element=filterByBoolMask_3.in)
code_block_24 = CodeBlock { 0.2..0.8..0.2; }
pointAtParameter_6 = Curve.PointAtParameter(curve=getLocation_3, param=code_block_24, lacing=CrossProduct)
byPoints_4 = NurbsCurve.ByPoints(points=pointAtParameter_6)
type_2 = Python(IN[0]=filterByBoolMask_3.in)  # "Element.Type"; CPython3; same code as type
getParameterValueByName_5 = Element.GetParameterValueByName(element=type_2, parameterName=split, lacing=CrossProduct)
code_block_25 = CodeBlock(IN0=getParameterValueByName_5) { List.Flatten(List.Clean(IN0==""?null:IN0,false)); }
code_block_26 = CodeBlock(y=getParameterValueByName_4, b=code_block_25) { y==0?b:y==3?-b:b; }
extrude_3 = Curve.Extrude(curve=byPoints_4, distance=code_block_26)
code_block_27 = CodeBlock { 0.5; }
pointAtParameter_7 = Curve.PointAtParameter(curve=byPoints_4, param=code_block_27)
code_block_28 = CodeBlock { 0.5; }
pointAtParameter_8 = Surface.PointAtParameter(surface=extrude_3, u=code_block_28, v=code_block_28)
byTwoPoints_6 = Vector.ByTwoPoints(start=pointAtParameter_7, end=pointAtParameter_8)
code_block_29 = CodeBlock(b=code_block_26) { b/2; }
translate_2 = Geometry.Translate(geometry=byPoints_4, direction=byTwoPoints_6, distance=code_block_29)
reverse_2 = Vector.Reverse(vector=byTwoPoints_6)
extrude_4 = Curve.Extrude(curve=translate_2, direction=reverse_2, distance=code_block_25)
code_block_30 = CodeBlock(y=getParameterValueByName_4, LineA=extrude_3, LineB=extrude_4) { y==0||y==3?LineA:LineB; }
code_block_31 = CodeBlock { 300; }
thicken_2 = Surface.Thicken(surface=code_block_30, thickness=code_block_31)
join_2 = List.Join(list0=thicken_2, list1=bySweep_2)
flatten_5 = List.Flatten(list=join_2)
doesIntersect_2 = Geometry.DoesIntersect(geometry=flatten_5, other=flatten_5, lacing=CrossProduct)
boolean_2 = BoolSelector(true)
allIndicesOf_2 = List.AllIndicesOf(list=doesIntersect_2@L2, item=boolean_2)
sort_2 = List.Sort(list=allIndicesOf_2)
python_script_2 = Python(IN[0]=sort_2)  # IronPython2; same code as python_script
getItemAtIndex_6 = List.GetItemAtIndex(list=flatten_5, index=python_script_2)
count_2 = List.Count(list=getItemAtIndex_6@L2)
code_block_32 = CodeBlock(IN0=count_2, IN1=getItemAtIndex_6) { List.Clean(IN0>1?IN1:null,false); }
indexOf_5 = List.IndexOf(list=bySweep_2, element=code_block_32)
code_block_33 = CodeBlock(IN0=indexOf_5) { List.Clean(IN0==-1?null:IN0,false); }
getItemAtIndex_7 = List.GetItemAtIndex(list=bySweep_2, index=code_block_33)
indexOf_6 = List.IndexOf(list=bySweep_2, element=getItemAtIndex_7)
getItemAtIndex_8 = List.GetItemAtIndex(list=filterByBoolMask.in, index=indexOf_6)
code_block_34 = CodeBlock { "Section Type"; "Structural Material"; "Comments"; }
indexOf_7 = List.IndexOf(list=thicken_2, element=code_block_32)
code_block_35 = CodeBlock(IN0=indexOf_7) { List.Clean(IN0==-1?null:IN0,false); }
getItemAtIndex_9 = List.GetItemAtIndex(list=thicken_2, index=code_block_35)
firstItem_2 = List.FirstItem(list=getItemAtIndex_9@L2)
indexOf_8 = List.IndexOf(list=thicken_2, element=firstItem_2)
getItemAtIndex_10 = List.GetItemAtIndex(list=filterByBoolMask_3.in, index=indexOf_8)
code_block_36 = CodeBlock { "Type"; }
getParameterValueByName_6 = Element.GetParameterValueByName(element=getItemAtIndex_10, parameterName=code_block_36)
setParameterByName_4 = Element.SetParameterByName(element=getItemAtIndex_8, parameterName=code_block_34.out0, value=getParameterValueByName_6)
getMaterials_2 = Element.GetMaterials(element=getItemAtIndex_10)
flatten_6 = List.Flatten(list=getMaterials_2)
setParameterByName_5 = Element.SetParameterByName(element=setParameterByName_4, parameterName=code_block_34.out1, value=flatten_6)
id_2 = Element.Id(element=getItemAtIndex_10)
code_block_37 = CodeBlock(ID=id_2) { ID+""; }
setParameterByName_6 = Element.SetParameterByName(element=setParameterByName_5, parameterName=code_block_34.out2, value=code_block_37)
associateElement_2 = StructuralDesign.Model.AnalyticalModel.AnalyticalMember.AssociateElement(analyticalMember=setParameterByName_6, physicalMember=getItemAtIndex_10)
join_3 = List.Join(list0=setParameterByName_6, list1=setParameterByName_3)
boolean_3 = BoolSelector(false)
clean = List.Clean(list=join_3, preserveIndices=boolean_3)
n4_structural_roles = StructuralRoleComboBox("Beam")  # "4. Structural Roles"; graph input
setStructuralRole = StructuralDesign.Model.AnalyticalModel.AnalyticalMember.SetStructuralRole(analiticalMember=clean, structuralRole=n4_structural_roles)
