# Dynamo graph OBC_ANA_Update section and material for analytical colums.dyn "Run - Update section and material for analytical colums" (Dynamo 2.16.1.2727)
# author: Thach Toan Trung
# Select multil model elements and analytical before run finish (Quét chọn đối tượng cấu kiện cột và sơ đồ tính trước khi bấm Run)
# packages: GenerativeDesign.Revit 4.0.5.0, Structural Design 2022.12.15

n1_select_multiple_model_elements = DSModelElementMutlipleSelection()  # "1. Select Multiple Model Elements"; 265 picked in the model; graph input
code_block = CodeBlock(All_Elements=n1_select_multiple_model_elements)
# ---------- code_block.designscript (3 lines) ----------
Get_category=Revit.Element.GetParameterValueByName(All_Elements,"Category");
Get_Framing = Get_category+""=="Structural Columns"?All_Elements:null;
All_members=List.Clean(Get_Framing,false);
# ----------------------------------------
getActualLocation = AnalyticalAutomation.RevitElements.Element.GetActualLocation(element=code_block.All_members)
code_block_2 = CodeBlock(A=getActualLocation) { A+""; }
code_block_3 = CodeBlock { "Line"; }
split = String.Split(string=code_block_2, separator0=code_block_3)
flatten = List.Flatten(list=split)
code_block_4 = CodeBlock(A=code_block_2, B=flatten, GetelementA=code_block.All_members) { List.Clean(A!=B?GetelementA:null,false); }
getActualLocation_2 = AnalyticalAutomation.RevitElements.Element.GetActualLocation(element=code_block_4)
code_block_5 = CodeBlock { 0.2..0.8..0.2; }
pointAtParameter = Curve.PointAtParameter(curve=getActualLocation_2, param=code_block_5, lacing=CrossProduct)
byPoints = NurbsCurve.ByPoints(points=pointAtParameter)
startPoint = Curve.StartPoint(curve=byPoints)
n3_intersect_mm = DoubleInput(300)  # "3. Intersect (mm)"; graph input
code_block_6 = CodeBlock(A=n3_intersect_mm) { 10+A; }
endPoint = Curve.EndPoint(curve=byPoints)
byTwoPoints = Vector.ByTwoPoints(start=startPoint, end=endPoint)
byCenterPointRadiusNormal = Circle.ByCenterPointRadiusNormal(centerPoint=startPoint, radius=code_block_6, normal=byTwoPoints)
bySweep = Solid.BySweep(profile=byCenterPointRadiusNormal, path=byPoints)
code_block_7 = CodeBlock(All_Elements=n1_select_multiple_model_elements)
# ---------- code_block_7.designscript (3 lines) ----------
Get_category=Revit.Element.GetParameterValueByName(All_Elements,"Category");
Get_Framing = Get_category+""=="Analytical Members"?All_Elements:null;
All_members=List.Clean(Get_Framing,false);
# ----------------------------------------
geometry = Element.Geometry(element=code_block_7.All_members)
flatten_2 = List.Flatten(list=geometry)
code_block_8 = CodeBlock { 0.2..0.8..0.2; }
pointAtParameter_2 = Curve.PointAtParameter(curve=flatten_2, param=code_block_8, lacing=CrossProduct)
byPoints_2 = NurbsCurve.ByPoints(points=pointAtParameter_2)
startPoint_2 = Curve.StartPoint(curve=byPoints_2)
endPoint_2 = Curve.EndPoint(curve=byPoints_2)
byTwoPoints_2 = Vector.ByTwoPoints(start=startPoint_2, end=endPoint_2)
byCenterPointRadiusNormal_2 = Circle.ByCenterPointRadiusNormal(centerPoint=startPoint_2, radius=n3_intersect_mm, normal=byTwoPoints_2)
bySweep_2 = Solid.BySweep(profile=byCenterPointRadiusNormal_2, path=byPoints_2)
join = List.Join(list0=bySweep, list1=bySweep_2)
flatten_3 = List.Flatten(list=join)
doesIntersect = Geometry.DoesIntersect(geometry=flatten_3, other=flatten_3, lacing=CrossProduct)
boolean = BoolSelector(true)
allIndicesOf = List.AllIndicesOf(list=doesIntersect@L2, item=boolean)
sort = List.Sort(list=allIndicesOf)
python_script = Python(IN[0]=sort)  # IronPython2
# ---------- python_script.python (19 lines) ----------
intersections = IN[0]

out = []
while len(intersections) > 0:
	first, rest = intersections[0], intersections[1:]
	first = set(first)
	lf = -1
	while len(first) > lf:
		lf = len(first)
		rest2 = []
		for r in rest:
			if len(first.intersection(set(r))) > 0:
				first |= set(r)
			else:
				rest2.append(r)     
		rest = rest2
	out.append(first)
	intersections = rest
OUT = out
# ----------------------------------------
getItemAtIndex = List.GetItemAtIndex(list=flatten_3, index=python_script)
count = List.Count(list=getItemAtIndex@L2)
code_block_9 = CodeBlock(IN0=count, IN1=getItemAtIndex) { List.Clean(IN0>1?IN1:null,false); }
volume = Solid.Volume(solid=code_block_9)
sortByKey = List.SortByKey(list=code_block_9@L2, keys=volume@L2)
lastItem = List.LastItem(list=sortByKey.sortedList@L2)
indexOf = List.IndexOf(list=bySweep, element=lastItem)
getItemAtIndex_2 = List.GetItemAtIndex(list=code_block_4, index=indexOf)
code_block_10 = CodeBlock(in0=getItemAtIndex_2) { List.Clean(List.Flatten(in0),false); }
firstItem = List.FirstItem(list=sortByKey.sortedList@L2)
indexOf_2 = List.IndexOf(list=bySweep_2, element=firstItem)
getItemAtIndex_3 = List.GetItemAtIndex(list=code_block_7.All_members, index=indexOf_2)
code_block_11 = CodeBlock { "Section Type"; "Structural Material"; "Cross-Section Rotation"; }
elementType = Element.ElementType(element=code_block_10)
setParameterByName = Element.SetParameterByName(element=getItemAtIndex_3, parameterName=code_block_11.out0, value=elementType)
getMaterials = Element.GetMaterials(element=code_block_10)
flatten_4 = List.Flatten(list=getMaterials)
setParameterByName_2 = Element.SetParameterByName(element=setParameterByName, parameterName=code_block_11.out1, value=flatten_4)
code_block_12 = CodeBlock { "Fix Edge 2"; }
getParameterValueByName = Element.GetParameterValueByName(element=code_block_10, parameterName=code_block_12)
python_script_2 = Python(IN[0]=code_block_10)  # IronPython2
# ---------- python_script_2.python (18 lines) ----------
import clr
from math import degrees
clr.AddReference('RevitAPI')
from Autodesk.Revit.DB import LocationPoint

##########################################################
""" Get Rotation columns"""

def UwList(x):  # Cach 2
    return UnwrapElement(x if hasattr(x, "__iter__") else [x])
def GetRotationColumns(items):  # Get Rotation colums
    rotaion_columns = []
    for i in items:
        if i.Location.ToString() == "Autodesk.Revit.DB.LocationPoint":
            if hasattr(i.Location, "Rotation"):
                rotaion_columns.append(degrees(i.Location.Rotation))
    return rotaion_columns
OUT = GetRotationColumns(UwList(IN[0]))
# ----------------------------------------
code_block_13 = CodeBlock { 5; }
round = Math.Round(number=python_script_2, digits=code_block_13)
code_block_14 = CodeBlock(A=getParameterValueByName, RotateElement=round) { A==0?360-RotateElement:270-RotateElement; }
setParameterByName_3 = Element.SetParameterByName(element=setParameterByName_2, parameterName=code_block_11.out2, value=code_block_14)
code_block_15 = CodeBlock(Get_collumn=code_block_10, elemenAll_Framing=setParameterByName_3)
# ---------- code_block_15.designscript (2 lines) ----------
ID_Element = Revit.Element.Id(Get_collumn);
Final_Element=Revit.Element.SetParameterByName(elemenAll_Framing,"Comments",ID_Element+"");
# ----------------------------------------
n2_structural_roles = StructuralRoleComboBox("Column")  # "2. Structural Roles"; graph input
setStructuralRole = StructuralDesign.Model.AnalyticalModel.AnalyticalMember.SetStructuralRole(analiticalMember=code_block_15.Final_Element, structuralRole=n2_structural_roles)
associateElement = StructuralDesign.Model.AnalyticalModel.AnalyticalMember.AssociateElement(analyticalMember=getItemAtIndex_3, physicalMember=getItemAtIndex_2)
