# Dynamo graph SPCC_AutoJoint.dyn (Dynamo 2.19.3.6394)
# packages: Hot Gear 2017.11.9

categories_a = Categories("OST_StructuralFraming")  # graph input
all_elements_of_category = ElementsOfCategory(Category=categories_a)
categories_b = Categories("OST_StructuralColumns")  # graph input
all_elements_of_category_2 = ElementsOfCategory(Category=categories_b)
list_create = List.Create(item0=all_elements_of_category, item1=all_elements_of_category_2)
join_geometry = Custom[Join Geometry](Elementlist=list_create)  # package Hot Gear; Join Selected Geometry
