# Dynamo graph SPCC_CopyAllFilters.dyn (Dynamo 2.13.1.3887)
# packages: Modelical 2022.6.15

views = Views("B1.Y0-ប្លង់កាត់១-១")  # graph input
views_2 = Views("{3D}")  # graph input
copyAllFilters = Custom[View.CopyAllFilters](sourceView=views, targetViews=views_2)  # package Modelical; This node copies all the filters with their settings from a view to another one.
