# Dynamo graph SPCC_CreateFileShareParasFromExcel.dyn (Dynamo 2.17.0.3472)

file_path = Filename("..\..\..\..\..\18_OCC-OnecadCambodia\05_Standard\DYN_200309_SharedParams2021.xlsx")  # graph input
file_from_path = FileObject(path=file_path)
code_block = CodeBlock { "10-SPA"; true; false; }
importExcel = Data.ImportExcel(file=file_from_path, sheetName=code_block.out0, readAsStrings=code_block.out1, showExcel=code_block.out2)
code_block_2 = CodeBlock { 1; }
dropItems = List.DropItems(list=importExcel, amount=code_block_2)
transpose = List.Transpose(lists=dropItems)
string_from_object = FromObject(object=transpose)
code_block_3 = CodeBlock { "null"; }
eq = string_from_object == code_block_3
filterByBoolMask = List.FilterByBoolMask(list=transpose, mask=eq)
code_block_4 = CodeBlock(a=filterByBoolMask.out) { a; }
code_block_5 = CodeBlock(lst=code_block_4) { Pnames = lst[0]; Groups = lst[1]; Ptypes = lst[2]; }
code_block_6 = CodeBlock { "PG_TEXT"; false; }
categories = Categories("OST_StructuralFoundation")  # graph input
createSharedParameter = Parameter.CreateSharedParameter(parameterName=code_block_5.Pnames, groupName=code_block_5.Groups, specType=code_block_5.Ptypes, groupType=code_block_6.out0, instance=code_block_6.out1, categoryList=categories, lacing=Longest)
code_block_7 = CodeBlock(a=code_block_5.Ptypes) { a; }
createSharedParameterForAllCategories = Parameter.CreateSharedParameterForAllCategories()  # unwired: parameterName, groupName, specType, groupType, instance
createSharedParameter_2 = Parameter.CreateSharedParameter()  # unwired: parameterName, groupName, specType, groupType, instance, categoryList
