# Dynamo graph SPCC_CreateFilter.dyn (Dynamo 2.13.1.3887)
# packages: Synthesize toolkit 11.9.6, Rhythm 2021.1.1, Genius Loci 2022.9.16

categories = Categories("OST_Rebar")
all_elements_of_category = ElementsOfCategory(Category=categories)
string = StringInput("Partition")
parameterByName = Parameter.ParameterByName(element=all_elements_of_category, name=string)
uniqueItems = List.UniqueItems(list=parameterByName)
isNull = Object.IsNull(object=uniqueItems)
filterByBoolMask = List.FilterByBoolMask(list=uniqueItems, mask=isNull)
code_block = CodeBlock(a=filterByBoolMask.out) { a; }
value = Parameter.Value(parameter=code_block)
uniqueItems_2 = List.UniqueItems(list=value)
hot_get_all_filter = Custom[HOT.Get All Filter]()  # package Synthesize toolkit; Get all Filter
code_block_2 = CodeBlock(a=hot_get_all_filter.VARName) { a; }
setDifference = List.SetDifference(list1=uniqueItems_2, list2=code_block_2)
select_rule_type = RuleTypes("NotEquals")
byRuleType = Revit.Filter.FilterRule.ByRuleType(type=select_rule_type, value=setDifference, parameter=code_block)
count = List.Count(list=byRuleType)
cycle = List.Cycle(list=categories, amount=count)
byRules = Revit.Filter.ParameterFilterElement.ByRules(name=setDifference, categories=cycle, rules=byRuleType, lacing=Shortest)
code_block_3 = CodeBlock(a=hot_get_all_filter.VARElement) { a; }
viewFamilyTypes = ViewFamilyTypes("CRK_SSH_BEAM")
all_elements_of_type = Custom[All Elements of Type+](type=viewFamilyTypes)  # package Genius Loci; Get the instances of the given type. Works with ElementType, FamilyType, ViewFamilyType, Wall/Floor/Roof/CeilingType, GroupType, FilledRegionType and TextNoteType.
name = Element.Name(element=all_elements_of_type)
code_block_4 = CodeBlock { "B"; }
contains = String.Contains(string=name, searchFor=code_block_4)
filterByBoolMask_2 = List.FilterByBoolMask(list=name, mask=contains)
code_block_5 = CodeBlock(a=filterByBoolMask_2.in) { a; }
code_block_6 = CodeBlock { "-"; }
split = String.Split(string=code_block_5, separator0=code_block_6)
code_block_7 = CodeBlock { 0; }
getItemAtIndex = List.GetItemAtIndex(list=split@L2, index=code_block_7)
setDifference_2 = List.SetDifference(list1=setDifference, list2=getItemAtIndex)
addFilter = View.AddFilter(parameterFilter=setDifference_2)  # frozen; unwired: view
sortByKey = List.SortByKey()  # unwired: list, keys
code_block_8 = CodeBlock { 1; }
getItemAtIndex_2 = List.GetItemAtIndex(list=split@L2, index=code_block_8)
code_block_9 = CodeBlock(a=getItemAtIndex_2) { a[1]; }
count_2 = List.Count(list=setDifference_2)
cycle_2 = List.Cycle(list=code_block_9, amount=count_2)
code_block_10 = CodeBlock(a=setDifference_2, b=cycle_2) { a+"-"+b; }
code_block_11 = CodeBlock { true; }
view_byname = Custom[View ByName](ViewName=code_block_10, DoesContain=code_block_11)  # package Genius Loci; Collect views by given name in the active or given document. Based on a Christian Gartland's script.
