# Dynamo graph SPCC_CreatingSeparateClashViews_V219.dyn (Dynamo 2.19.3.6394)
# packages: PracticalBIM 2020.0.43, Rhythm 2020.9.8, archi-lab.net 2020.23.11, spring nodes 204.1.0, Clockwork for Dynamo 2.x 2.6.0

views = Views("{3D}")
categories = Categories("OST_GenericModel")
all_elements_of_category = ElementsOfCategory(Category=categories)
string_from_object = FromObject(obj=all_elements_of_category)
code_block = CodeBlock { "Clash Sphere"; }
contains = String.Contains(string=string_from_object, searchFor=code_block)
filterByBoolMask = List.FilterByBoolMask(list=all_elements_of_category, mask=contains)
code_block_2 = CodeBlock(a=filterByBoolMask.in) { a; }
code_block_3 = CodeBlock { "LevelC"; }
getParameterValueByName = Element.GetParameterValueByName(element=code_block_2, parameterName=code_block_3)
sortByKey = List.SortByKey(list=filterByBoolMask.in, keys=getParameterValueByName)
groupByKey = List.GroupByKey(list=sortByKey.sortedList, keys=sortByKey.sortedKeys)
code_block_4 = CodeBlock(a=groupByKey.groups) { a; }
code_block_5 = CodeBlock { "LevelC"; }
getParameterValueByName_2 = Element.GetParameterValueByName(element=code_block_4, parameterName=code_block_5)
code_block_6 = CodeBlock { "ID"; }
getParameterValueByName_3 = Element.GetParameterValueByName(element=groupByKey.groups, parameterName=code_block_6)
code_block_7 = CodeBlock(a=getParameterValueByName_3) { "Clash "+a; }
code_block_8 = CodeBlock(a=getParameterValueByName_2, b=code_block_7) { a+"_"+b; }
duplicateView = Custom[DuplicateView](SelectecViews=views, NewNames=code_block_8, lacing=Longest)  # package PracticalBIM; Creates a Duplicate from any View
getLocation = Element.GetLocation(element=code_block_2)
code_block_9 = CodeBlock { "Radius"; }
getParameterValueByName_4 = Element.GetParameterValueByName(element=code_block_2, parameterName=code_block_9)
code_block_10 = CodeBlock(a=getParameterValueByName_4) { a*6; }
byLengths = Cuboid.ByLengths(origin=getLocation, width=code_block_10, length=code_block_10, height=code_block_10)
byGeometry = BoundingBox.ByGeometry(geom=byLengths, lacing=Shortest)
code_block_11 = CodeBlock { -1.5; }
ꟿ_boundingbox_scale = Custom[ꟿ BoundingBox.Scale](boundingBox=byGeometry, xAmmount=code_block_11, yAmmount=code_block_11, zAmmount=code_block_11)  # package spring nodes; Scales the bounding box in three dimensions according to it's center.
setSectionBox = Custom[View3D.SetSectionBox](view3D=duplicateView, boundingBox=ꟿ_boundingbox_scale)  # package Clockwork for Dynamo 2.x; Sets the section box of a given 3D view to the extents of a given bounding box
flatten = List.Flatten(list=setSectionBox)
code_block_12 = CodeBlock { 50; }
setScale = View.SetScale(view=flatten, scale=code_block_12, lacing=Longest)
ʳʰʸᵗʰᵐ_view_getcropregionelement = Rhythm.Revit.Views.View.GetCropRegionElement(view=flatten)
setCropBox = archilab.Revit.Views.Views.SetCropBox(view=flatten, boundingBox=ꟿ_boundingbox_scale)
getCropBoxCurvesfromView = Custom[GetCropBoxCurvesfromView](views=setCropBox)  # package PracticalBIM; Gets the Crop Boxes as Curves from View
boundingBoxCentroid = Custom[BoundingBoxCentroid](boundingBox=ꟿ_boundingbox_scale)  # package PracticalBIM; Gives the Centroid of a Bounding Box
projectedLocationofCentroidonaCropBox = Custom[ProjectedLocationofCentroidonaCropBox](curves=getCropBoxCurvesfromView, geometryToProject=boundingBoxCentroid, lacing=Longest)  # package PracticalBIM; Useitto project a centroid to a cropbox
flatten_2 = List.Flatten(list=projectedLocationofCentroidonaCropBox)
moveByVector = Element.MoveByVector(element=ʳʰʸᵗʰᵐ_view_getcropregionelement, vector=flatten_2)
