# Dynamo graph SPCC_DimColumn.dyn (Dynamo 2.19.3.6394)
# packages: Genius Loci 2021.4.13, Data-Shapes 2021.2.94

# group: View
current = Document.Current()
activeView = Document.ActiveView(document=current)

categories = Categories("OST_Grids")
categories_2 = Categories("OST_StructuralColumns")
list_create = List.Create(item0=categories, item1=categories_2)
boolean = BoolSelector(true)
select_model_elements_of = Custom[Select Model Elements of Category](Categories=list_create, Toggle=boolean)  # package Data-Shapes; Allows to perform a manual selection with a category filter.

# group: Structural Columns
getCategory = Element.GetCategory(element=select_model_elements_of)
string_from_object = FromObject(obj=getCategory)
code_block = CodeBlock { "Structural Columns"; }
eq = string_from_object == code_block
filterByBoolMask = List.FilterByBoolMask(list=select_model_elements_of, mask=eq)
faces = Element.Faces(element=filterByBoolMask.in)

# group: Face X min (lấy các mặt phẳng theo phương X nằm bên trái)
code_block_2 = CodeBlock { 0.5; }
pointAtParameter = Surface.PointAtParameter(surface=faces, u=code_block_2, v=code_block_2)
X = Point.X(point=pointAtParameter)
sortIndexByValue = List.SortIndexByValue(list=X)
getItemAtIndex = List.GetItemAtIndex(list=faces@L2, index=sortIndexByValue@L2)
firstItem = List.FirstItem(list=getItemAtIndex@L2)

# group: Create Line
getItemAtIndex_2 = List.GetItemAtIndex(list=pointAtParameter@L2, index=sortIndexByValue@L2)
firstItem_2 = List.FirstItem(list=getItemAtIndex_2@L2)
X_2 = Point.X(point=firstItem_2)
dim_offset_1_horizontal = DoubleInput(1000)  # graph input
code_block_3 = CodeBlock(b=X_2, a=dim_offset_1_horizontal) { b+a; }
code_block_4 = CodeBlock(b=X_2, a=dim_offset_1_horizontal) { b+a; }
Z = Point.Z(point=firstItem_2)
byCoordinates = Point.ByCoordinates(x=code_block_3, y=code_block_4, z=Z)
byCoordinates_2 = Point.ByCoordinates(x=X_2, y=code_block_4, z=Z)
byStartPointEndPoint = Line.ByStartPointEndPoint(startPoint=byCoordinates, endPoint=byCoordinates_2)
dim_offset_2_horizontal = DoubleInput(500)  # graph input
code_block_5 = CodeBlock(b=X_2, a=dim_offset_2_horizontal) { b+a; }
Y = Point.Y(point=firstItem_2)
code_block_6 = CodeBlock(b=Y, a=dim_offset_2_horizontal) { b+a; }
byCoordinates_3 = Point.ByCoordinates(x=code_block_5, y=code_block_6, z=Z)
byCoordinates_4 = Point.ByCoordinates(x=X_2, y=code_block_6, z=Z)
byStartPointEndPoint_2 = Line.ByStartPointEndPoint(startPoint=byCoordinates_3, endPoint=byCoordinates_4)

# group: Surface to Reference X min
create = List.Create(item0=firstItem)
flatten = List.Flatten(list=create)
python_script = Python(IN[0]=flatten)  # IronPython2
# ---------- python_script.python (13 lines) ----------
import clr
clr.AddReference('RevitAPI')
from Autodesk.Revit.DB import *

faces = UnwrapElement(IN[0])
elementlist = list()
for face in faces:
	try:
		ref = face.Tags.LookupTag("RevitFaceReference")
		elementlist.append(ref)
	except:
		elementlist.append(list())
OUT = elementlist
# ----------------------------------------
python_script_2 = Python(IN[0]=firstItem, IN[1]=python_script)  # IronPython2
# ---------- python_script_2.python (4 lines) ----------
check = IN[0]
items = IN[1]
if isinstance(check, (list)): OUT = items
else: OUT = items[0]
# ----------------------------------------

# group: Face X max (Lấy các mặt phăng nằm phương X bên tay phải)
code_block_7 = CodeBlock { 0.5; }
pointAtParameter_2 = Surface.PointAtParameter(surface=faces, u=code_block_7, v=code_block_7)
X_3 = Point.X(point=pointAtParameter_2)
sortIndexByValue_2 = List.SortIndexByValue(list=X_3)
getItemAtIndex_3 = List.GetItemAtIndex(list=faces@L2, index=sortIndexByValue_2@L2)
lastItem = List.LastItem(list=getItemAtIndex_3@L2)

# group: Surface to Reference X max
create_2 = List.Create(item0=lastItem)
flatten_2 = List.Flatten(list=create_2)
python_script_3 = Python(IN[0]=flatten_2)  # IronPython2; same code as python_script
python_script_4 = Python(IN[0]=lastItem, IN[1]=python_script_3)  # IronPython2; same code as python_script_2

# group: Create Dimention X (Packages: GeniusLoci-2021.4.13)
code_block_8 = CodeBlock { 1; }
insert = List.Insert(list=python_script_2@L1, element=python_script_4@L1, index=code_block_8)
dimension_byreferences = Custom[Dimension ByReferences](view=activeView, line=byStartPointEndPoint@L1, references=insert@L2)  # package Genius Loci; Creates a new linear dimension from at least two geometric references of an object.

# group: Grids
getCategory_2 = Element.GetCategory(element=select_model_elements_of)
string_from_object_2 = FromObject(obj=getCategory_2)
code_block_9 = CodeBlock { "Grids"; }
eq_2 = string_from_object_2 == code_block_9
filterByBoolMask_2 = List.FilterByBoolMask(list=select_model_elements_of, mask=eq_2)

# group: Get Location Mark
code_block_10 = CodeBlock { "Name"; }
getParameterValueByName = Element.GetParameterValueByName(element=filterByBoolMask_2.in, parameterName=code_block_10)
code_block_11 = CodeBlock { ""; }
code_block_12 = CodeBlock { "Column Location Mark"; }
getParameterValueByName_2 = Element.GetParameterValueByName(element=filterByBoolMask.in, parameterName=code_block_12)
code_block_13 = CodeBlock { "("; }
code_block_14 = CodeBlock { ")"; }
split = String.Split(string=getParameterValueByName_2, separator0=code_block_13, separator1=code_block_14)
code_block_15 = CodeBlock { 1; }
removeItemAtIndex = List.RemoveItemAtIndex(list=split@L2, indices=code_block_15)
code_block_16 = CodeBlock { 2; }
removeItemAtIndex_2 = List.RemoveItemAtIndex(list=removeItemAtIndex@L2, indices=code_block_16)
join = String.Join(separator=code_block_11, string0=removeItemAtIndex_2)
code_block_17 = CodeBlock { "-"; }
split_2 = String.Split(string=join, separator0=code_block_17)
code_block_18 = CodeBlock { 1; }
flatten_3 = List.Flatten(list=split_2, amount=code_block_18)

# group: Grid Y
lastItem_2 = List.LastItem(list=flatten_3@L2)
allIndicesOf = List.AllIndicesOf(list=getParameterValueByName@L2, item=lastItem_2)
getItemAtIndex_4 = List.GetItemAtIndex(list=filterByBoolMask_2.in, index=allIndicesOf)

# group: Grid Y
lastItem_3 = List.LastItem(list=getItemAtIndex_4@L2)
flatten_4 = List.Flatten(list=lastItem_3)
python_script_5 = Python(IN[0]=flatten_4)  # IronPython2
# ---------- python_script_5.python (17 lines) ----------
import clr
clr.AddReference('RevitAPI')
import Autodesk
from Autodesk.Revit.DB import *

elements = UnwrapElement(IN[0]) if isinstance(IN[0],list) else [UnwrapElement(IN[0])]

ref=[]
for element in elements:
	if isinstance (element, Autodesk.Revit.DB.Dimension):
		ref.append(element.References)
	elif isinstance (element, Autodesk.Revit.DB.ReferencePlane):
		ref.append(element.GetReference())
	else : ref.append(Reference(element))

if isinstance(IN[0], list): OUT = ref
else: OUT = ref[0]
# ----------------------------------------

# group: Crate Dimention X (Packages: GeniusLoci-2021.4.13)
code_block_19 = CodeBlock { 1; }
insert_2 = List.Insert(list=python_script_2@L1, element=python_script_5@L1, index=code_block_19)
dimension_byreferences_2 = Custom[Dimension ByReferences](view=activeView, line=byStartPointEndPoint_2@L1, references=insert_2@L2)

# group: Face Y min
code_block_20 = CodeBlock { 0.5; }
pointAtParameter_3 = Surface.PointAtParameter(surface=faces, u=code_block_20, v=code_block_20)
Y_2 = Point.Y(point=pointAtParameter_3)
sortIndexByValue_3 = List.SortIndexByValue(list=Y_2)
getItemAtIndex_5 = List.GetItemAtIndex(list=faces@L2, index=sortIndexByValue_3@L2)
firstItem_3 = List.FirstItem(list=getItemAtIndex_5@L2)

# group: Surface to Reference X min
create_3 = List.Create(item0=firstItem_3)
flatten_5 = List.Flatten(list=create_3)
python_script_6 = Python(IN[0]=flatten_5)  # IronPython2; same code as python_script
python_script_7 = Python(IN[0]=firstItem_3, IN[1]=python_script_6)  # IronPython2; same code as python_script_2

# group: Face Y max
code_block_21 = CodeBlock { 0.5; }
pointAtParameter_4 = Surface.PointAtParameter(surface=faces, u=code_block_21, v=code_block_21)
Y_3 = Point.Y(point=pointAtParameter_4)
sortIndexByValue_4 = List.SortIndexByValue(list=Y_3)
getItemAtIndex_6 = List.GetItemAtIndex(list=faces@L2, index=sortIndexByValue_4@L2)
lastItem_4 = List.LastItem(list=getItemAtIndex_6@L2)

# group: Surface to Reference X max
create_4 = List.Create(item0=lastItem_4)
flatten_6 = List.Flatten(list=create_4)
python_script_8 = Python(IN[0]=flatten_6)  # IronPython2; same code as python_script
python_script_9 = Python(IN[0]=lastItem_4, IN[1]=python_script_8)  # IronPython2; same code as python_script_2

dim_offset_2_vertical = DoubleInput(500)  # graph input

# group: Create Line
getItemAtIndex_7 = List.GetItemAtIndex(list=pointAtParameter_3@L2, index=sortIndexByValue_3@L2)
firstItem_4 = List.FirstItem(list=getItemAtIndex_7@L2)
X_4 = Point.X(point=firstItem_4)
dim_offset_1_vertical = DoubleInput(1000)  # graph input
code_block_22 = CodeBlock(p=X_4, a=dim_offset_1_vertical) { p-a; }
Y_4 = Point.Y(point=firstItem_4)
Z_2 = Point.Z(point=firstItem_4)
byCoordinates_5 = Point.ByCoordinates(x=code_block_22, y=Y_4, z=Z_2)
code_block_23 = CodeBlock(p=X_4, a=dim_offset_1_vertical) { p-a; }
byCoordinates_6 = Point.ByCoordinates(x=code_block_22, y=code_block_23, z=Z_2)
byStartPointEndPoint_3 = Line.ByStartPointEndPoint(startPoint=byCoordinates_5, endPoint=byCoordinates_6)
code_block_24 = CodeBlock(p=X_4, a=dim_offset_2_vertical) { p-a; }
byCoordinates_7 = Point.ByCoordinates(x=code_block_24, y=Y_4, z=Z_2)
code_block_25 = CodeBlock(p=X_4, a=dim_offset_2_vertical) { p-a; }
byCoordinates_8 = Point.ByCoordinates(x=code_block_24, y=code_block_25, z=Z_2)
byStartPointEndPoint_4 = Line.ByStartPointEndPoint(startPoint=byCoordinates_7, endPoint=byCoordinates_8)

# group: Create Dimention Y (Packages: GeniusLoci-2021.4.13)
code_block_26 = CodeBlock { 1; }
insert_3 = List.Insert(list=python_script_7@L1, element=python_script_9@L1, index=code_block_26)
dimension_byreferences_3 = Custom[Dimension ByReferences](view=activeView, line=byStartPointEndPoint_3@L1, references=insert_3@L2)

# group: Grid X
firstItem_5 = List.FirstItem(list=flatten_3@L2)
allIndicesOf_2 = List.AllIndicesOf(list=getParameterValueByName@L2, item=firstItem_5)
getItemAtIndex_8 = List.GetItemAtIndex(list=filterByBoolMask_2.in, index=allIndicesOf_2)

# group: Grid X
firstItem_6 = List.FirstItem(list=getItemAtIndex_8@L2)
flatten_7 = List.Flatten(list=firstItem_6)
python_script_10 = Python(IN[0]=flatten_7)  # IronPython2; same code as python_script_5

# group: Create Dimention Y (Packages: GeniusLoci-2021.4.13)
code_block_27 = CodeBlock { 1; }
insert_4 = List.Insert(list=python_script_7@L1, element=python_script_10@L1, index=code_block_27)
dimension_byreferences_4 = Custom[Dimension ByReferences](view=activeView, line=byStartPointEndPoint_4@L1, references=insert_4@L2)

# group: Delete Value 0
list_create_2 = List.Create(item0=dimension_byreferences, item1=dimension_byreferences_2, item2=dimension_byreferences_3, item3=dimension_byreferences_4)
flatten_8 = List.Flatten(list=list_create_2)
code_block_28 = CodeBlock { "Value"; }
getParameterValueByName_3 = Element.GetParameterValueByName(element=flatten_8, parameterName=code_block_28)
round = Math.Round(number=getParameterValueByName_3)
code_block_29 = CodeBlock { 0; }
eq_3 = round == code_block_29
filterByBoolMask_3 = List.FilterByBoolMask(list=flatten_8, mask=eq_3)
delete = Element.Delete(element=filterByBoolMask_3.in)

code_block_30 = CodeBlock { "Value"; }
getParameterValueByName_4 = Element.GetParameterValueByName(element=dimension_byreferences, parameterName=code_block_30)
round_2 = Math.Round(number=getParameterValueByName_4)
code_block_31 = CodeBlock { "Value"; }
getParameterValueByName_5 = Element.GetParameterValueByName(element=dimension_byreferences_2, parameterName=code_block_31)
round_3 = Math.Round(number=getParameterValueByName_5)
eq_4 = round_2 == round_3
filterByBoolMask_4 = List.FilterByBoolMask(list=dimension_byreferences_2, mask=eq_4)
delete_2 = Element.Delete(element=filterByBoolMask_4.in)
code_block_32 = CodeBlock { "Value"; }
getParameterValueByName_6 = Element.GetParameterValueByName(element=dimension_byreferences_4, parameterName=code_block_32)
round_4 = Math.Round(number=getParameterValueByName_6)
code_block_33 = CodeBlock { "Value"; }
getParameterValueByName_7 = Element.GetParameterValueByName(element=dimension_byreferences_3, parameterName=code_block_33)
round_5 = Math.Round(number=getParameterValueByName_7)
eq_5 = round_4 == round_5
filterByBoolMask_5 = List.FilterByBoolMask(list=dimension_byreferences_4, mask=eq_5)
delete_3 = Element.Delete(element=filterByBoolMask_5.in)
