# Dynamo graph SPCC_DimGrid.dyn (Dynamo 2.6.1.8786)
# packages: Synthesize toolkit 11.9.6

code_block = CodeBlock()
# ---------- code_block.designscript (2 lines) ----------
//Default Null
null;
# ----------------------------------------
# note: THOU VANDA 31/12/2021
# :))))
run = BoolSelector(true)
rh_pick_model_elements = Custom[RH.Pick Model Elements](refresh=run)  # package Synthesize toolkit; This node offers a pick method for selecting elements in Revit.
getCategory = Element.GetCategory(element=rh_pick_model_elements)
string_from_object = FromObject(obj=getCategory)
code_block_2 = CodeBlock { "Grids"; }
eq = string_from_object == code_block_2
filterByBoolMask = List.FilterByBoolMask(list=rh_pick_model_elements, mask=eq)
curve = Grid.Curve(grid=filterByBoolMask.in)
direction = Line.Direction(line=curve)
XAxis = Vector.XAxis()
ZAxis = Vector.ZAxis()
angleAboutAxis = Vector.AngleAboutAxis(vector=direction, otherVector=XAxis, rotationAxis=ZAxis)
code_block_3 = CodeBlock { 45; }
ge = angleAboutAxis >= code_block_3
code_block_4 = CodeBlock { 135; }
le = angleAboutAxis <= code_block_4
and_ = ge && le
code_block_5 = CodeBlock { 225; }
ge_2 = angleAboutAxis >= code_block_5
code_block_6 = CodeBlock { 315; }
le_2 = angleAboutAxis <= code_block_6
and_2 = ge_2 && le_2
or_ = and_ || and_2
filterByBoolMask_2 = List.FilterByBoolMask(list=filterByBoolMask.in, mask=or_)
flatten = List.Flatten(list=filterByBoolMask_2.in)

# group: Grid X1
curve_2 = Grid.Curve(grid=flatten)
startPoint = Curve.StartPoint(curve=curve_2)
X = Point.X(point=startPoint)
sortIndexByValue = List.SortIndexByValue(list=X)
firstItem = List.FirstItem(list=sortIndexByValue)
getItemAtIndex = List.GetItemAtIndex(list=flatten, index=firstItem)

# group: Grid Xn
curve_3 = Grid.Curve(grid=flatten)
startPoint_2 = Curve.StartPoint(curve=curve_3)
X_2 = Point.X(point=startPoint_2)
sortIndexByValue_2 = List.SortIndexByValue(list=X_2)
lastItem = List.LastItem(list=sortIndexByValue_2)
getItemAtIndex_2 = List.GetItemAtIndex(list=flatten, index=lastItem)

# group: Dim First Grid with Last Grid
curve_4 = Grid.Curve(grid=getItemAtIndex)
startPoint_3 = Curve.StartPoint(curve=curve_4)
Y = Point.Y(point=startPoint_3)
endPoint = Curve.EndPoint(curve=curve_4)
Y_2 = Point.Y(point=endPoint)
gt = Y > Y_2
if_ = If(test=gt, true=startPoint_3, false=endPoint)
curve_5 = Grid.Curve(grid=getItemAtIndex_2)
startPoint_4 = Curve.StartPoint(curve=curve_5)
Y_3 = Point.Y(point=startPoint_4)
endPoint_2 = Curve.EndPoint(curve=curve_5)
Y_4 = Point.Y(point=endPoint_2)
gt_2 = Y_3 > Y_4
if_2 = If(test=gt_2, true=startPoint_4, false=endPoint_2)
byStartPointEndPoint = Line.ByStartPointEndPoint(startPoint=if_, endPoint=if_2)
firstItem_2 = List.FirstItem(list=getItemAtIndex)
lastItem_2 = List.LastItem(list=getItemAtIndex_2)
join = List.Join(list0=firstItem_2, list1=lastItem_2)
python_script = Python(IN[0]=join)
# ---------- python_script.python (17 lines) ----------
import clr
clr.AddReference('RevitAPI')
import Autodesk
from Autodesk.Revit.DB import *

elements = UnwrapElement(IN[0]) if isinstance(IN[0],list) else [UnwrapElement(IN[0])]

ref=[]
for element in elements:
	if isinstance (element, Autodesk.Revit.DB.Dimension):
		ref.append(element.References)
	elif isinstance (element, Autodesk.Revit.DB.ReferencePlane):
		ref.append(element.GetReference())
	else : ref.append(Reference(element))

if isinstance(IN[0], list): OUT = ref
else: OUT = ref[0]
# ----------------------------------------

dimensionWithReference = Python(IN[0]=code_block, IN[1]=byStartPointEndPoint, IN[2]=python_script, IN[3]=code_block)
# ---------- dimensionWithReference.python (50 lines) ----------
#Alban de Chasteigner 2019
#twitter : @geniusloci_bim
#geniusloci.bim@gmail.com

import clr
clr.AddReference('RevitAPI')
from Autodesk.Revit.DB import *

clr.AddReference('RevitNodes')
import Revit
clr.ImportExtensions(Revit.GeometryConversion)
clr.ImportExtensions(Revit.Elements)

clr.AddReference('RevitServices')
import RevitServices
from RevitServices.Persistence import DocumentManager
from RevitServices.Transactions import TransactionManager

doc = DocumentManager.Instance.CurrentDBDocument

def tolist(obj1):
    if hasattr(obj1,"__iter__"): return obj1
    else: return [obj1]

view = tolist(UnwrapElement(IN[0]))[0]
lines = tolist(IN[1])
references= IN[2]
dimensionType=tolist(UnwrapElement(IN[3]))[0]

elementsRef = ReferenceArray()
for reference in references :
	elementsRef.Append(reference)
	
if view == None:
	view = UnwrapElement(doc.ActiveView)
TransactionManager.Instance.EnsureInTransaction(doc)
for line in lines:
	if doc.IsFamilyDocument == True :
		if IN[3]== None: 
			dim = doc.FamilyCreate.NewDimension(view, line.ToRevitType(), elementsRef).ToDSType(True)
		else:
			dim = doc.FamilyCreate.NewDimension(view, line.ToRevitType(), elementsRef,dimensionType).ToDSType(True)
	else:
		if IN[3]== None: 
			dim = doc.Create.NewDimension(view, line.ToRevitType(), elementsRef).ToDSType(True)
		else:
			dim = doc.Create.NewDimension(view, line.ToRevitType(), elementsRef,dimensionType).ToDSType(True)
TransactionManager.Instance.TransactionTaskDone()

OUT=dim
# ----------------------------------------
code_block_7 = CodeBlock()  # same code as code_block

# group: Dim First Grid with Last Grid
curve_6 = Grid.Curve(grid=getItemAtIndex)
startPoint_5 = Curve.StartPoint(curve=curve_6)
Y_5 = Point.Y(point=startPoint_5)
endPoint_3 = Curve.EndPoint(curve=curve_6)
Y_6 = Point.Y(point=endPoint_3)
gt_3 = Y_5 > Y_6
if_3 = If(test=gt_3, true=endPoint_3, false=startPoint_5)
curve_7 = Grid.Curve(grid=getItemAtIndex_2)
startPoint_6 = Curve.StartPoint(curve=curve_7)
Y_7 = Point.Y(point=startPoint_6)
endPoint_4 = Curve.EndPoint(curve=curve_7)
Y_8 = Point.Y(point=endPoint_4)
gt_4 = Y_7 > Y_8
if_4 = If(test=gt_4, true=endPoint_4, false=startPoint_6)
byStartPointEndPoint_2 = Line.ByStartPointEndPoint(startPoint=if_3, endPoint=if_4)
firstItem_3 = List.FirstItem(list=getItemAtIndex)
lastItem_3 = List.LastItem(list=getItemAtIndex_2)
join_2 = List.Join(list0=firstItem_3, list1=lastItem_3)
python_script_2 = Python(IN[0]=join_2)  # same code as python_script

dimensionWithReference_2 = Python(IN[0]=code_block_7, IN[1]=byStartPointEndPoint_2, IN[2]=python_script_2, IN[3]=code_block_7)  # same code as dimensionWithReference
code_block_8 = CodeBlock()  # same code as code_block
dim_offset = DoubleInput(500)

# group: All Grids
curve_8 = Grid.Curve(grid=flatten)
startPoint_7 = Curve.StartPoint(curve=curve_8)
X_3 = Point.X(point=startPoint_7)
sortIndexByValue_3 = List.SortIndexByValue(list=X_3)
getItemAtIndex_3 = List.GetItemAtIndex(list=flatten, index=sortIndexByValue_3)

# group: Dim Grids
X_4 = Point.X(point=if_3)
Y_9 = Point.Y(point=if_3)
code_block_9 = CodeBlock(a=Y_9, b=dim_offset) { a+b; }
Z = Point.Z(point=if_3)
byCoordinates = Point.ByCoordinates(x=X_4, y=code_block_9, z=Z)
X_5 = Point.X(point=if_4)
Y_10 = Point.Y(point=if_4)
code_block_10 = CodeBlock(a=Y_10, b=dim_offset) { a+b; }
Z_2 = Point.Z(point=if_4)
byCoordinates_2 = Point.ByCoordinates(x=X_5, y=code_block_10, z=Z_2)
byStartPointEndPoint_3 = Line.ByStartPointEndPoint(startPoint=byCoordinates, endPoint=byCoordinates_2)
python_script_3 = Python(IN[0]=getItemAtIndex_3)  # same code as python_script

dimensionWithReference_3 = Python(IN[0]=code_block_8, IN[1]=byStartPointEndPoint_3, IN[2]=python_script_3, IN[3]=code_block_8)  # same code as dimensionWithReference
code_block_11 = CodeBlock()  # same code as code_block

# group: Dim Grids
X_6 = Point.X(point=if_)
Y_11 = Point.Y(point=if_)
code_block_12 = CodeBlock(a=Y_11, b=dim_offset) { a-b; }
Z_3 = Point.Z(point=if_)
byCoordinates_3 = Point.ByCoordinates(x=X_6, y=code_block_12, z=Z_3)
X_7 = Point.X(point=if_2)
Y_12 = Point.Y(point=if_2)
code_block_13 = CodeBlock(a=Y_12, b=dim_offset) { a-b; }
Z_4 = Point.Z(point=if_2)
byCoordinates_4 = Point.ByCoordinates(x=X_7, y=code_block_13, z=Z_4)
byStartPointEndPoint_4 = Line.ByStartPointEndPoint(startPoint=byCoordinates_3, endPoint=byCoordinates_4)
python_script_4 = Python(IN[0]=getItemAtIndex_3)  # same code as python_script

dimensionWithReference_4 = Python(IN[0]=code_block_11, IN[1]=byStartPointEndPoint_4, IN[2]=python_script_4, IN[3]=code_block_11)  # same code as dimensionWithReference
code_block_14 = CodeBlock()  # same code as code_block
flatten_2 = List.Flatten(list=filterByBoolMask_2.out)

# group: Grid Y1
curve_9 = Grid.Curve(grid=flatten_2)
startPoint_8 = Curve.StartPoint(curve=curve_9)
Y_13 = Point.Y(point=startPoint_8)
sortIndexByValue_4 = List.SortIndexByValue(list=Y_13)
firstItem_4 = List.FirstItem(list=sortIndexByValue_4)
getItemAtIndex_4 = List.GetItemAtIndex(list=flatten_2, index=firstItem_4)

# group: Grid Yn
curve_10 = Grid.Curve(grid=flatten_2)
startPoint_9 = Curve.StartPoint(curve=curve_10)
Y_14 = Point.Y(point=startPoint_9)
sortIndexByValue_5 = List.SortIndexByValue(list=Y_14)
lastItem_4 = List.LastItem(list=sortIndexByValue_5)
getItemAtIndex_5 = List.GetItemAtIndex(list=flatten_2, index=lastItem_4)

# group: Dim First Grid with Last Grid
curve_11 = Grid.Curve(grid=getItemAtIndex_4)
startPoint_10 = Curve.StartPoint(curve=curve_11)
endPoint_5 = Curve.EndPoint(curve=curve_11)
curve_12 = Grid.Curve(grid=getItemAtIndex_5)
startPoint_11 = Curve.StartPoint(curve=curve_12)
endPoint_6 = Curve.EndPoint(curve=curve_12)
firstItem_5 = List.FirstItem(list=getItemAtIndex_4)
lastItem_5 = List.LastItem(list=getItemAtIndex_5)
join_3 = List.Join(list0=firstItem_5, list1=lastItem_5)
python_script_5 = Python(IN[0]=join_3)  # same code as python_script

X_8 = Point.X(point=startPoint_10)
X_9 = Point.X(point=endPoint_5)

# group (continued): Dim First Grid with Last Grid
gt_5 = X_8 > X_9
if_5 = If(test=gt_5, true=startPoint_10, false=endPoint_5)

X_10 = Point.X(point=startPoint_11)
X_11 = Point.X(point=endPoint_6)

# group (continued): Dim First Grid with Last Grid
gt_6 = X_10 > X_11
if_6 = If(test=gt_6, true=startPoint_11, false=endPoint_6)
byStartPointEndPoint_5 = Line.ByStartPointEndPoint(startPoint=if_5, endPoint=if_6)

# group: All Grids
curve_13 = Grid.Curve(grid=flatten_2)
startPoint_12 = Curve.StartPoint(curve=curve_13)
Y_15 = Point.Y(point=startPoint_12)
sortIndexByValue_6 = List.SortIndexByValue(list=Y_15)
getItemAtIndex_6 = List.GetItemAtIndex(list=flatten_2, index=sortIndexByValue_6)

# group: Dim Grids
X_12 = Point.X(point=if_5)
code_block_15 = CodeBlock(a=X_12, b=dim_offset) { a-b; }
Y_16 = Point.Y(point=if_5)
Z_5 = Point.Z(point=if_5)
byCoordinates_5 = Point.ByCoordinates(x=code_block_15, y=Y_16, z=Z_5)
X_13 = Point.X(point=if_6)
code_block_16 = CodeBlock(a=X_13, b=dim_offset) { a-b; }
Y_17 = Point.Y(point=if_6)
Z_6 = Point.Z(point=if_6)
byCoordinates_6 = Point.ByCoordinates(x=code_block_16, y=Y_17, z=Z_6)
byStartPointEndPoint_6 = Line.ByStartPointEndPoint(startPoint=byCoordinates_5, endPoint=byCoordinates_6)
python_script_6 = Python(IN[0]=getItemAtIndex_6)  # same code as python_script

dimensionWithReference_5 = Python(IN[0]=code_block_14, IN[1]=byStartPointEndPoint_6, IN[2]=python_script_6, IN[3]=code_block_14)  # same code as dimensionWithReference
code_block_17 = CodeBlock()  # same code as code_block

# group: Dim First Grid with Last Grid
curve_14 = Grid.Curve(grid=getItemAtIndex_4)
startPoint_13 = Curve.StartPoint(curve=curve_14)
endPoint_7 = Curve.EndPoint(curve=curve_14)
curve_15 = Grid.Curve(grid=getItemAtIndex_5)
startPoint_14 = Curve.StartPoint(curve=curve_15)
endPoint_8 = Curve.EndPoint(curve=curve_15)
firstItem_6 = List.FirstItem(list=getItemAtIndex_4)
lastItem_6 = List.LastItem(list=getItemAtIndex_5)
join_4 = List.Join(list0=firstItem_6, list1=lastItem_6)
python_script_7 = Python(IN[0]=join_4)  # same code as python_script

X_14 = Point.X(point=startPoint_13)
X_15 = Point.X(point=endPoint_7)

# group (continued): Dim First Grid with Last Grid
gt_7 = X_14 > X_15
if_7 = If(test=gt_7, true=endPoint_7, false=startPoint_13)

X_16 = Point.X(point=startPoint_14)
X_17 = Point.X(point=endPoint_8)

# group (continued): Dim First Grid with Last Grid
gt_8 = X_16 > X_17
if_8 = If(test=gt_8, true=endPoint_8, false=startPoint_14)
byStartPointEndPoint_7 = Line.ByStartPointEndPoint(startPoint=if_7, endPoint=if_8)

# group: Dim Grids
X_18 = Point.X(point=if_7)
code_block_18 = CodeBlock(a=X_18, b=dim_offset) { a+b; }
Y_18 = Point.Y(point=if_7)
Z_7 = Point.Z(point=if_7)
byCoordinates_7 = Point.ByCoordinates(x=code_block_18, y=Y_18, z=Z_7)
X_19 = Point.X(point=if_8)
code_block_19 = CodeBlock(a=X_19, b=dim_offset) { a+b; }
Y_19 = Point.Y(point=if_8)
Z_8 = Point.Z(point=if_8)
byCoordinates_8 = Point.ByCoordinates(x=code_block_19, y=Y_19, z=Z_8)
byStartPointEndPoint_8 = Line.ByStartPointEndPoint(startPoint=byCoordinates_7, endPoint=byCoordinates_8)
python_script_8 = Python(IN[0]=getItemAtIndex_6)  # same code as python_script

dimensionWithReference_6 = Python(IN[0]=code_block_17, IN[1]=byStartPointEndPoint_8, IN[2]=python_script_8, IN[3]=code_block_17)  # same code as dimensionWithReference
code_block_20 = CodeBlock()  # same code as code_block
dimensionWithReference_7 = Python(IN[0]=code_block_20, IN[1]=byStartPointEndPoint_7, IN[2]=python_script_7, IN[3]=code_block_20)  # same code as dimensionWithReference
code_block_21 = CodeBlock()  # same code as code_block
dimensionWithReference_8 = Python(IN[0]=code_block_21, IN[1]=byStartPointEndPoint_5, IN[2]=python_script_5, IN[3]=code_block_21)  # same code as dimensionWithReference
