# Dynamo graph SPCC_DuplicateBeamFromCAD.dyn (Dynamo 2.18.1.5096)
# packages: LinkDWG 0.3.91, archi-lab.net 2023.213.1722

code_block = CodeBlock { "VD_(300x500)"; }
byName = FamilyType.ByName(name=code_block)
boolean = BoolSelector(true)
boolean_2 = BoolSelector(false)
selectOnScreen = Custom[SelectOnScreen](Run=boolean, ShowSwitchAlert=boolean_2)  # package LinkDWG; UI to select objects on screen in AutoCAD
string_from_object = FromObject(object=selectOnScreen)
code_block_2 = CodeBlock { "("; }
contains = String.Contains(string=string_from_object, searchFor=code_block_2)
filterByBoolMask = List.FilterByBoolMask(list=string_from_object, mask=contains)
code_block_3 = CodeBlock { "B"; }
contains_2 = String.Contains(string=string_from_object, searchFor=code_block_3)
filterByBoolMask_2 = List.FilterByBoolMask(list=filterByBoolMask.in, mask=contains_2)
code_block_4 = CodeBlock(a=filterByBoolMask_2.in) { a; }
code_block_5 = CodeBlock { "{"; "}"; }
split = String.Split(string=code_block_4, separator0=code_block_5.out0, separator1=code_block_5.out1)
contains_3 = String.Contains(string=split, searchFor=code_block_2)
filterByBoolMask_3 = List.FilterByBoolMask(list=split, mask=contains_3)
code_block_6 = CodeBlock(a=filterByBoolMask_3.in) { a; }
flatten = List.Flatten(list=code_block_6)
code_block_7 = CodeBlock { "("; ")"; }
split_2 = String.Split(string=flatten, separator0=code_block_7.out0, separator1=code_block_7.out1)
code_block_8 = CodeBlock { 1; }
getItemAtIndex = List.GetItemAtIndex(list=split_2@L2, index=code_block_8)
uniqueItems = List.UniqueItems(list=getItemAtIndex)
code_block_9 = CodeBlock { "VD_STR_RectangularConcreteBeam"; }
byName_2 = Family.ByName(name=code_block_9)
types = Family.Types(family=byName_2)
name = Element.Name(element=types)
eq = name == uniqueItems  # lacing=Longest
filterByBoolMask_4 = List.FilterByBoolMask(list=uniqueItems, mask=eq)
code_block_10 = CodeBlock(a=filterByBoolMask_4.out) { a; }
duplicate = archilab.Revit.Elements.ElementTypes.Duplicate(element=byName, name=code_block_10)
code_block_11 = CodeBlock { "b"; }
code_block_12 = CodeBlock { "x"; " "; }
split_3 = String.Split(string=uniqueItems, separator0=code_block_12.out0)
code_block_13 = CodeBlock { 0; }
getItemAtIndex_2 = List.GetItemAtIndex(list=split_3@L2, index=code_block_13)
code_block_14 = CodeBlock(b=getItemAtIndex_2) { b; }
toNumber = String.ToNumber(string=code_block_14)
setParameterByName = Element.SetParameterByName(element=duplicate, parameterName=code_block_11, value=toNumber)
code_block_15 = CodeBlock { "h"; }
code_block_16 = CodeBlock { 1; }
getItemAtIndex_3 = List.GetItemAtIndex(list=split_3@L2, index=code_block_16)
code_block_17 = CodeBlock(h=getItemAtIndex_3) { h; }
toNumber_2 = String.ToNumber(string=code_block_17)
setParameterByName_2 = Element.SetParameterByName(element=duplicate, parameterName=code_block_15, value=toNumber_2)
