# Dynamo graph SPCC_ExportNWC.dyn (Dynamo 2.17.0.3472)
# packages: Genius Loci 2021.6.3, archi-lab.net 2016.12.7, archi-lab.net 2023.213.1722

current_document = Custom[Current Document]()  # package archi-lab.net
directory_path = Directory("G:\Shared drives\CAM - ATCT\SPCC\8. BIM\AS-BUILT MODELS\Review Model\20230220_ATCT_AssignCOBie\20230301")  # graph input
view_type = ViewTypesUi("ThreeD")
name = Element.Name(element=view_type)  # frozen
startWith = StringInput("NNN_")  # graph input
code_block = CodeBlock { true; }
startsWith = String.StartsWith(string=name, searchFor=startWith, ignoreCase=code_block)
filterByBoolMask = List.FilterByBoolMask(list=view_type, mask=startsWith)
view = CodeBlock(a=filterByBoolMask.in) { a; }
filterByBoolMask_2 = List.FilterByBoolMask(list=name, mask=startsWith)
view_name = CodeBlock(a=filterByBoolMask_2.in) { a; }
enumerate_naviswork_coordinates = Custom[Enumerate Naviswork Coordinates and Exportscope]()  # package Genius Loci; Use with the "Export NWC in Document" node.
code_block_2 = CodeBlock(x=enumerate_naviswork_coordinates.ExportScope) { x[1]; }
code_block_3 = CodeBlock(x=enumerate_naviswork_coordinates.ChooseCoordinates) { x[0]; }
boolean = BoolSelector(false)
boolean_2 = BoolSelector(true)  # graph input
# note: Genius Loci
export_nwc_in_document = Custom[Export NWC in Document](document=current_document, DirectoryPath=directory_path, view=view, Filename=view_name, exportScope=code_block_2, chooseCoordinates=code_block_3, ExportLinks=boolean, RunIt=boolean_2, lacing=Longest)  # package Genius Loci; !! This node needs Navisworks Exporters for Revit to export NWC. This node exports Views to NWC files in the active or given document. Navisworks options are embedded inside the python script.
code_block_4 = CodeBlock(a=export_nwc_in_document.Result) { a; }
