# Dynamo graph SPCC_ExportToNaviswork.dyn (Dynamo 2.6.1.8786)

python_script = Python()  # unwired: IN[0], IN[1]
# ---------- python_script.python (49 lines) ----------
# Load the Python Standard and DesignScript Libraries
import.clr

clr.AddReference('RevitAPI')
from Autodesk.Revit.DB import*

Clr.AddReference('RevitServices')
from RevitServices.Persistence import DocumentManager

Clr.Addreference('ProtoGeometry')
from Autodesk.DesignScript.Geometry import*

import System
from System.Collections.Generic import*

#STEP 2 Connect to the current document.

doc = DocumentManager.Instance.CurrentDBDocument

#STEP 3 Get name of view
names = IN[0]

#STEP 4 Get directory of folder to save files.
directory = IN[1]

#STEP 5. Use filterElementCollector
#This class use to search, Filter and iterate through a set of element.

collector = FilteredElementCollector(doc.)ofclass(view)

#STEP 6. Use the Naviswork export options.
NavisExport = NavisworksOptions()
NavisExport.ExportScope = NavisworksExportScope.View
NavisExport.Exportlinks = True

#STEP 7. Create a new list for results.

OUT = []

#STEP 8. Create a loop on all filtered views for save nwc.
for i in names:
    FindViewString = i.name
     OUT.append(FindViewString)
     
     for view in collector:
       if (view.ViewType == ViewType.ThreeD and view.name.contains(FindViewString)):
           NavisExport.ViewId = View.Id
           doc.Export(directory, view.Name + ".nwc", NavisExport)
 
# ----------------------------------------
