# Dynamo graph SPCC_MarkBeam.dyn (Dynamo 2.19.3.6394)
# packages: ACOPackage 1.0.4

level = BoolSelector(true)
boolean = BoolSelector(true)
selectFraming = ACOSolution.Selection.SelectFraming(refresh=boolean)
getCategory = Element.GetCategory(element=selectFraming)
name = Category.Name(category=getCategory)
code_block = CodeBlock { "Structural Framing"; }
eq = name == code_block
filterByBoolMask = List.FilterByBoolMask(list=selectFraming, mask=eq)
code_block_2 = CodeBlock { "Special Beam"; }
getParameterValueByName = Element.GetParameterValueByName(element=filterByBoolMask.in, parameterName=code_block_2)
code_block_3 = CodeBlock { 1; }
eq_2 = getParameterValueByName == code_block_3
filterByBoolMask_2 = List.FilterByBoolMask(list=filterByBoolMask.in, mask=eq_2)
geometry = Element.Geometry(element=filterByBoolMask_2.out)
flatten = List.Flatten(list=geometry)
centroid = Solid.Centroid(solid=flatten)
Z = Point.Z(point=centroid)
sortIndexByValue = List.SortIndexByValue(list=Z)
getItemAtIndex = List.GetItemAtIndex(list=filterByBoolMask_2.out, index=sortIndexByValue)
getLocation = Element.GetLocation(element=getItemAtIndex)
string_from_object = FromObject(obj=getLocation)
string = StringInput("Arc")
startsWith = String.StartsWith(string=string_from_object, searchFor=string)
filterByBoolMask_3 = List.FilterByBoolMask(list=getItemAtIndex, mask=startsWith)
getLocation_2 = Element.GetLocation(element=filterByBoolMask_3.out)
direction = Line.Direction(line=getLocation_2)
XAxis = Vector.XAxis()
ZAxis = Vector.ZAxis()
angleAboutAxis = Vector.AngleAboutAxis(vector=direction, otherVector=XAxis, rotationAxis=ZAxis)
code_block_4 = CodeBlock { 45; }
ge = angleAboutAxis >= code_block_4
code_block_5 = CodeBlock { 135; }
le = angleAboutAxis <= code_block_5
and_ = ge && le
code_block_6 = CodeBlock { 225; }
ge_2 = angleAboutAxis >= code_block_6
code_block_7 = CodeBlock { 315; }
le_2 = angleAboutAxis <= code_block_7
and_2 = ge_2 && le_2
or_ = and_ || and_2
filterByBoolMask_4 = List.FilterByBoolMask(list=filterByBoolMask_3.out, mask=or_)
geometry_2 = Element.Geometry(element=filterByBoolMask_4.out)
flatten_2 = List.Flatten(list=geometry_2)
centroid_2 = Solid.Centroid(solid=flatten_2)
Y = Point.Y(point=centroid_2)
sortIndexByValue_2 = List.SortIndexByValue(list=Y)
getItemAtIndex_2 = List.GetItemAtIndex(list=filterByBoolMask_4.out, index=sortIndexByValue_2)
string_2 = StringInput("Cut Length")
getParameterValueByName_2 = Element.GetParameterValueByName(element=getItemAtIndex_2, parameterName=string_2)
code_block_8 = CodeBlock { 5; }
round = Math.Round(number=getParameterValueByName_2, digits=code_block_8)
groupByKey = List.GroupByKey(list=getItemAtIndex_2, keys=round)
string_3 = StringInput("Type")
getParameterValueByName_3 = Element.GetParameterValueByName(element=groupByKey.groups, parameterName=string_3)
groupByKey_2 = List.GroupByKey(list=groupByKey.groups@L2, keys=getParameterValueByName_3@L2)
code_block_9 = CodeBlock { 0; }
flatten_3 = List.Flatten(list=groupByKey_2.groups@L2, amount=code_block_9)
para_name = StringInput("VD_DAT_Name")
horizontal_beam_name = StringInput("HB")
count = List.Count(list=flatten_3@L2)
count_2 = List.Count(list=count)
code_block_10 = CodeBlock(count=count_2) { 1..count; }
code_block_11 = CodeBlock(MarkBeam=horizontal_beam_name, CountBeam=code_block_10) { MarkBeam+CountBeam; }
zone_name_true_false = BoolSelector(false)
zone_name = StringInput("")
code_block_12 = CodeBlock { ""; }
if_ = If(test=zone_name_true_false, true=zone_name, false=code_block_12)
code_block_13 = CodeBlock(NameBeam=code_block_11, Z=if_) { NameBeam+Z; }
setParameterByName = Element.SetParameterByName(element=flatten_3, parameterName=para_name, value=code_block_13)
getParameterValueByName_4 = Element.GetParameterValueByName(element=setParameterByName, parameterName=para_name)
geometry_3 = Element.Geometry(element=filterByBoolMask_4.in)
flatten_4 = List.Flatten(list=geometry_3)
centroid_3 = Solid.Centroid(solid=flatten_4)
X = Point.X(point=centroid_3)
sortIndexByValue_3 = List.SortIndexByValue(list=X)
getItemAtIndex_3 = List.GetItemAtIndex(list=filterByBoolMask_4.in, index=sortIndexByValue_3)
string_4 = StringInput("Cut Length")
getParameterValueByName_5 = Element.GetParameterValueByName(element=getItemAtIndex_3, parameterName=string_4)
code_block_14 = CodeBlock { 5; }
round_2 = Math.Round(number=getParameterValueByName_5, digits=code_block_14)
groupByKey_3 = List.GroupByKey(list=getItemAtIndex_3, keys=round_2)
string_5 = StringInput("Type")
getParameterValueByName_6 = Element.GetParameterValueByName(element=groupByKey_3.groups, parameterName=string_5)
groupByKey_4 = List.GroupByKey(list=groupByKey_3.groups@L2, keys=getParameterValueByName_6@L2)
code_block_15 = CodeBlock { 0; }
flatten_5 = List.Flatten(list=groupByKey_4.groups@L2, amount=code_block_15)
vertical_beam_name = StringInput("VB")
count_3 = List.Count(list=flatten_5@L2)
count_4 = List.Count(list=count_3)
code_block_16 = CodeBlock(count=count_4) { 1..count; }
code_block_17 = CodeBlock(MarkBeam=vertical_beam_name, CountBeam=code_block_16) { MarkBeam+CountBeam; }
code_block_18 = CodeBlock { ""; }
if_2 = If(test=zone_name_true_false, true=zone_name, false=code_block_18)
code_block_19 = CodeBlock(NameBeam=code_block_17, Z=if_2) { NameBeam+Z; }
setParameterByName_2 = Element.SetParameterByName(element=flatten_5, parameterName=para_name, value=code_block_19)
getParameterValueByName_7 = Element.GetParameterValueByName(element=setParameterByName_2, parameterName=para_name)
code_block_20 = CodeBlock { ""; }
if_3 = If(test=zone_name_true_false, true=zone_name, false=code_block_20)
string_6 = StringInput("Cut Length")
getParameterValueByName_8 = Element.GetParameterValueByName(element=filterByBoolMask_2.in, parameterName=string_6)
code_block_21 = CodeBlock { 5; }
round_3 = Math.Round(number=getParameterValueByName_8, digits=code_block_21)
groupByKey_5 = List.GroupByKey(list=filterByBoolMask_2.in, keys=round_3)
string_7 = StringInput("Type")
getParameterValueByName_9 = Element.GetParameterValueByName(element=groupByKey_5.groups, parameterName=string_7)
groupByKey_6 = List.GroupByKey(list=groupByKey_5.groups@L2, keys=getParameterValueByName_9@L2)
sb_beam_name = StringInput("SB")
code_block_22 = CodeBlock { 0; }
flatten_6 = List.Flatten(list=groupByKey_6.groups@L2, amount=code_block_22)
count_5 = List.Count(list=flatten_6@L2)
count_6 = List.Count(list=count_5)
code_block_23 = CodeBlock(count=count_6) { 1..count; }
code_block_24 = CodeBlock(MarkBeam=sb_beam_name, CountBeam=code_block_23) { MarkBeam+CountBeam; }
code_block_25 = CodeBlock(NameBeam=code_block_24) { NameBeam+Z; }  # unwired: Z
setParameterByName_3 = Element.SetParameterByName(element=groupByKey_6.groups, parameterName=para_name, value=code_block_25)
getParameterValueByName_10 = Element.GetParameterValueByName(element=setParameterByName_3, parameterName=para_name)
level_2 = BoolSelector(true)
code_block_26 = CodeBlock(a=filterByBoolMask_4.out) { a; }
code_block_27 = CodeBlock(a=filterByBoolMask_2.in) { a; }
