# Dynamo graph SPCC_MarkBeamXY.dyn "VD_MarkBeamXY" (Dynamo 2.6.1.8786)
# packages: ACOPackage 1.0.4

boolean = BoolSelector(true)
selectFraming = ACOSolution.Selection.SelectFraming(refresh=boolean)

# group: Lọc các dầm cùng chiều dài
string = StringInput("Cut Length")
getParameterValueByName = Element.GetParameterValueByName(element=selectFraming, parameterName=string)

code_block = CodeBlock { 5; }
round = Math.Round(number=getParameterValueByName, digits=code_block)

# group (continued): Lọc các dầm cùng chiều dài
groupByKey = List.GroupByKey(list=selectFraming, keys=round)

# group: Lọc lấy đối tượng cùng Type (Kích thước)
string_2 = StringInput("Type")
getParameterValueByName_2 = Element.GetParameterValueByName(element=groupByKey.groups, parameterName=string_2)
groupByKey_2 = List.GroupByKey(list=groupByKey.groups@L2, keys=getParameterValueByName_2@L2)

# group: Tạo danh sách đêm số cấu kiện
code_block_2 = CodeBlock { 0; }
flatten = List.Flatten(list=groupByKey_2.groups@L2, amt=code_block_2)
count = List.Count(list=flatten@L2)
count_2 = List.Count(list=count)
code_block_3 = CodeBlock(count=count_2) { 1..count; }

# group: Gáng tên vào cấu kiện
code_block_4 = CodeBlock { "Mark"; }
tên_dầm = StringInput("D")  # graph input
code_block_5 = CodeBlock(a=tên_dầm, b=code_block_3) { a+b; }
tên_tầng_có_không = BoolSelector(false)  # graph input
tên_tầng = StringInput("-F1")  # graph input
code_block_6 = CodeBlock { ""; }
if_ = If(test=tên_tầng_có_không, true=tên_tầng, false=code_block_6)
code_block_7 = CodeBlock(a=code_block_5, b=if_) { a+b; }
setParameterByName = Element.SetParameterByName(element=flatten, parameterName=code_block_4, value=code_block_7)
getParameterValueByName_3 = Element.GetParameterValueByName(element=setParameterByName, parameterName=code_block_4)
