# Dynamo graph SPCC_MarkColumn.dyn (Dynamo 2.17.0.3472)
# packages: ACOPackage 1.0.4, Universo_BIM 19.10.11

boolean = BoolSelector(true)
selectStrColumn = ACOSolution.Selection.SelectStrColumn(refresh=boolean)
code_block = CodeBlock { "DYN_DAT_Name"; }
type = Elements.Element.Type(element=selectStrColumn)
sort = List.Sort(list=type)
name = Element.Name(element=sort)
uniqueItems = List.UniqueItems(list=name)
indexOf = List.IndexOf(list=uniqueItems, element=name)
code_block_2 = CodeBlock(a=indexOf) { "C"+a; }
setParameterByName = Element.SetParameterByName(element=selectStrColumn, parameterName=code_block, value=code_block_2)
