# Dynamo graph SPCC_RebarColumnMiddle.dyn "VD_RebarColumnMiddle" (Dynamo 2.6.1.8786)
# packages: BIM4Struc.Rebar 1.3.0, Dynamo for Rebar 2.0.2, DynaTools 2018.1.15

select_top_column = DSModelElementSelection()  # 1 picked in the model; graph input
faces = Element.Faces(element=select_top_column)

# group: Lọc lấy mặt phẳng cột trên
code_block = CodeBlock { 0.5; }
normalAtParameter = Surface.NormalAtParameter(surface=faces, u=code_block, v=code_block)
Z = Vector.Z(vector=normalAtParameter)
maximumItem = List.MaximumItem(list=Z)
indexOf = List.IndexOf(list=Z, element=maximumItem)
minimumItem = List.MinimumItem(list=Z)
indexOf_2 = List.IndexOf(list=Z, element=minimumItem)
create = List.Create(item0=indexOf, item1=indexOf_2)
other = List.RemoveItemAtIndex(list=faces, indices=create)
code_block_2 = CodeBlock { 0.5; }
normalAtParameter_2 = Surface.NormalAtParameter(surface=other, u=code_block_2, v=code_block_2)
XAxis = Vector.XAxis()
ZAxis = Vector.ZAxis()
angleAboutAxis = Vector.AngleAboutAxis(vector=normalAtParameter_2, otherVector=XAxis, rotationAxis=ZAxis)
sortByKey = List.SortByKey(list=other, keys=angleAboutAxis)
other_2 = CodeBlock(ListA=sortByKey.sorted_list) { ListA; }
bottom = List.GetItemAtIndex(list=faces, index=indexOf_2)
top = List.GetItemAtIndex(list=faces, index=indexOf)

select_bottom_column = DSModelElementSelection()  # 1 picked in the model; graph input
faces_2 = Element.Faces(element=select_bottom_column)

# group: Lọc lấy mặt phẳng cột dưới
code_block_3 = CodeBlock { 0.5; }
normalAtParameter_3 = Surface.NormalAtParameter(surface=faces_2, u=code_block_3, v=code_block_3)
Z_2 = Vector.Z(vector=normalAtParameter_3)
maximumItem_2 = List.MaximumItem(list=Z_2)
indexOf_3 = List.IndexOf(list=Z_2, element=maximumItem_2)
minimumItem_2 = List.MinimumItem(list=Z_2)
indexOf_4 = List.IndexOf(list=Z_2, element=minimumItem_2)
create_2 = List.Create(item0=indexOf_3, item1=indexOf_4)
other_3 = List.RemoveItemAtIndex(list=faces_2, indices=create_2)
code_block_4 = CodeBlock { 0.5; }
normalAtParameter_4 = Surface.NormalAtParameter(surface=other_3, u=code_block_4, v=code_block_4)
XAxis_2 = Vector.XAxis()
ZAxis_2 = Vector.ZAxis()
angleAboutAxis_2 = Vector.AngleAboutAxis(vector=normalAtParameter_4, otherVector=XAxis_2, rotationAxis=ZAxis_2)
sortByKey_2 = List.SortByKey(list=other_3, keys=angleAboutAxis_2)
other_4 = CodeBlock(ListA=sortByKey_2.sorted_list) { ListA; }
bottom_2 = List.GetItemAtIndex(list=faces_2, index=indexOf_4)
top_2 = List.GetItemAtIndex(list=faces_2, index=indexOf_3)

# group: Tạo lớp bảo vệ
boolean = BoolSelector(true)
getRebarCover = Custom[Element.GetRebarCover](element=select_bottom_column, ConvertToMM=boolean)  # package BIM4Struc.Rebar; Get the rebar cover dimensions for a selected element.

stird_rebar = RebarBarType("Ø6", ElementType="Autodesk.Revit.DB.Structure.RebarBarType, RevitAPI, Version=21.0.0.0, Culture=neutral, PublicKeyToken=null")  # graph input
getRebarDiameter = RebarTools.Query.getRebarDiameter(rebarBarType=stird_rebar)
mean_rebar = RebarBarType("Ø22", ElementType="Autodesk.Revit.DB.Structure.RebarBarType, RevitAPI, Version=21.0.0.0, Culture=neutral, PublicKeyToken=null")  # graph input
getRebarDiameter_2 = RebarTools.Query.getRebarDiameter(rebarBarType=mean_rebar)

# group: Offset đến tâm thép chủ
code_block_5 = CodeBlock(Cover=getRebarCover.Other, Stird=getRebarDiameter, Bardiameter=getRebarDiameter_2) { -(Cover+Stird+Bardiameter/2); }

# group: Tạo đường giao
create_3 = List.Create(item0=other_2, item1=other_4)
byJoinedSurfaces = PolySurface.ByJoinedSurfaces(surfaces=create_3)
offset = Surface.Offset(surface=byJoinedSurfaces, distance=code_block_5, lacing=Longest)
create_4 = List.Create(item0=bottom, item1=bottom_2)
number = DoubleInput(1)
pointAtParameter = Surface.PointAtParameter(surface=create_4, u=number, v=number)
normalAtParameter_5 = Surface.NormalAtParameter(surface=create_4, u=number, v=number)
byOriginNormal = Plane.ByOriginNormal(origin=pointAtParameter, normal=normalAtParameter_5)
intersect = Geometry.Intersect(geometry=offset, other=byOriginNormal)

# group: Tạo chiều cho thép
code_block_6 = CodeBlock { 50; }
offset_2 = Surface.Offset(surface=bottom, distance=code_block_6)
code_block_7 = CodeBlock(x=offset_2) { x; }
number_2 = DoubleInput(1)
pointAtParameter_2 = Surface.PointAtParameter(surface=code_block_7, u=number_2, v=number_2)
normalAtParameter_6 = Surface.NormalAtParameter(surface=code_block_7, u=number_2, v=number_2)
byOriginNormal_2 = Plane.ByOriginNormal(origin=pointAtParameter_2, normal=normalAtParameter_6)
normal = Plane.Normal(plane=byOriginNormal_2)
reverse = Vector.Reverse(vector=normal)

# group: Tạo điểm
direction = Line.Direction(line=intersect)
XAxis_3 = Vector.XAxis()
angleAboutAxis_3 = Vector.AngleAboutAxis(vector=direction, otherVector=XAxis_3, rotationAxis=reverse)
sortByKey_3 = List.SortByKey(list=intersect, keys=angleAboutAxis_3, lacing=Longest)
code_block_8 = CodeBlock { 2; }
code_block_9 = CodeBlock { 0; }
takeEveryNthItem = List.TakeEveryNthItem(list=sortByKey_3.sorted_list, n=code_block_8, offset=code_block_9, lacing=Longest)
code_block_10 = CodeBlock { 2; }
code_block_11 = CodeBlock { 1; }
takeEveryNthItem_2 = List.TakeEveryNthItem(list=sortByKey_3.sorted_list, n=code_block_10, offset=code_block_11, lacing=Longest)
startPoint = Curve.StartPoint(curve=sortByKey_3.sorted_list)

number_rebar_shots_length = DoubleInput(5)  # graph input
number_rebar_long_length = DoubleInput(5)  # graph input

# group: Tạo điểm trên thanh dài và ngắn
code_block_12 = CodeBlock(NumberRebar=number_rebar_shots_length) { NumberRebar-1; }
pointsAtEqualSegmentLength = Curve.PointsAtEqualSegmentLength(curve=takeEveryNthItem, divisions=code_block_12)
code_block_13 = CodeBlock(NumberRebar=number_rebar_long_length) { NumberRebar-1; }
pointsAtEqualSegmentLength_2 = Curve.PointsAtEqualSegmentLength(curve=takeEveryNthItem_2, divisions=code_block_13)

addItemToEnd = List.AddItemToEnd(item=pointsAtEqualSegmentLength_2, list=startPoint, lacing=Longest)
addItemToEnd_2 = List.AddItemToEnd(item=pointsAtEqualSegmentLength, list=addItemToEnd, lacing=Longest)
code_block_14 = CodeBlock { 2; }
flatten = List.Flatten(list=addItemToEnd_2, amt=code_block_14, lacing=Longest)
uniqueItems = List.UniqueItems(list=flatten, lacing=Longest)
code_block_15 = CodeBlock(SecondPoint=uniqueItems) { SecondPoint[1]; }
# note: By Revit Khmer
# Contact Me: vanda5000262@nuce.edu.vn
beam_hight = DoubleInput(400)  # graph input

# group: Offset bằng mặt dầm
number_3 = DoubleInput(1)
pointAtParameter_3 = Surface.PointAtParameter(surface=bottom, u=number_3, v=number_3)
normalAtParameter_7 = Surface.NormalAtParameter(surface=bottom, u=number_3, v=number_3)
byOriginNormal_3 = Plane.ByOriginNormal(origin=pointAtParameter_3, normal=normalAtParameter_7)
offset_3 = Plane.Offset(plane=byOriginNormal_3, dist=beam_hight)

project = Point.Project(point=code_block_15, baseGeometry=offset_3, projectionDirection=reverse)
flatten_2 = List.Flatten(list=project)
code_block_16 = CodeBlock(points=flatten_2) { points; }

# group: Tạo điểm tâm lọc
X = Point.X(point=code_block_16)
average = Math.Average(numbers=X)
Y = Point.Y(point=code_block_16)
average_2 = Math.Average(numbers=Y)
Z_3 = Point.Z(point=code_block_16)
average_3 = Math.Average(numbers=Z_3)
byCoordinates = Point.ByCoordinates(x=average, y=average_2, z=average_3)
byTwoPoints = Vector.ByTwoPoints(start=byCoordinates, end=code_block_16)
XAxis_4 = Vector.XAxis()
byBestFitThroughPoints = Plane.ByBestFitThroughPoints(points=code_block_16)
normal_2 = Plane.Normal(plane=byBestFitThroughPoints)
Z_4 = Vector.Z(vector=normal_2)
code_block_17 = CodeBlock { 0; }
gt = Z_4 > code_block_17
reverse_2 = Vector.Reverse(vector=normal_2)
if_ = If(test=gt, true=normal_2, false=reverse_2)
angleAboutAxis_4 = Vector.AngleAboutAxis(vector=byTwoPoints, otherVector=XAxis_4, rotationAxis=if_)
sortByKey_4 = List.SortByKey(list=code_block_16, keys=angleAboutAxis_4)

code_block_18 = CodeBlock { 2; }
code_block_19 = CodeBlock { 0; }
takeEveryNthItem_3 = List.TakeEveryNthItem(list=sortByKey_4.sorted_list, n=code_block_18, offset=code_block_19)
replace_length = DoubleInput(30)  # graph input
code_block_20 = CodeBlock(NumberRebar=replace_length, Bardiameter=getRebarDiameter_2) { NumberRebar*Bardiameter; }

# group: Offset mặt đáy cột
code_block_21 = CodeBlock(facee=bottom_2) { facee; }
number_4 = DoubleInput(1)
pointAtParameter_4 = Surface.PointAtParameter(surface=code_block_21, u=number_4, v=number_4)
normalAtParameter_8 = Surface.NormalAtParameter(surface=code_block_21, u=number_4, v=number_4)
byOriginNormal_4 = Plane.ByOriginNormal(origin=pointAtParameter_4, normal=normalAtParameter_8)
code_block_22 = CodeBlock(Reversenumber=code_block_20) { -Reversenumber; }
offset_4 = Plane.Offset(plane=byOriginNormal_4, dist=code_block_22)

chẵn_nấc_1 = Point.Project(point=takeEveryNthItem_3, baseGeometry=offset_4, projectionDirection=normal, lacing=Longest)
flatten_3 = List.Flatten(list=chẵn_nấc_1)
flatten_4 = List.Flatten(list=takeEveryNthItem_3)
code_block_23 = CodeBlock(FirstPoint=uniqueItems) { FirstPoint[0]; }

# group: Lấy điểm
allIndicesOf = List.AllIndicesOf(list=flatten_2, item=sortByKey_4.sorted_list)
flatten_5 = List.Flatten(list=allIndicesOf)
getItemAtIndex = List.GetItemAtIndex(list=code_block_23, index=flatten_5)

code_block_24 = CodeBlock { 2; }
code_block_25 = CodeBlock { 0; }
takeEveryNthItem_4 = List.TakeEveryNthItem(list=getItemAtIndex, n=code_block_24, offset=code_block_25)
flatten_6 = List.Flatten(list=takeEveryNthItem_4)
code_block_26 = CodeBlock(x=bottom) { x; }
number_5 = DoubleInput(1)
pointAtParameter_5 = Surface.PointAtParameter(surface=code_block_26, u=number_5, v=number_5)
normalAtParameter_9 = Surface.NormalAtParameter(surface=code_block_26, u=number_5, v=number_5)
byOriginNormal_5 = Plane.ByOriginNormal(origin=pointAtParameter_5, normal=normalAtParameter_9)

# group: Chiều dài đoạn nối
formula = Formula("Number*Bardiameter", number=replace_length, bardiameter=getRebarDiameter_2)

code_block_27 = CodeBlock(Reversenumber=formula) { -Reversenumber; }
mặt_lẻ_4 = Plane.Offset(plane=byOriginNormal_5, dist=code_block_27)
mặt_chẵn_4 = Plane.Offset(plane=mặt_lẻ_4, dist=code_block_27)
project_2 = Point.Project(point=takeEveryNthItem_4, baseGeometry=mặt_chẵn_4, projectionDirection=reverse, lacing=Longest)
flatten_7 = List.Flatten(list=project_2)
create_5 = List.Create(item0=flatten_3, item1=flatten_4, item2=flatten_6, item3=flatten_7)
transpose = List.Transpose(lists=create_5)
byPoints = PolyCurve.ByPoints(points=transpose)
code_block_28 = CodeBlock { 2; }
code_block_29 = CodeBlock { 1; }
takeEveryNthItem_5 = List.TakeEveryNthItem(list=sortByKey_4.sorted_list, n=code_block_28, offset=code_block_29)
lẻ_nấc_1 = Point.Project(point=takeEveryNthItem_5, baseGeometry=byOriginNormal_4, projectionDirection=normal)
flatten_8 = List.Flatten(list=lẻ_nấc_1)
flatten_9 = List.Flatten(list=takeEveryNthItem_5)
code_block_30 = CodeBlock { 2; }
code_block_31 = CodeBlock { 1; }
takeEveryNthItem_6 = List.TakeEveryNthItem(list=getItemAtIndex, n=code_block_30, offset=code_block_31)
flatten_10 = List.Flatten(list=takeEveryNthItem_6)
project_3 = Point.Project(point=takeEveryNthItem_6, baseGeometry=mặt_lẻ_4, projectionDirection=reverse, lacing=Longest)
flatten_11 = List.Flatten(list=project_3)
create_6 = List.Create(item0=flatten_8, item1=flatten_9, item2=flatten_10, item3=flatten_11)
transpose_2 = List.Transpose(lists=create_6)
byPoints_2 = PolyCurve.ByPoints(points=transpose_2)
create_7 = List.Create(item0=byPoints, item1=byPoints_2)
startPoint_2 = Curve.StartPoint(curve=create_7)
endPoint = Curve.EndPoint(curve=create_7)
byTwoPoints_2 = Vector.ByTwoPoints(start=startPoint_2, end=endPoint)
isParallel = Vector.IsParallel(vector=byTwoPoints_2, other=reverse)
byStartPointEndPoint = Line.ByStartPointEndPoint(startPoint=startPoint_2, endPoint=endPoint)
if_2 = If(test=isParallel, true=byStartPointEndPoint, false=create_7)
id = Element.Id(element=select_bottom_column)
rebar_style = RebarStyle("Standard", EnumerationType="Autodesk.Revit.DB.Structure.RebarStyle, RevitAPI, Version=21.0.0.0, Culture=neutral, PublicKeyToken=null")
rebar_hook_orientation = RebarHookOrientation("Left", EnumerationType="Autodesk.Revit.DB.Structure.RebarHookOrientation, RevitAPI, Version=21.0.0.0, Culture=neutral, PublicKeyToken=null")
rebar_hook_type = RevitRebarHookType("None", ElementType="Autodesk.Revit.DB.Structure.RebarHookType, RevitAPI, Version=21.0.0.0, Culture=neutral, PublicKeyToken=null")
basePlane = PolyCurve.BasePlane(polyCurve=create_7)
normal_3 = Plane.Normal(plane=basePlane)
byCurve = Rebar.ByCurve(curve=if_2, hostElementId=id, rebarStyle=rebar_style, rebarBarType=mean_rebar, startHookOrientation=rebar_hook_orientation, endHookOrientation=rebar_hook_orientation, startHookType=rebar_hook_type, endHookType=rebar_hook_type, vector=normal_3)
current = Document.Current()
activeView = Document.ActiveView(document=current)
setSolidInView = Custom[Rebar.SetSolidInView](rebarElements=byCurve, views=activeView)  # package BIM4Struc.Rebar; Sets this rebar element to be shown solidly in a 3D view.
setUnobscuredInView = Custom[Rebar.SetUnobscuredInView](rebarElements=byCurve, views=activeView)  # package BIM4Struc.Rebar; Sets this rebar element to be shown unobscured in a view.
faces_3 = Element.Faces(element=select_bottom_column)

# group: New
code_block_32 = CodeBlock(surface=faces_3) { surface; }
code_block_33 = CodeBlock { 0.5; }
normalAtParameter_10 = Surface.NormalAtParameter(surface=code_block_32, u=code_block_33, v=code_block_33)
Z_5 = Vector.Z(vector=normalAtParameter_10)
maximumItem_3 = List.MaximumItem(list=Z_5)
indexOf_5 = List.IndexOf(list=Z_5, element=maximumItem_3)
minimumItem_3 = List.MinimumItem(list=Z_5)
indexOf_6 = List.IndexOf(list=Z_5, element=minimumItem_3)
list_create = List.Create(item0=indexOf_5, item1=indexOf_6)
removeItemAtIndex = List.RemoveItemAtIndex(list=code_block_32, indices=list_create)
code_block_34 = CodeBlock { 0.5; }
normalAtParameter_11 = Surface.NormalAtParameter(surface=removeItemAtIndex, u=code_block_34, v=code_block_34)
XAxis_5 = Vector.XAxis()
ZAxis_3 = Vector.ZAxis()
angleAboutAxis_5 = Vector.AngleAboutAxis(vector=normalAtParameter_11, otherVector=XAxis_5, rotationAxis=ZAxis_3)
other_5 = List.SortByKey(list=removeItemAtIndex, keys=angleAboutAxis_5)
bottom_3 = List.GetItemAtIndex(list=code_block_32, index=indexOf_6)
top_3 = List.GetItemAtIndex(list=code_block_32, index=indexOf_5)

# group: Lấy mặt phẳng bên
byJoinedSurfaces_2 = PolySurface.ByJoinedSurfaces(surfaces=other_5.sorted_list)

# group: Lấy lớp bảo vệ
getRebarCover_2 = Custom[Element.GetRebarCover](element=select_bottom_column)

getRebarDiameter_3 = RebarTools.Query.getRebarDiameter(rebarBarType=stird_rebar)

# group: tạo bề dày lớp bảo vệ tính đến tim thép
code_block_35 = CodeBlock(COVER=getRebarCover_2.Other, stir=getRebarDiameter_3) { -(COVER+stir/2); }

# group: Offset vào một khoảng bằng lớp bảo vệ đến tim thép
offset_5 = Surface.Offset(surface=byJoinedSurfaces_2, distance=code_block_35)

code_block_36 = CodeBlock { -25; }

# group: Offset từ mặt dưới cột lên
offset_6 = Surface.Offset(surface=bottom_3, distance=code_block_36)

# group: Tạo đường thẳng từ đường giao các mặt phẳng
intersect_2 = Geometry.Intersect(geometry=offset_5, other=offset_6)

# group: Tạo thành 1 đường từ nhiều đường
byJoinedCurves = PolyCurve.ByJoinedCurves(curves=intersect_2)

# group: Tạo vector vuông góc với các đường thẳng
normal_4 = Curve.Normal(curve=byJoinedCurves)

# group: Đổi hướng
reverse_3 = Vector.Reverse(vector=normal_4)

# group: Tạo cây thép
id_2 = Element.Id(element=select_bottom_column)
rebar_style_2 = RebarStyle("StirrupTie", EnumerationType="Autodesk.Revit.DB.Structure.RebarStyle, RevitAPI, Version=21.0.0.0, Culture=neutral, PublicKeyToken=null")
rebar_hook_orientation_2 = RebarHookOrientation("Right", EnumerationType="Autodesk.Revit.DB.Structure.RebarHookOrientation, RevitAPI, Version=21.0.0.0, Culture=neutral, PublicKeyToken=null")
rebar_hook_type_2 = RevitRebarHookType("Stirrup - 135 deg", ElementType="Autodesk.Revit.DB.Structure.RebarHookType, RevitAPI, Version=21.0.0.0, Culture=neutral, PublicKeyToken=null")
byCurve_2 = Rebar.ByCurve(curve=byJoinedCurves, hostElementId=id_2, rebarStyle=rebar_style_2, rebarBarType=stird_rebar, startHookOrientation=rebar_hook_orientation_2, endHookOrientation=rebar_hook_orientation_2, startHookType=rebar_hook_type_2, endHookType=rebar_hook_type_2, vector=reverse_3)

# group: Hiển thị 3D
current_2 = Document.Current()
activeView_2 = Document.ActiveView(document=current_2)
setSolidInView_2 = Custom[Rebar.SetSolidInView](rebarElements=byCurve_2, views=activeView_2)
setUnobscuredInView_2 = Custom[Rebar.SetUnobscuredInView](rebarElements=byCurve_2, views=activeView_2)

boolean_2 = BoolSelector(false)

# group: Lọc lấy chiều dài
code_block_37 = CodeBlock { "Length"; }
getParameterValueByName = Element.GetParameterValueByName(element=select_bottom_column, parameterName=code_block_37)

code_block_38 = CodeBlock(Hightcolum=getParameterValueByName, Hightbeam=beam_hight) { Hightcolum-Hightbeam; }

# group: Offset mặt phẳng từ chân cột lên 5L/6
code_block_39 = CodeBlock(a=code_block_38) { -5*a/6; }
offset_7 = Surface.Offset(surface=bottom_3, distance=code_block_39)

# group: Tạo đường thẳng từ đường giao các mặt phẳng
intersect_3 = Geometry.Intersect(geometry=offset_5, other=offset_7)

# group: Tạo thành 1 đường từ nhiều đường
byJoinedCurves_2 = PolyCurve.ByJoinedCurves(curves=intersect_3)

# group: Tạo vector vuông góc với các đường thẳng
normal_5 = Curve.Normal(curve=byJoinedCurves_2)

# group: Đổi hướng
reverse_4 = Vector.Reverse(vector=normal_5)

# group: Tạo cây thép
id_3 = Element.Id(element=select_bottom_column)
rebar_style_3 = RebarStyle("StirrupTie", EnumerationType="Autodesk.Revit.DB.Structure.RebarStyle, RevitAPI, Version=21.0.0.0, Culture=neutral, PublicKeyToken=null")
rebar_hook_orientation_3 = RebarHookOrientation("Right", EnumerationType="Autodesk.Revit.DB.Structure.RebarHookOrientation, RevitAPI, Version=21.0.0.0, Culture=neutral, PublicKeyToken=null")
rebar_hook_type_3 = RevitRebarHookType("Stirrup - 135 deg", ElementType="Autodesk.Revit.DB.Structure.RebarHookType, RevitAPI, Version=21.0.0.0, Culture=neutral, PublicKeyToken=null")
byCurve_3 = Rebar.ByCurve(curve=byJoinedCurves_2, hostElementId=id_3, rebarStyle=rebar_style_3, rebarBarType=stird_rebar, startHookOrientation=rebar_hook_orientation_3, endHookOrientation=rebar_hook_orientation_3, startHookType=rebar_hook_type_3, endHookType=rebar_hook_type_3, vector=reverse_4)

# group: Hiển thị 3D
current_3 = Document.Current()
activeView_3 = Document.ActiveView(document=current_3)
setSolidInView_3 = Custom[Rebar.SetSolidInView](rebarElements=byCurve_3, views=activeView_3)
setUnobscuredInView_3 = Custom[Rebar.SetUnobscuredInView](rebarElements=byCurve_3, views=activeView_3)

# group: L/6
code_block_40 = CodeBlock(a=code_block_38) { a/6; }

# group: Làm tròn lên 5
code_block_41 = CodeBlock(a=code_block_40) { a/5; }
code_block_42 = CodeBlock(a=code_block_41) { a-0.00001; }
ceiling = Math.Ceiling(number=code_block_42)
code_block_43 = CodeBlock(a=ceiling, b=code_block_36) { a*5+b; }

# group: Offset mặt phẳng từ chân cột lên L/6
code_block_44 = CodeBlock(a=code_block_43, b=code_block_36) { -a+b; }
offset_8 = Surface.Offset(surface=bottom_3, distance=code_block_44)

# group: Tạo đường thẳng từ đường giao các mặt phẳng
intersect_4 = Geometry.Intersect(geometry=offset_5, other=offset_8)

# group: Tạo thành 1 đường từ nhiều đường
byJoinedCurves_3 = PolyCurve.ByJoinedCurves(curves=intersect_4)

# group: Tạo vector vuông góc với các đường thẳng
normal_6 = Curve.Normal(curve=byJoinedCurves_3)

# group: Đổi hướng
reverse_5 = Vector.Reverse(vector=normal_6)

# group: Tạo cây thép
id_4 = Element.Id(element=select_bottom_column)
rebar_style_4 = RebarStyle("StirrupTie", EnumerationType="Autodesk.Revit.DB.Structure.RebarStyle, RevitAPI, Version=21.0.0.0, Culture=neutral, PublicKeyToken=null")
rebar_hook_orientation_4 = RebarHookOrientation("Right", EnumerationType="Autodesk.Revit.DB.Structure.RebarHookOrientation, RevitAPI, Version=21.0.0.0, Culture=neutral, PublicKeyToken=null")
rebar_hook_type_4 = RevitRebarHookType("Stirrup - 135 deg", ElementType="Autodesk.Revit.DB.Structure.RebarHookType, RevitAPI, Version=21.0.0.0, Culture=neutral, PublicKeyToken=null")
byCurve_4 = Rebar.ByCurve(curve=byJoinedCurves_3, hostElementId=id_4, rebarStyle=rebar_style_4, rebarBarType=stird_rebar, startHookOrientation=rebar_hook_orientation_4, endHookOrientation=rebar_hook_orientation_4, startHookType=rebar_hook_type_4, endHookType=rebar_hook_type_4, vector=reverse_5)

# group: Hiển thị 3D
current_4 = Document.Current()
activeView_4 = Document.ActiveView(document=current_4)
setSolidInView_4 = Custom[Rebar.SetSolidInView](rebarElements=byCurve_4, views=activeView_4)
setUnobscuredInView_4 = Custom[Rebar.SetUnobscuredInView](rebarElements=byCurve_4, views=activeView_4)

sapcing_stir_rebar_center_column = DoubleInput(200)  # graph input
code_block_45 = CodeBlock(a=ceiling) { a*5; }

# group: 2/3L
code_block_46 = CodeBlock(a=code_block_38, b=code_block_45) { a-2*b; }

# group: Pakage(Dynamo for Rebar 2.0)
code_block_47 = CodeBlock { true; }
setLayoutAsMaximumSpacing = DynamoRebar.Rebar.SetLayoutAsMaximumSpacing(rebar=byCurve_4, spacing=sapcing_stir_rebar_center_column, arrayLength=code_block_46, barsOnNormalSide=code_block_47, includeFirstBar=code_block_47, includeLastBar=code_block_47)

spacing_stir_rebar_bottom_column = DoubleInput(150)  # graph input

# group: 1/6L
code_block_48 = CodeBlock(a=code_block_38) { a/6; }

# group: Làm tròn lên 5
code_block_49 = CodeBlock(a=code_block_48) { a/5; }
code_block_50 = CodeBlock(a=code_block_49) { a-0.00001; }
ceiling_2 = Math.Ceiling(number=code_block_50)
code_block_51 = CodeBlock(a=ceiling_2, b=code_block_36) { a*5+b; }

# group: Pakage(Dynamo for Rebar 2.0)
code_block_52 = CodeBlock { true; }
setLayoutAsMaximumSpacing_2 = DynamoRebar.Rebar.SetLayoutAsMaximumSpacing(rebar=byCurve_2, spacing=spacing_stir_rebar_bottom_column, arrayLength=code_block_51, barsOnNormalSide=code_block_52, includeFirstBar=code_block_52, includeLastBar=code_block_52)

spacing_stir_rebar_top_column = DoubleInput(150)  # graph input

# group: Pakage(Dynamo for Rebar 2.0)
code_block_53 = CodeBlock { true; }
setLayoutAsMaximumSpacing_3 = DynamoRebar.Rebar.SetLayoutAsMaximumSpacing(rebar=byCurve_3, spacing=spacing_stir_rebar_top_column, arrayLength=code_block_51, barsOnNormalSide=code_block_53, includeFirstBar=code_block_53, includeLastBar=code_block_53)
