# Dynamo graph SPCC_ViewToSheetByName.dyn (Dynamo 2.13.1.3887)
# packages: Genius Loci 2022.9.16, Clockwork for Dynamo 2.x 2.4.0, SteamNodes 1.2.4

categories = Categories("OST_Sheets")
all_elements_of_type = Custom[All Elements of Type+](type=categories)  # package Genius Loci; Get the instances of the given type. Works with ElementType, FamilyType, ViewFamilyType, Wall/Floor/Roof/CeilingType, GroupType, FilledRegionType and TextNoteType.
name = Element.Name(element=all_elements_of_type)
boolean = BoolSelector(false)
views = Custom[Document.Views](toggle=boolean)  # package Clockwork for Dynamo 2.x; Gets all views in the document - except for 3D view templates (as long as this bug is not fixed: https://github.com/DynamoDS/Dynamo/issues/2970)
name_2 = Element.Name(element=views)
setIntersection = List.SetIntersection(list1=name, list2=name_2)
sheet_byname = Custom[Sheet ByName](NameOrNumber=setIntersection)  # package Genius Loci; Collects sheets by name or number in the active or given document.
view_byname = Custom[View ByName](ViewName=setIntersection)  # package Genius Loci; Collect views by given name in the active or given document. Based on a Christian Gartland's script.
code_block = CodeBlock { 530; }
code_block_2 = CodeBlock { 400; }
byCoordinates = Point.ByCoordinates(x=code_block, y=code_block_2)
count = List.Count(list=view_byname)
ofRepeatedItem = List.OfRepeatedItem(item=byCoordinates, amount=count)
placeViewsOnExistingSheets = Custom[Tool.PlaceViewsOnExistingSheets](Sheet=sheet_byname, view_byname, ofRepeatedItem)  # package SteamNodes; Place the views on the sheets at the points you provide.
