# Dynamo graph VDA_AreaReinforcement.dyn (Dynamo 2.18.1.5096)
# packages: Structural Design 2023.4.25, BIM4Struc.Rebar 1.3.0

select_model_element = DSModelElementSelection()  # 1 picked in the model
XAxis = Vector.XAxis()
boolean = BoolSelector(true)
top_major_bar_type = RevitRebarBarType("Ø10")
top_major_spacing = DoubleInput(150)
top_minor_bar_type = RevitRebarBarType("Ø12")
top_minor_spacing = DoubleInput(150)
bottom_major_bar_type = RevitRebarBarType("Ø10")
bottom_major_spacing = DoubleInput(150)
bottom_minor_bar_type = RevitRebarBarType("Ø8")
bottomminor_spacing = DoubleInput(150)
createBasedOnHost = StructuralDesign.Rebar.AreaReinforcement.AreaReinforcement.CreateBasedOnHost(hostElement=select_model_element, majorDirection=XAxis, layoutRule=boolean, topMajorBarType=top_major_bar_type, topMajorSpacing=top_major_spacing, topMinorBarType=top_minor_bar_type, topMinorSpacing=top_minor_spacing, bottomMajorBarType=bottom_major_bar_type, bottomMajorSpacing=bottom_major_spacing, bottomMinorBarType=bottom_minor_bar_type, bottomMinorSpacing=bottomminor_spacing)
removeAreaReinforcementSystem = StructuralDesign.Rebar.AreaReinforcement.AreaReinforcement.RemoveAreaReinforcementSystem(areaReinforcement=createBasedOnHost)
current = Document.Current()
activeView = Document.ActiveView(document=current)
boolean_2 = BoolSelector(true)
setSolidInView = Custom[Rebar.SetSolidInView](rebarElements=removeAreaReinforcementSystem, views=activeView, solid=boolean_2)  # package BIM4Struc.Rebar; Sets this rebar element to be shown solidly in a 3D view.
setUnobscuredInView = StructuralDesign.Rebar.Create.SetUnobscuredInView(rebar=removeAreaReinforcementSystem, view=activeView, unobscured=boolean_2)
