# Dynamo graph VDA_RebarBeam.dyn (Dynamo 2.6.1.8786)
# packages: Dynamo for Rebar 2.0.2, Structural Design 2021.1.22, BIM4Struc.Rebar 1.3.0

select_beam = DSModelElementSelection()  # 1 picked in the model; graph input
code_block = CodeBlock(element=select_beam) { element; }
getLocation = Element.GetLocation(element=code_block)
startPoint = Curve.StartPoint(curve=getLocation)
code_block_2 = CodeBlock { 0; }
coordinateSystemAtParameter = Curve.CoordinateSystemAtParameter(curve=getLocation, param=code_block_2)
YAxis = CoordinateSystem.YAxis(coordinateSystem=coordinateSystemAtParameter)
code_block_3 = CodeBlock { 1000; }
byStartPointDirectionLength = Line.ByStartPointDirectionLength(startPoint=startPoint, direction=YAxis, length=code_block_3)
XAxis = CoordinateSystem.XAxis(coordinateSystem=coordinateSystemAtParameter)
byStartPointDirectionLength_2 = Line.ByStartPointDirectionLength(startPoint=startPoint, direction=XAxis, length=code_block_3)
geometry = Element.Geometry(element=code_block)
explode = Geometry.Explode(geometry=geometry)
code_block_4 = CodeBlock { 0.5; }
normalAtParameter = Surface.NormalAtParameter(surface=explode, u=code_block_4, v=code_block_4)
tangentAtParameter = Curve.TangentAtParameter(curve=getLocation, param=code_block_4)
isParallel = Vector.IsParallel(vector=normalAtParameter, other=tangentAtParameter)
filterByBoolMask = List.FilterByBoolMask(list=explode, mask=isParallel)
flatten = List.Flatten(list=filterByBoolMask.in)
distanceTo = Geometry.DistanceTo(geometry=flatten, other=startPoint)
sortByKey = List.SortByKey(list=flatten, keys=distanceTo)
code_block_5 = CodeBlock(a=sortByKey.sorted_list) { a; }
code_block_6 = CodeBlock { 2; }
chop = List.Chop(list=code_block_5, lengths=code_block_6)
transpose = List.Transpose(lists=chop)
code_block_7 = CodeBlock(lst=transpose) { lst[0]; }

# group: Thou Vanda
space_stirrup_rebar_compare_with = DoubleInput(50)  # "Space stirrup rebar compare with column"; graph input
thickness_lean_concrete = DoubleInput(40)  # graph input
ø_stirrup = StringInput("8")  # graph input
n_stirrup_rebar_head_beam = StringInput("10,20,15")  # graph input
space_stirrup_rebar_head_beam = StringInput("100,150,100")  # graph input
space_stirrup_rebar_middle_beam = StringInput("200,200,200")  # graph input
ø_mainbar_bot_layer = StringInput("16")  # graph input
space_between_bar_layer = DoubleInput(50)  # graph input
ø_mainbar_bot_layer_top_column = StringInput("16")  # "Ø Mainbar Bot layer Top Column Middle Beam"; graph input
space_main_rebar_compared_with = DoubleInput(70)  # "Space main rebar compared with side column"; graph input
n_main_rebar_top_layer = DoubleInput(4)  # graph input
ø_mainbar_top_layer = StringInput("16")  # graph input
n_main_rebar_bot_layer = DoubleInput(4)  # graph input
l_main_rebar_top_layer_head_beam = DoubleInput(2000)  # graph input
ø_mainbar_top_layer_head_beam = StringInput("16")  # graph input
n_rebar_top_layer_head_beam = DoubleInput(4)  # graph input
l_main_rebar_top_layer_inside_at = DoubleInput(2000)  # "L main rebar top layer inside at column"; graph input
l_main_rebar_top_layer_outside = DoubleInput(2500)  # "L main rebar top layer outside at column"; graph input
ø_mainbar_top_layer_top_column = StringInput("16")  # "Ø Mainbar Top layer Top Column Middle Beam"; graph input
n_main_rebar_add_middle_all = DoubleInput(4)  # "N main rebar add middle all beams"; graph input

translate = Geometry.Translate(geometry=code_block_7, direction=YAxis, distance=space_stirrup_rebar_compare_with)
perimeterCurves = Surface.PerimeterCurves(surface=translate)
byJoinedCurves = PolyCurve.ByJoinedCurves(curves=perimeterCurves)
code_block_8 = CodeBlock(a=thickness_lean_concrete) { -a; }
offset = Curve.Offset(curve=byJoinedCurves, distance=code_block_8)
explode_2 = Geometry.Explode(geometry=offset)
startPoint_2 = Curve.StartPoint(curve=explode_2)
boolean = BoolSelector(true)  # graph input
byPoints = PolyCurve.ByPoints(points=startPoint_2, connectLastToFirst=boolean)
id = Element.Id(element=code_block)
rebar_style = RebarStyle("StirrupTie", EnumerationType="Autodesk.Revit.DB.Structure.RebarStyle, RevitAPI, Version=21.0.0.0, Culture=neutral, PublicKeyToken=null")
diameter_stirrup = StringInput("Ø")  # graph input
code_block_9 = CodeBlock(a=diameter_stirrup, b=ø_stirrup) { a+b; }
byName = RebarBarType.ByName(name=code_block_9)
rebar_hook_orientation = RebarHookOrientation("Left", EnumerationType="Autodesk.Revit.DB.Structure.RebarHookOrientation, RevitAPI, Version=21.0.0.0, Culture=neutral, PublicKeyToken=null")
rebar_hook_type = RevitRebarHookType("Stirrup/Tie - 135 deg.", ElementType="Autodesk.Revit.DB.Structure.RebarHookType, RevitAPI, Version=21.0.0.0, Culture=neutral, PublicKeyToken=null")
normal = Curve.Normal(curve=byPoints)
byCurve = Rebar.ByCurve(curve=byPoints, hostElementId=id, rebarStyle=rebar_style, rebarBarType=byName, startHookOrientation=rebar_hook_orientation, endHookOrientation=rebar_hook_orientation, startHookType=rebar_hook_type, endHookType=rebar_hook_type, vector=normal)
string = StringInput(",")
split = String.Split(str=n_stirrup_rebar_head_beam, separator0=string)
flatten_2 = List.Flatten(list=split)
toNumber = String.ToNumber(str=flatten_2)
string_2 = StringInput(",")
split_2 = String.Split(str=space_stirrup_rebar_head_beam, separator0=string_2)
flatten_3 = List.Flatten(list=split_2)
toNumber_2 = String.ToNumber(str=flatten_3)
isAlmostEqualTo = Vector.IsAlmostEqualTo(vector=normal, other=YAxis)
setLayoutAsNumberWithSpacing = StructuralDesign.Rebar.Layout.SetLayoutAsNumberWithSpacing(rebar=byCurve, numberOfBarPositions=toNumber, spacing=toNumber_2, barsOnNormalSide=isAlmostEqualTo)
code_block_10 = CodeBlock(number=toNumber) { number-1; }
code_block_11 = CodeBlock(number=code_block_10, spacing=toNumber_2) { number*spacing; }
flatten_4 = List.Flatten(list=filterByBoolMask.out)
code_block_12 = CodeBlock { 0.5; }
pointAtParameter = Surface.PointAtParameter(surface=flatten_4, u=code_block_12, v=code_block_12)
Z = Point.Z(point=pointAtParameter)
sortByKey_2 = List.SortByKey(list=flatten_4, keys=Z)
count = List.Count(list=sortByKey_2.sorted_list)
count_2 = List.Count(list=chop)
code_block_13 = CodeBlock(lst=sortByKey_2.sorted_list, n=count, a=count_2) { lst[n-a..n-1]; }
code_block_14 = CodeBlock { 0.5; }
pointAtParameter_2 = Surface.PointAtParameter(surface=code_block_13, u=code_block_14, v=code_block_14)
distanceTo_2 = Geometry.DistanceTo(geometry=pointAtParameter_2, other=startPoint)
sortByKey_3 = List.SortByKey(list=code_block_13, keys=distanceTo_2)
YZPlane = CoordinateSystem.YZPlane(coordinateSystem=coordinateSystemAtParameter)
intersect = Geometry.Intersect(geometry=sortByKey_3.sorted_list, other=YZPlane)
flatten_5 = List.Flatten(list=intersect)
length = Curve.Length(curve=flatten_5)
code_block_15 = CodeBlock(length=length, offset=space_stirrup_rebar_compare_with, kc1=code_block_11) { length-offset*2-kc1*2; }
string_3 = StringInput(",")
split_3 = String.Split(str=space_stirrup_rebar_middle_beam, separator0=string_3)
flatten_6 = List.Flatten(list=split_3)
toNumber_3 = String.ToNumber(str=flatten_6)
code_block_16 = CodeBlock(lengthMid=code_block_15, spacingMid=toNumber_3) { lengthMid/spacingMid; }
floor = Math.Floor(number=code_block_16)
code_block_17 = CodeBlock(numbermid=floor, spacingMid=toNumber_3) { numbermid*spacingMid; }
code_block_18 = CodeBlock(a=code_block_15, b=code_block_17) { (a-b)/2; }
code_block_19 = CodeBlock(a=code_block_18, spacing=toNumber_2) { a>spacing; }
code_block_20 = CodeBlock(a=code_block_18) { a+100; }
if_ = If(test=code_block_19, true=code_block_18, false=code_block_20)
code_block_21 = CodeBlock(a=code_block_11, b=if_) { a+b; }
translate_2 = Geometry.Translate(geometry=byPoints, direction=YAxis, distance=code_block_21)
byCurve_2 = Rebar.ByCurve(curve=translate_2, hostElementId=id, rebarStyle=rebar_style, rebarBarType=byName, startHookOrientation=rebar_hook_orientation, endHookOrientation=rebar_hook_orientation, startHookType=rebar_hook_type, endHookType=rebar_hook_type, vector=normal)
code_block_22 = CodeBlock(a=floor) { a-1; }
if_2 = If(test=code_block_19, true=floor, false=code_block_22)
code_block_23 = CodeBlock(a=if_2) { a+1; }
setLayoutAsNumberWithSpacing_2 = StructuralDesign.Rebar.Layout.SetLayoutAsNumberWithSpacing(rebar=byCurve_2, numberOfBarPositions=code_block_23, spacing=toNumber_3, barsOnNormalSide=isAlmostEqualTo)
code_block_24 = CodeBlock(number=if_2, spacing=toNumber_3) { number*spacing; }
code_block_25 = CodeBlock(a=code_block_11, b=if_, c=code_block_24) { a+b*2+c; }
translate_3 = Geometry.Translate(geometry=byPoints, direction=YAxis, distance=code_block_25)
byCurve_3 = Rebar.ByCurve(curve=translate_3, hostElementId=id, rebarStyle=rebar_style, rebarBarType=byName, startHookOrientation=rebar_hook_orientation, endHookOrientation=rebar_hook_orientation, startHookType=rebar_hook_type, endHookType=rebar_hook_type, vector=normal)
setLayoutAsNumberWithSpacing_3 = StructuralDesign.Rebar.Layout.SetLayoutAsNumberWithSpacing(rebar=byCurve_3, numberOfBarPositions=toNumber, spacing=toNumber_2, barsOnNormalSide=isAlmostEqualTo)
code_block_26 = CodeBlock { 0.5; }
pointAtParameter_3 = Surface.PointAtParameter(surface=chop, u=code_block_26, v=code_block_26)
byPoints_2 = PolyCurve.ByPoints(points=pointAtParameter_3)
pointAtParameter_4 = Curve.PointAtParameter(curve=byPoints_2, param=code_block_26)
ZAxis = Vector.ZAxis()
reverse = Vector.Reverse(vector=ZAxis)
code_block_27 = CodeBlock(a=perimeterCurves) { a[0]; }
code_block_28 = CodeBlock { 0.5; }
tangentAtParameter_2 = Curve.TangentAtParameter(curve=code_block_27, param=code_block_28)
isParallel_2 = Vector.IsParallel(vector=tangentAtParameter_2, other=XAxis)
filterByBoolMask_2 = List.FilterByBoolMask(list=code_block_27, mask=isParallel_2)
code_block_29 = CodeBlock(a=filterByBoolMask_2.out) { a[0]; }
length_2 = Curve.Length(curve=code_block_29)
toNumber_4 = String.ToNumber(str=ø_stirrup)
toNumber_5 = String.ToNumber(str=ø_mainbar_bot_layer)
code_block_30 = CodeBlock(cover=thickness_lean_concrete, d1=toNumber_4, d2=toNumber_5) { cover+d1+d2/2; }
code_block_31 = CodeBlock(l=length_2, b=code_block_30, kc=space_between_bar_layer) { l/2-b-kc; }
translate_4 = Geometry.Translate(geometry=pointAtParameter_4, direction=reverse, distance=code_block_31)
code_block_32 = CodeBlock(a=filterByBoolMask_2.in) { a[0]; }
length_3 = Curve.Length(curve=code_block_32)
code_block_33 = CodeBlock(a=code_block_30) { a+10; }
code_block_34 = CodeBlock(length=length_3, a=code_block_33) { length-a*2; }
code_block_35 = CodeBlock(a=code_block_34) { a/2; }
translate_5 = Geometry.Translate(geometry=translate_4, direction=XAxis, distance=code_block_35)
reverse_2 = Vector.Reverse(vector=YAxis)
code_block_36 = CodeBlock(a=if_2, b=toNumber_3) { a*b/2; }
translate_6 = Geometry.Translate(geometry=translate_5, direction=reverse_2, distance=code_block_36)
translate_7 = Geometry.Translate(geometry=translate_5, direction=YAxis, distance=code_block_36)
byStartPointEndPoint = Line.ByStartPointEndPoint(startPoint=translate_6, endPoint=translate_7)
rebar_style_2 = RebarStyle("Standard", EnumerationType="Autodesk.Revit.DB.Structure.RebarStyle, RevitAPI, Version=21.0.0.0, Culture=neutral, PublicKeyToken=null")
code_block_37 = CodeBlock(a=diameter_stirrup, b=ø_mainbar_bot_layer_top_column) { a+b; }
byName_2 = RebarBarType.ByName(name=code_block_37)
rebar_hook_orientation_2 = RebarHookOrientation("Left", EnumerationType="Autodesk.Revit.DB.Structure.RebarHookOrientation, RevitAPI, Version=21.0.0.0, Culture=neutral, PublicKeyToken=null")
rebar_hook_type_2 = RevitRebarHookType("None", ElementType="Autodesk.Revit.DB.Structure.RebarHookType, RevitAPI, Version=21.0.0.0, Culture=neutral, PublicKeyToken=null")
code_block_38 = CodeBlock(a=flatten_5) { a[0]; }
ZAxis_2 = Vector.ZAxis()
reverse_3 = Vector.Reverse(vector=ZAxis_2)
translate_8 = Geometry.Translate(geometry=code_block_38, direction=reverse_3, distance=code_block_30)
code_block_39 = CodeBlock { 0.5; }
pointAtParameter_5 = Curve.PointAtParameter(curve=translate_8, param=code_block_39)

# group: Filter column intersect with beam by level id
categories = Categories("OST_StructuralColumns")  # graph input
all_elements_of_category = ElementsOfCategory(Category=categories)
code_block_40 = CodeBlock { "Reference Level"; }
getParameterValueByName = Element.GetParameterValueByName(element=code_block, parameterName=code_block_40)
id_2 = Element.Id(element=getParameterValueByName)
code_block_41 = CodeBlock { "Top Level"; }
getParameterValueByName_2 = Element.GetParameterValueByName(element=all_elements_of_category, parameterName=code_block_41)
id_3 = Element.Id(element=getParameterValueByName_2)
eq = id_2 == id_3
filterByBoolMask_3 = List.FilterByBoolMask(list=all_elements_of_category, mask=eq)
geometry_2 = Element.Geometry(element=filterByBoolMask_3.in)
flatten_7 = List.Flatten(list=geometry_2)
doesIntersect = Geometry.DoesIntersect(geometry=geometry, other=flatten_7, lacing=CrossProduct)
flatten_8 = List.Flatten(list=doesIntersect)
filterByBoolMask_4 = List.FilterByBoolMask(list=flatten_7, mask=flatten_8)

explode_3 = Geometry.Explode(geometry=filterByBoolMask_4.in)
flatten_9 = List.Flatten(list=explode_3)
code_block_42 = CodeBlock { 0.5; }
normalAtParameter_2 = Surface.NormalAtParameter(surface=flatten_9, u=code_block_42, v=code_block_42)
isParallel_3 = Vector.IsParallel(vector=normalAtParameter_2, other=YAxis)
filterByBoolMask_5 = List.FilterByBoolMask(list=flatten_9, mask=isParallel_3)
code_block_43 = CodeBlock { 2000; }
translate_9 = Geometry.Translate(geometry=startPoint, direction=reverse_2, distance=code_block_43)
distanceTo_3 = Geometry.DistanceTo(geometry=translate_9, other=filterByBoolMask_5.in)
sortByKey_4 = List.SortByKey(list=filterByBoolMask_5.in, keys=distanceTo_3)
firstItem = List.FirstItem(list=sortByKey_4.sorted_list)
translate_10 = Geometry.Translate(geometry=firstItem, direction=YAxis, distance=space_main_rebar_compared_with)
project = Point.Project(point=pointAtParameter_5, baseGeometry=translate_10, projectionDirection=reverse_2)
code_block_44 = CodeBlock(a=sortByKey_2.sorted_list) { a[0]; }
code_block_45 = CodeBlock { 0.5; }
pointAtParameter_6 = Surface.PointAtParameter(surface=code_block_44, u=code_block_45, v=code_block_45)
normalAtParameter_3 = Surface.NormalAtParameter(surface=code_block_44, u=code_block_45, v=code_block_45)
byOriginNormal = Plane.ByOriginNormal(origin=pointAtParameter_6, normal=normalAtParameter_3)
translate_11 = Geometry.Translate(geometry=byOriginNormal, direction=ZAxis_2, distance=code_block_30)
project_2 = Point.Project(point=project, baseGeometry=translate_11, projectionDirection=reverse_3)
lastItem = List.LastItem(list=sortByKey_4.sorted_list)
translate_12 = Geometry.Translate(geometry=lastItem, direction=reverse_2, distance=space_main_rebar_compared_with)
project_3 = Point.Project(point=project, baseGeometry=translate_12, projectionDirection=YAxis)
project_4 = Point.Project(point=project_3, baseGeometry=translate_11, projectionDirection=reverse_3)
create = List.Create(item0=project_2, item1=project, item2=project_3, item3=project_4)
flatten_10 = List.Flatten(list=create)
byPoints_3 = PolyCurve.ByPoints(points=flatten_10)
translate_13 = Geometry.Translate(geometry=byPoints_3, direction=XAxis, distance=code_block_35)
normal_2 = Curve.Normal(curve=translate_13)

# group: Main bar bot layer middle beam
byCurve_4 = Rebar.ByCurve(curve=byStartPointEndPoint, hostElementId=id, rebarStyle=rebar_style_2, rebarBarType=byName_2, startHookOrientation=rebar_hook_orientation_2, endHookOrientation=rebar_hook_orientation_2, startHookType=rebar_hook_type_2, endHookType=rebar_hook_type_2, vector=normal_2)
code_block_46 = CodeBlock(a=n_main_rebar_top_layer) { a; }
code_block_47 = CodeBlock(a=code_block_34) { a; }
code_block_48 = CodeBlock(a=code_block_47, n=code_block_46) { a/(n-1); }
setLayoutAsNumberWithSpacing_4 = StructuralDesign.Rebar.Layout.SetLayoutAsNumberWithSpacing(rebar=byCurve_4, numberOfBarPositions=code_block_46, spacing=code_block_48)

code_block_49 = CodeBlock(a=diameter_stirrup, b=ø_mainbar_top_layer) { a+b; }
byName_3 = RebarBarType.ByName(name=code_block_49)

# group: Main bar top layer head column middle
byCurve_5 = Rebar.ByCurve(curve=translate_13, hostElementId=id, rebarStyle=rebar_style_2, rebarBarType=byName_3, startHookOrientation=rebar_hook_orientation_2, endHookOrientation=rebar_hook_orientation_2, startHookType=rebar_hook_type_2, endHookType=rebar_hook_type_2, vector=normal_2)
code_block_50 = CodeBlock(a=n_main_rebar_top_layer) { a; }
code_block_51 = CodeBlock(a=code_block_34) { a; }
code_block_52 = CodeBlock(a=code_block_51, n=code_block_50) { a/(n-1); }
setLayoutAsNumberWithSpacing_5 = StructuralDesign.Rebar.Layout.SetLayoutAsNumberWithSpacing(rebar=byCurve_5, numberOfBarPositions=code_block_50, spacing=code_block_52)

endPoint = Curve.EndPoint(curve=translate_13)
startPoint_3 = Curve.StartPoint(curve=translate_13)
byStartPointEndPoint_2 = Line.ByStartPointEndPoint(startPoint=endPoint, endPoint=startPoint_3)
code_block_53 = CodeBlock(a=diameter_stirrup, b=ø_mainbar_bot_layer) { a+b; }
byName_4 = RebarBarType.ByName(name=code_block_53)

# group: Main bar top layer head beam
byCurve_6 = Rebar.ByCurve(curve=byStartPointEndPoint_2, hostElementId=id, rebarStyle=rebar_style_2, rebarBarType=byName_4, startHookOrientation=rebar_hook_orientation_2, endHookOrientation=rebar_hook_orientation_2, startHookType=rebar_hook_type_2, endHookType=rebar_hook_type_2, vector=normal_2)
code_block_54 = CodeBlock(a=n_main_rebar_bot_layer) { a; }
code_block_55 = CodeBlock(a=code_block_34) { a; }
code_block_56 = CodeBlock(a=code_block_55, n=code_block_54) { a/(n-1); }
setLayoutAsNumberWithSpacing_6 = StructuralDesign.Rebar.Layout.SetLayoutAsNumberWithSpacing(rebar=byCurve_6, numberOfBarPositions=code_block_54, spacing=code_block_56)

translate_14 = Geometry.Translate(geometry=project_3, direction=reverse_2, distance=l_main_rebar_top_layer_head_beam)
byStartPointEndPoint_3 = Line.ByStartPointEndPoint(startPoint=project_3, endPoint=translate_14)
translate_15 = Geometry.Translate(geometry=byStartPointEndPoint_3, direction=reverse_3, distance=space_between_bar_layer)
translate_16 = Geometry.Translate(geometry=translate_15, direction=XAxis, distance=code_block_35)
code_block_57 = CodeBlock(a=diameter_stirrup, b=ø_mainbar_top_layer_head_beam) { a+b; }
byName_5 = RebarBarType.ByName(name=code_block_57)

# group: Main bar top layer head beam
byCurve_7 = Rebar.ByCurve(curve=translate_16, hostElementId=id, rebarStyle=rebar_style_2, rebarBarType=byName_5, startHookOrientation=rebar_hook_orientation_2, endHookOrientation=rebar_hook_orientation_2, startHookType=rebar_hook_type_2, endHookType=rebar_hook_type_2, vector=normal_2)
code_block_58 = CodeBlock(a=n_rebar_top_layer_head_beam) { a; }
code_block_59 = CodeBlock(a=code_block_34) { a; }
code_block_60 = CodeBlock(a=code_block_59, n=code_block_58) { a/(n-1); }
setLayoutAsNumberWithSpacing_7 = StructuralDesign.Rebar.Layout.SetLayoutAsNumberWithSpacing(rebar=byCurve_7, numberOfBarPositions=code_block_58, spacing=code_block_60)

translate_17 = Geometry.Translate(geometry=project, direction=YAxis, distance=l_main_rebar_top_layer_head_beam)
byStartPointEndPoint_4 = Line.ByStartPointEndPoint(startPoint=project, endPoint=translate_17)
translate_18 = Geometry.Translate(geometry=byStartPointEndPoint_4, direction=reverse_3, distance=space_between_bar_layer)
translate_19 = Geometry.Translate(geometry=translate_18, direction=XAxis, distance=code_block_35)

# group: Main bar top layer head beam
byCurve_8 = Rebar.ByCurve(curve=translate_19, hostElementId=id, rebarStyle=rebar_style_2, rebarBarType=byName_5, startHookOrientation=rebar_hook_orientation_2, endHookOrientation=rebar_hook_orientation_2, startHookType=rebar_hook_type_2, endHookType=rebar_hook_type_2, vector=normal_2)
code_block_61 = CodeBlock(a=n_rebar_top_layer_head_beam) { a; }
code_block_62 = CodeBlock(a=code_block_34) { a; }
code_block_63 = CodeBlock(a=code_block_62, n=code_block_61) { a/(n-1); }

code_block_64 = CodeBlock { "Shape"; }
code_block_65 = CodeBlock { "M_17A"; }
byName_6 = Custom[RebarShape.ByName](RebarShapeName=code_block_65)  # package BIM4Struc.Rebar; Get the Rebar Shape object from Revit, based on the given name.
setParameterByName = Element.SetParameterByName(element=byCurve_8, parameterName=code_block_64, value=byName_6)

# group (continued): Main bar top layer head beam
setLayoutAsNumberWithSpacing_8 = StructuralDesign.Rebar.Layout.SetLayoutAsNumberWithSpacing(rebar=setParameterByName, numberOfBarPositions=code_block_61, spacing=code_block_63)

count_3 = List.Count(list=code_block_5)
code_block_66 = CodeBlock(COUNT=count_3) { COUNT-1; }
removeItemAtIndex = List.RemoveItemAtIndex(list=code_block_5, indices=code_block_66)
code_block_67 = CodeBlock { 0; }
removeItemAtIndex_2 = List.RemoveItemAtIndex(list=removeItemAtIndex, indices=code_block_67)
chop_2 = List.Chop(list=removeItemAtIndex_2, lengths=code_block_6)
code_block_68 = CodeBlock { 0.5; }
pointAtParameter_7 = Surface.PointAtParameter(surface=chop_2, u=code_block_68, v=code_block_68)
byPoints_4 = PolyCurve.ByPoints(points=pointAtParameter_7)
pointAtParameter_8 = Curve.PointAtParameter(curve=byPoints_4, param=code_block_68)
ZAxis_3 = Vector.ZAxis()
translate_20 = Geometry.Translate(geometry=pointAtParameter_8, direction=ZAxis_3, distance=code_block_31)
translate_21 = Geometry.Translate(geometry=translate_20, direction=XAxis, distance=code_block_35)
join = List.Join(list0=l_main_rebar_top_layer_inside_at, list1=l_main_rebar_top_layer_outside)
translate_22 = Geometry.Translate(geometry=translate_21, direction=reverse_2, distance=join)
reverse_4 = List.Reverse(list=join)
translate_23 = Geometry.Translate(geometry=translate_21, direction=YAxis, distance=reverse_4)
byStartPointEndPoint_5 = Line.ByStartPointEndPoint(startPoint=translate_22, endPoint=translate_23)
code_block_69 = CodeBlock(a=diameter_stirrup, b=ø_mainbar_top_layer_top_column) { a+b; }
byName_7 = RebarBarType.ByName(name=code_block_69)

# group: Main bar top layer head column middle
byCurve_9 = Rebar.ByCurve(curve=byStartPointEndPoint_5, hostElementId=id, rebarStyle=rebar_style_2, rebarBarType=byName_7, startHookOrientation=rebar_hook_orientation_2, endHookOrientation=rebar_hook_orientation_2, startHookType=rebar_hook_type_2, endHookType=rebar_hook_type_2, vector=normal_2)
code_block_70 = CodeBlock(a=n_main_rebar_add_middle_all) { a; }
code_block_71 = CodeBlock(a=code_block_34) { a; }
code_block_72 = CodeBlock(a=code_block_71, n=code_block_70) { a/(n-1); }
setLayoutAsNumberWithSpacing_9 = StructuralDesign.Rebar.Layout.SetLayoutAsNumberWithSpacing(rebar=byCurve_9, numberOfBarPositions=code_block_70, spacing=code_block_72)

# group: Show rebar
list_create = List.Create(item0=setLayoutAsNumberWithSpacing, item1=setLayoutAsNumberWithSpacing_2, item2=setLayoutAsNumberWithSpacing_3, item3=setLayoutAsNumberWithSpacing_4, item4=setLayoutAsNumberWithSpacing_5, item5=setLayoutAsNumberWithSpacing_6, item6=setLayoutAsNumberWithSpacing_7, item7=setLayoutAsNumberWithSpacing_8, item8=setLayoutAsNumberWithSpacing_9)
current = Document.Current()
activeView = Document.ActiveView(document=current)
setUnobscuredInView = StructuralDesign.Rebar.Create.SetUnobscuredInView(rebar=list_create, view=activeView)
setSolidInView = StructuralDesign.Rebar.Create.SetSolidInView(rebar=list_create, view=activeView)

code_block_73 = CodeBlock(a=filterByBoolMask_4.in) { a; }
rebarShape = RevitRebarShape("M_00")
