# Dynamo graph VDA_SplitBeam.dyn (Dynamo 2.18.1.5096)
# packages: Orchid 2.18.1.6006

solids = Element.Solids()  # unwired: element
explode = Geometry.Explode(geometry=solids)
code_block = CodeBlock { 0.5; }
pointAtParameter = Surface.PointAtParameter(surface=explode, u=code_block, v=code_block)
Z = Point.Z(point=pointAtParameter)
sortByKey = List.SortByKey(list=pointAtParameter@L2, keys=Z@L2)
code_block_2 = CodeBlock(a=sortByKey.sortedList) { a; }
flatten = List.Flatten(list=code_block_2)
count = List.Count(list=flatten)
code_block_3 = CodeBlock(c=count) { c-1; }
code_block_4 = CodeBlock(a=flatten, n=code_block_3) { a[0]; a[n]; }
byStartPointEndPoint = Line.ByStartPointEndPoint(startPoint=code_block_4.out0, endPoint=code_block_4.out1)
endPoint = Curve.EndPoint(curve=byStartPointEndPoint)
startPoint = Curve.StartPoint(curve=byStartPointEndPoint)
select_model_elements = DSModelElementsSelection()  # 6 picked in the model; frozen
elevation = Level.Elevation(level=select_model_elements)
floor = Math.Floor(number=elevation)
ceiling = Math.Ceiling(number=floor)
pointAtSegmentLength = Curve.PointAtSegmentLength(curve=byStartPointEndPoint, segmentLength=ceiling)
addItemToFront = List.AddItemToFront(item=startPoint, list=pointAtSegmentLength)  # frozen
addItemToEnd = List.AddItemToEnd(item=endPoint, list=addItemToFront)
count_2 = List.Count(list=addItemToEnd)
code_block_5 = CodeBlock(c=count_2) { 0..c-2; }
code_block_6 = CodeBlock { 1; }
chop = List.Chop(list=code_block_5, lengths=code_block_6)
code_block_7 = CodeBlock(c=count_2) { 1..c-1; }
chop_2 = List.Chop(list=code_block_7, lengths=code_block_6)
list_create = List.Create(item0=chop, item1=chop_2)
transpose = List.Transpose(lists=list_create)
getItemAtIndex = List.GetItemAtIndex(list=addItemToEnd, index=transpose)
code_block_8 = CodeBlock { 0; 1; }
getItemAtIndex_2 = List.GetItemAtIndex(list=getItemAtIndex@L3, index=code_block_8.out0)
flatten_2 = List.Flatten(list=getItemAtIndex_2)
getItemAtIndex_3 = List.GetItemAtIndex(list=getItemAtIndex@L3, index=code_block_8.out1)
flatten_3 = List.Flatten(list=getItemAtIndex_3)
byStartPointEndPoint_2 = Line.ByStartPointEndPoint(startPoint=flatten_2, endPoint=flatten_3)
code_block_9 = CodeBlock { "FFL 00"; }
byName = Orchid.RevitProject.Datums.Level.ByName(name=code_block_9)
addItemToFront_2 = List.AddItemToFront(item=byName, list=select_model_elements)
code_block_10 = CodeBlock { "300 X 800"; }
byName_2 = FamilyType.ByName(name=code_block_10)
columnByCurve = StructuralFraming.ColumnByCurve(curve=byStartPointEndPoint_2, level=addItemToFront_2, structuralColumnType=byName_2)
select_model_element = DSModelElementSelection()  # 1 picked in the model
getLocation = Element.GetLocation(element=select_model_element)
