# Dynamo graph VD_CreateFileShareParasFromExcel.dyn (Dynamo 2.6.1.8786)

file_path = Filename("..\..\..\..\..\..\60_SPCC\02_Template\04_Share-Parameters\01_PAR\SPCC_SharedParams2021.xlsx")  # graph input
file_from_path = FileObject(path=file_path)
code_block = CodeBlock { "10-SPA"; true; false; }
importExcel = Data.ImportExcel(file=file_from_path, sheetName=code_block.out0, readAsStrings=code_block.out1, showExcel=code_block.out2)
code_block_2 = CodeBlock { 1; }
dropItems = List.DropItems(list=importExcel, amount=code_block_2)
transpose = List.Transpose(lists=dropItems)
code_block_3 = CodeBlock(lst=transpose) { Pnames = lst[0]; Groups = lst[1]; Ptypes = lst[2]; }
code_block_4 = CodeBlock { "PG_TEXT"; false; }
categories = Categories("OST_GenericModel")  # graph input
createSharedParameter = Parameter.CreateSharedParameter(parameterName=code_block_3.Pnames, groupName=code_block_3.Groups, type=code_block_3.Ptypes, group=code_block_4.out0, instance=code_block_4.out1, categoryList=categories)
code_block_5 = CodeBlock(a=code_block_3.Pnames) { a; }
