# Dynamo graph VD_FormworkArea.dyn "SPCC_FormworkArea" (Dynamo 2.6.1.8786)

select_model_elements = DSModelElementsSelection()  # 1 picked in the model; graph input

# group: Column
getCategory = Element.GetCategory(element=select_model_elements)
name = Category.Name(category=getCategory)
code_block = CodeBlock { "Structural Columns"; }
eq = name == code_block
filterByBoolMask = List.FilterByBoolMask(list=select_model_elements, mask=eq)

# group: Fill Beam
getCategory_2 = Element.GetCategory(element=select_model_elements)
name_2 = Category.Name(category=getCategory_2)
code_block_2 = CodeBlock { "Structural Framing"; }
eq_2 = name_2 == code_block_2
filterByBoolMask_2 = List.FilterByBoolMask(list=select_model_elements, mask=eq_2)

# group: Floor
getCategory_3 = Element.GetCategory(element=select_model_elements)
name_3 = Category.Name(category=getCategory_3)
code_block_3 = CodeBlock { "Floors"; }
eq_3 = name_3 == code_block_3
filterByBoolMask_3 = List.FilterByBoolMask(list=select_model_elements, mask=eq_3)

# group: Floor
getCategory_4 = Element.GetCategory(element=select_model_elements)
name_4 = Category.Name(category=getCategory_4)
code_block_4 = CodeBlock { "Floors"; }
eq_4 = name_4 == code_block_4
filterByBoolMask_4 = List.FilterByBoolMask(list=select_model_elements, mask=eq_4)

# group: Connection
getCategory_5 = Element.GetCategory(element=select_model_elements)
name_5 = Category.Name(category=getCategory_5)
code_block_5 = CodeBlock { "Structural Connections"; }
eq_5 = name_5 == code_block_5
filterByBoolMask_5 = List.FilterByBoolMask(list=select_model_elements, mask=eq_5)

# group: Foundation
getCategory_6 = Element.GetCategory(element=select_model_elements)
name_6 = Category.Name(category=getCategory_6)
code_block_6 = CodeBlock { "Structural Foundations"; }
eq_6 = name_6 == code_block_6
filterByBoolMask_6 = List.FilterByBoolMask(list=select_model_elements, mask=eq_6)

list_create = List.Create(item0=filterByBoolMask.in, item1=filterByBoolMask_2.in, item2=filterByBoolMask_3.in, item3=filterByBoolMask_4.in, item4=filterByBoolMask_5.in, item5=filterByBoolMask_6.in)

# group: Filter Surfaces
geometry = Element.Geometry(element=list_create)
flatten = List.Flatten(list=geometry)
byUnion = Solid.ByUnion(solids=flatten)
bySolid = PolySurface.BySolid(solid=byUnion)
explode = Geometry.Explode(geometry=bySolid)
geometry_2 = Element.Geometry(element=list_create)
byUnion_2 = Solid.ByUnion(solids=geometry_2)
bySolid_2 = PolySurface.BySolid(solid=byUnion_2)
explode_2 = Geometry.Explode(geometry=bySolid_2)
intersect = Geometry.Intersect(geometry=explode_2, other=explode, lacing=CrossProduct)
number = DoubleInput(2)
normalizeDepth = List.NormalizeDepth(list=intersect, rank=number)
string_from_object = FromObject(obj=normalizeDepth)
string = StringInput("Surface")
startsWith = String.StartsWith(str=string_from_object, searchFor=string)

# group: Calculate Area Formwork
python_script = Python(IN[0]=explode)
# ---------- python_script.python (11 lines) ----------
import clr
clr.AddReference('ProtoGeometry')
from Autodesk.DesignScript.Geometry import *

List1 = []
if (IN[0] == 'Structural Columns') | (IN[0] == 'Walls'):
	List1.append('true')
else:
	List1.append('false')
	
OUT = List1
# ----------------------------------------
firstItem = List.FirstItem(list=python_script)
filterByBoolMask_7 = List.FilterByBoolMask(list=normalizeDepth, mask=startsWith)
normalAtParameter = Surface.NormalAtParameter(surface=filterByBoolMask_7.in)
Z = Vector.Z(vector=normalAtParameter)
number_2 = DoubleInput(1)
eq_7 = Z == number_2
filterByBoolMask_8 = List.FilterByBoolMask(list=filterByBoolMask_7.in, mask=eq_7)
filterByBoolMask_9 = List.FilterByBoolMask(list=Z, mask=eq_7)
number_3 = DoubleInput(-1)
eq_8 = filterByBoolMask_9.out == number_3
filterByBoolMask_10 = List.FilterByBoolMask(list=filterByBoolMask_8.out, mask=eq_8)
python_script_2 = Python(IN[0]=firstItem, IN[1]=filterByBoolMask_8.out, IN[2]=filterByBoolMask_10.out)
# ---------- python_script_2.python (12 lines) ----------
import clr
clr.AddReference('ProtoGeometry')
from Autodesk.DesignScript.Geometry import *
#The inputs to this node will be stored as a list in the IN variables.
dataEnteringNode = IN
List4 = []
if IN[0] == 'false':
	List4.append(IN[1])
else:
	List4.append(IN[2])
	
OUT = List4
# ----------------------------------------

flatten_2 = List.Flatten(list=python_script_2)
thickness_unit_mm = DoubleInput(15)  # graph input
boolean = BoolSelector(false)
thicken = Surface.Thicken(surface=flatten_2, thickness=thickness_unit_mm, both_sides=boolean)
flatten_3 = List.Flatten(list=thicken)
centroid = Solid.Centroid(solid=flatten_3)
flatten_4 = List.Flatten(list=centroid)
groupByKey = List.GroupByKey(list=flatten_3, keys=flatten_4)
firstItem_2 = List.FirstItem(list=groupByKey.groups@L2)
categories_type_formwork = Categories("OST_GenericModel")  # graph input
material_name = StringInput("Default")  # graph input
byName = Material.ByName(name=material_name)
formwork_name = StringInput("VD_DAT_FormworkArea")
byGeometry = DirectShape.ByGeometry(geometry=firstItem_2, category=categories_type_formwork, material=byName, name=formwork_name)
set_formwork_area_type_area = StringInput("VD_DAT_FormworkArea")  # graph input
solids = Element.Solids(element=byGeometry)
volume = Solid.Volume(solid=solids)
code_block_7 = CodeBlock(VolumeFormwork=volume, Thickness=thickness_unit_mm) { VolumeFormwork/Thickness; }
convert_between_units = DynamoConvert(code_block_7, MeasurementType="Area", FromConversion="SquareMillimeter", ToConversion="SquareMeter")
flatten_5 = List.Flatten(list=convert_between_units)
setParameterByName = Element.SetParameterByName(element=byGeometry, parameterName=set_formwork_area_type_area, value=flatten_5)
