# Dynamo graph VD_GridIntersectWithElements.dyn (Dynamo 2.19.3.6394)
# packages: Crumple 2022.2.13, Rhythm 2021.4.2

all_elements_in_active_view = ElementsInView()
code_block = CodeBlock { "VD_DAT_GridIntersect"; }
code_block_2 = CodeBlock { "Grids"; }
byName = Category.ByName(name=code_block_2)
all_elements_of_category = ElementsOfCategory(Category=byName)
name = Element.Name(element=all_elements_of_category)
code_block_3 = CodeBlock(a=name) { a+"-"; }
curve = Grid.Curve(grid=all_elements_of_category)
direction = Line.Direction(line=curve)
select_model_element = DSModelElementSelection()  # 1 picked in the model; graph input
curve_2 = Grid.Curve(grid=select_model_element)
direction_2 = Line.Direction(line=curve_2)
isParallel = Vector.IsParallel(vector=direction, otherVector=direction_2)
filterByBoolMask = List.FilterByBoolMask(list=code_block_3, mask=isParallel)
add = filterByBoolMask.in + filterByBoolMask.out  # lacing=CrossProduct
flatten = List.Flatten(list=add)
length = String.Length(string=flatten)
code_block_4 = CodeBlock(a=length) { a-1; }
code_block_5 = CodeBlock { 1; }
remove = String.Remove(string=flatten, startIndex=code_block_4, count=code_block_5)
elementcentroid = Custom[© ElementCentroid](element=all_elements_in_active_view)  # package Crumple; Returns the centroid of the element's axis-aligned bounding box.
code_block_6 = CodeBlock(P=elementcentroid) { P.X; P.Y; }
byCoordinates = Point.ByCoordinates(x=code_block_6.out0, y=code_block_6.out1)
filterByBoolMask_2 = List.FilterByBoolMask(list=curve, mask=isParallel)
intersect = Geometry.Intersect(geometry=filterByBoolMask_2.in, other=filterByBoolMask_2.out, lacing=CrossProduct)
flatten_2 = List.Flatten(list=intersect)
code_block_7 = CodeBlock(P=flatten_2) { P.X; P.Y; }
byCoordinates_2 = Point.ByCoordinates(x=code_block_7.out0, y=code_block_7.out1)
distanceTo = Geometry.DistanceTo(geometry=byCoordinates@L1, other=byCoordinates_2@L2, lacing=Longest)
sortIndexByValue = List.SortIndexByValue(list=distanceTo@L2)
firstItem = List.FirstItem(list=sortIndexByValue@L2)
getItemAtIndex = List.GetItemAtIndex(list=remove, index=firstItem)
ʳʰʸᵗʰᵐ_elements = Rhythm.Revit.Elements.Elements.SetParameterValueByNameCaSeiNSeNSiTiVe(element=all_elements_in_active_view, parameterName=code_block, value=getItemAtIndex)
