# Dynamo graph VD_MarkPiles.dyn (Dynamo 2.6.1.8786)

code_block = CodeBlock { "D300"; }
select_model_elements = DSModelElementsSelection()  # 18 picked in the model; graph input
string_from_object = FromObject(obj=select_model_elements)
name_pile = StringInput("D1000")  # graph input
eq = string_from_object == name_pile
filterByBoolMask = List.FilterByBoolMask(list=select_model_elements, mask=eq)
geometry = Element.Geometry(element=filterByBoolMask.out)
flatten = List.Flatten(list=geometry)
geometry_2 = Element.Geometry(element=filterByBoolMask.in)
code_block_2 = CodeBlock { 2; }
getItemAtIndex = List.GetItemAtIndex(list=geometry_2@L2, index=code_block_2)
doesIntersect = Geometry.DoesIntersect(geometry=flatten, other=getItemAtIndex, lacing=CrossProduct)
filterByBoolMask_2 = List.FilterByBoolMask(list=filterByBoolMask.in, mask=doesIntersect@L2)
code_block_3 = CodeBlock(a=filterByBoolMask_2.in) { a; }
para_name = StringInput("VD_ELEMENT_NAME")  # graph input
getParameterValueByName = Element.GetParameterValueByName(element=filterByBoolMask.out, parameterName=para_name)
groupByKey = List.GroupByKey(list=code_block_3, keys=getParameterValueByName)
count = List.Count(list=groupByKey.groups@L2)
code_block_4 = CodeBlock(t=count) { 1..t; }
code_block_5 = CodeBlock(a=code_block_4) { "C-"+a+"_"; }
add = code_block_5 + getParameterValueByName
setParameterByName = Element.SetParameterByName(element=code_block_3, parameterName=para_name, value=add)
