# Dynamo graph VD_RebarColumTop.dyn (Dynamo 2.18.1.5096)
# packages: BIM4Struc.Rebar 1.3.0, Dynamo for Rebar 2.0.2, DynaTools 2018.1.15, Structural Design 2021.1.22, RIE 2021.7.1

select_top_column = DSModelElementSelection()  # 1 picked in the model; graph input
faces = Element.Faces(element=select_top_column)

# group: Lọc lấy mặt phẳng cột dưới
code_block = CodeBlock { 0.5; }
normalAtParameter = Surface.NormalAtParameter(surface=faces, u=code_block, v=code_block)
Z = Vector.Z(vector=normalAtParameter)
maximumItem = List.MaximumItem(list=Z)
indexOf = List.IndexOf(list=Z, element=maximumItem)
minimumItem = List.MinimumItem(list=Z)
indexOf_2 = List.IndexOf(list=Z, element=minimumItem)
create = List.Create(item0=indexOf, item1=indexOf_2)
other = List.RemoveItemAtIndex(list=faces, indices=create)
code_block_2 = CodeBlock { 0.5; }
normalAtParameter_2 = Surface.NormalAtParameter(surface=other, u=code_block_2, v=code_block_2)
XAxis = Vector.XAxis()
ZAxis = Vector.ZAxis()
angleAboutAxis = Vector.AngleAboutAxis(vector=normalAtParameter_2, otherVector=XAxis, rotationAxis=ZAxis)
sortByKey = List.SortByKey(list=other, keys=angleAboutAxis)
other_2 = CodeBlock(ListA=sortByKey.sortedList) { ListA; }
top = List.GetItemAtIndex(list=faces, index=indexOf)
bottom = List.GetItemAtIndex(list=faces, index=indexOf_2)

# group: Tạo lớp bảo vệ
getRebarCover = RebarTools.Query.getRebarCover(elements=select_top_column)

stirrup = RevitRebarBarType("Ø6")  # graph input
getRebarDiameter = RebarTools.Query.getRebarDiameter(rebarBarType=stirrup)
mainRebarBar = RevitRebarBarType("Ø22")  # graph input
getRebarDiameter_2 = RebarTools.Query.getRebarDiameter(rebarBarType=mainRebarBar)

# group: Offset đến tâm thép chủ
code_block_3 = CodeBlock(Cover=getRebarCover.others, Stird=getRebarDiameter, Bardiameter=getRebarDiameter_2) { -(Cover+Stird+Bardiameter/2); }

# group: Tạo đường giao
create_2 = List.Create(item0=other_2, item1=other_2)
byJoinedSurfaces = PolySurface.ByJoinedSurfaces(surfaces=create_2)
offset = Surface.Offset(surface=byJoinedSurfaces, distance=code_block_3, lacing=Longest)
create_3 = List.Create(item0=top, item1=bottom)
number = DoubleInput(1)
pointAtParameter = Surface.PointAtParameter(surface=create_3, u=number, v=number)
normalAtParameter_3 = Surface.NormalAtParameter(surface=create_3, u=number, v=number)
byOriginNormal = Plane.ByOriginNormal(origin=pointAtParameter, normal=normalAtParameter_3)
intersect = Geometry.Intersect(geometry=offset, other=byOriginNormal, lacing=CrossProduct)

flatten = List.Flatten(list=intersect)
RIE_RemoveNulls = Custom[RIE_RemoveNulls](list=flatten)  # package RIE; Removes Nulls from list, and outputs a clean list as well as a list of indices that contained nulls in input list

# group: Tạo chiều cho thép
code_block_4 = CodeBlock { 50; }
offset_2 = Surface.Offset(surface=top, distance=code_block_4)
code_block_5 = CodeBlock(x=offset_2) { x; }
number_2 = DoubleInput(1)
pointAtParameter_2 = Surface.PointAtParameter(surface=code_block_5, u=number_2, v=number_2)
normalAtParameter_4 = Surface.NormalAtParameter(surface=code_block_5, u=number_2, v=number_2)
byOriginNormal_2 = Plane.ByOriginNormal(origin=pointAtParameter_2, normal=normalAtParameter_4)
normal = Plane.Normal(plane=byOriginNormal_2)

# group: Tạo điểm
direction = Line.Direction(line=RIE_RemoveNulls.CleanList)
XAxis_2 = Vector.XAxis()
angleAboutAxis_2 = Vector.AngleAboutAxis(vector=direction, otherVector=XAxis_2, rotationAxis=normal)
sortByKey_2 = List.SortByKey(list=RIE_RemoveNulls.CleanList, keys=angleAboutAxis_2, lacing=Longest)
code_block_6 = CodeBlock { 2; }
code_block_7 = CodeBlock { 0; }
takeEveryNthItem = List.TakeEveryNthItem(list=sortByKey_2.sortedList, n=code_block_6, offset=code_block_7, lacing=Longest)
code_block_8 = CodeBlock { 2; }
code_block_9 = CodeBlock { 1; }
takeEveryNthItem_2 = List.TakeEveryNthItem(list=sortByKey_2.sortedList, n=code_block_8, offset=code_block_9, lacing=Longest)
startPoint = Curve.StartPoint(curve=sortByKey_2.sortedList)

numberrebar_x = StringInput("6")  # graph input
toNumber = String.ToNumber(string=numberrebar_x)
numberrebar_y = StringInput("5")  # graph input
toNumber_2 = String.ToNumber(string=numberrebar_y)

# group: Tạo điểm trên thanh dài và ngắn
code_block_10 = CodeBlock(NumberRebar=toNumber) { NumberRebar-1; }
pointsAtEqualSegmentLength = Curve.PointsAtEqualSegmentLength(curve=takeEveryNthItem, divisions=code_block_10)
code_block_11 = CodeBlock(NumberRebar=toNumber_2) { NumberRebar-1; }
pointsAtEqualSegmentLength_2 = Curve.PointsAtEqualSegmentLength(curve=takeEveryNthItem_2, divisions=code_block_11)

addItemToEnd = List.AddItemToEnd(item=pointsAtEqualSegmentLength_2, list=startPoint, lacing=Longest)
addItemToEnd_2 = List.AddItemToEnd(item=pointsAtEqualSegmentLength, list=addItemToEnd, lacing=Longest)
code_block_12 = CodeBlock { 2; }
flatten_2 = List.Flatten(list=addItemToEnd_2, amount=code_block_12, lacing=Longest)
code_block_13 = CodeBlock(SecondPoint=flatten_2) { SecondPoint[1]; }
getRebarCover_2 = RebarTools.Query.getRebarCover(elements=select_top_column)
code_block_14 = CodeBlock(a=getRebarCover_2.bottomInterior) { -a; }

# group: Offset bằng mặt dầm
number_3 = DoubleInput(1)
pointAtParameter_3 = Surface.PointAtParameter(surface=top, u=number_3, v=number_3)
normalAtParameter_5 = Surface.NormalAtParameter(surface=top, u=number_3, v=number_3)
byOriginNormal_3 = Plane.ByOriginNormal(origin=pointAtParameter_3, normal=normalAtParameter_5)
offset_3 = Plane.Offset(plane=byOriginNormal_3, dist=code_block_14)

project = Point.Project(point=code_block_13, baseGeometry=offset_3, projectionDirection=normal)
flatten_3 = List.Flatten(list=project)
code_block_15 = CodeBlock(points=flatten_3) { points; }

# group: Tạo điểm tâm lọc
X = Point.X(point=code_block_15)
average = Math.Average(numbers=X)
Y = Point.Y(point=code_block_15)
average_2 = Math.Average(numbers=Y)
Z_2 = Point.Z(point=code_block_15)
average_3 = Math.Average(numbers=Z_2)
byCoordinates = Point.ByCoordinates(x=average, y=average_2, z=average_3)
byTwoPoints = Vector.ByTwoPoints(start=byCoordinates, end=code_block_15)
XAxis_3 = Vector.XAxis()
byBestFitThroughPoints = Plane.ByBestFitThroughPoints(points=code_block_15)
normal_2 = Plane.Normal(plane=byBestFitThroughPoints)
Z_3 = Vector.Z(vector=normal_2)
code_block_16 = CodeBlock { 0; }
gt = Z_3 > code_block_16
reverse = Vector.Reverse(vector=normal_2)
if_ = If(test=gt, true=normal_2, false=reverse)
angleAboutAxis_3 = Vector.AngleAboutAxis(vector=byTwoPoints, otherVector=XAxis_3, rotationAxis=if_)
sortByKey_3 = List.SortByKey(list=code_block_15, keys=angleAboutAxis_3)

code_block_17 = CodeBlock { 2; }
code_block_18 = CodeBlock { 0; }
takeEveryNthItem_3 = List.TakeEveryNthItem(list=sortByKey_3.sortedList, n=code_block_17, offset=code_block_18)
flatten_4 = List.Flatten(list=takeEveryNthItem_3)
byStartPointEndPoint = Line.ByStartPointEndPoint(startPoint=flatten_4, endPoint=byCoordinates)
replaceLength = StringInput("30")  # graph input
toNumber_3 = String.ToNumber(string=replaceLength)
code_block_19 = CodeBlock(NumberRebar=toNumber_3, Bardiameter=getRebarDiameter_2) { NumberRebar*Bardiameter; }

# group: Offset mặt đáy cột
code_block_20 = CodeBlock(facee=bottom) { facee; }
number_4 = DoubleInput(1)
pointAtParameter_4 = Surface.PointAtParameter(surface=code_block_20, u=number_4, v=number_4)
normalAtParameter_6 = Surface.NormalAtParameter(surface=code_block_20, u=number_4, v=number_4)
byOriginNormal_4 = Plane.ByOriginNormal(origin=pointAtParameter_4, normal=normalAtParameter_6)
code_block_21 = CodeBlock(Reversenumber=code_block_19) { -Reversenumber; }
offset_4 = Plane.Offset(plane=byOriginNormal_4, dist=code_block_21)

reverse_2 = Vector.Reverse(vector=normal)
chẵn_nấc_1 = Point.Project(point=takeEveryNthItem_3, baseGeometry=offset_4, projectionDirection=reverse_2, lacing=Longest)
flatten_5 = List.Flatten(list=chẵn_nấc_1)
byStartPointEndPoint_2 = Line.ByStartPointEndPoint(startPoint=flatten_5, endPoint=flatten_4)
create_4 = List.Create(item0=byStartPointEndPoint, item1=byStartPointEndPoint_2)
transpose = List.Transpose(lists=create_4)
byJoinedCurves = PolyCurve.ByJoinedCurves(curves=transpose)
code_block_22 = CodeBlock { 2; }
code_block_23 = CodeBlock { 1; }
takeEveryNthItem_4 = List.TakeEveryNthItem(list=sortByKey_3.sortedList, n=code_block_22, offset=code_block_23)
flatten_6 = List.Flatten(list=takeEveryNthItem_4)
byStartPointEndPoint_3 = Line.ByStartPointEndPoint(startPoint=flatten_6, endPoint=byCoordinates)
lẻ_nấc_1 = Point.Project(point=takeEveryNthItem_4, baseGeometry=byOriginNormal_4, projectionDirection=reverse_2)
flatten_7 = List.Flatten(list=lẻ_nấc_1)
byStartPointEndPoint_4 = Line.ByStartPointEndPoint(startPoint=flatten_6, endPoint=flatten_7)
create_5 = List.Create(item0=byStartPointEndPoint_3, item1=byStartPointEndPoint_4)
transpose_2 = List.Transpose(lists=create_5)
byJoinedCurves_2 = PolyCurve.ByJoinedCurves(curves=transpose_2)
create_6 = List.Create(item0=byJoinedCurves, item1=byJoinedCurves_2)
flatten_8 = List.Flatten(list=create_6)
id = Element.Id(element=select_top_column)
rebar_style = RebarStyle("Standard", EnumerationType="Autodesk.Revit.DB.Structure.RebarStyle, RevitAPI, Version=24.0.0.0, Culture=neutral, PublicKeyToken=null")
rebar_hook_orientation = RebarHookOrientation("Left", EnumerationType="Autodesk.Revit.DB.Structure.RebarHookOrientation, RevitAPI, Version=24.0.0.0, Culture=neutral, PublicKeyToken=null")
rebar_hook_type = RevitRebarHookType("None", ElementType="Autodesk.Revit.DB.Structure.RebarHookType, RevitAPI, Version=24.0.0.0, Culture=neutral, PublicKeyToken=null")
byJoinedCurves_3 = PolyCurve.ByJoinedCurves(curves=flatten_8, lacing=Longest)
basePlane = PolyCurve.BasePlane(polyCurve=byJoinedCurves_3)
normal_3 = Plane.Normal(plane=basePlane)
byCurve = Rebar.ByCurve(curve=flatten_8, hostElementId=id, rebarStyle=rebar_style, rebarBarType=mainRebarBar, startHookOrientation=rebar_hook_orientation, endHookOrientation=rebar_hook_orientation, startHookType=rebar_hook_type, endHookType=rebar_hook_type, vector=normal_3)
current = Document.Current()
activeView = Document.ActiveView(document=current)
setSolidInView = Custom[Rebar.SetSolidInView](rebarElements=byCurve, views=activeView)  # package BIM4Struc.Rebar; Sets this rebar element to be shown solidly in a 3D view.
setUnobscuredInView = Custom[Rebar.SetUnobscuredInView](rebarElements=byCurve, views=activeView)  # package BIM4Struc.Rebar; Sets this rebar element to be shown unobscured in a view.
faces_2 = Element.Faces(element=select_top_column)

# group: New
code_block_24 = CodeBlock(surface=faces_2) { surface; }
code_block_25 = CodeBlock { 0.5; }
normalAtParameter_7 = Surface.NormalAtParameter(surface=code_block_24, u=code_block_25, v=code_block_25)
Z_4 = Vector.Z(vector=normalAtParameter_7)
maximumItem_2 = List.MaximumItem(list=Z_4)
indexOf_3 = List.IndexOf(list=Z_4, element=maximumItem_2)
minimumItem_2 = List.MinimumItem(list=Z_4)
indexOf_4 = List.IndexOf(list=Z_4, element=minimumItem_2)
list_create = List.Create(item0=indexOf_3, item1=indexOf_4)
removeItemAtIndex = List.RemoveItemAtIndex(list=code_block_24, indices=list_create)
code_block_26 = CodeBlock { 0.5; }
normalAtParameter_8 = Surface.NormalAtParameter(surface=removeItemAtIndex, u=code_block_26, v=code_block_26)
XAxis_4 = Vector.XAxis()
ZAxis_2 = Vector.ZAxis()
angleAboutAxis_4 = Vector.AngleAboutAxis(vector=normalAtParameter_8, otherVector=XAxis_4, rotationAxis=ZAxis_2)
other_3 = List.SortByKey(list=removeItemAtIndex, keys=angleAboutAxis_4)
bottom_2 = List.GetItemAtIndex(list=code_block_24, index=indexOf_4)
top_2 = List.GetItemAtIndex(list=code_block_24, index=indexOf_3)

# group: Lấy mặt phẳng bên
byJoinedSurfaces_2 = PolySurface.ByJoinedSurfaces(surfaces=other_3.sortedList)

getRebarCover_3 = RebarTools.Query.getRebarCover(elements=select_top_column)

# group: Lấy đường kính thép đai
getRebarDiameter_3 = RebarTools.Query.getRebarDiameter(rebarBarType=stirrup)

# group: tạo bề dày lớp bảo vệ tính đến tim thép
code_block_27 = CodeBlock(COVER=getRebarCover_3.others, stir=getRebarDiameter_3) { -(COVER+stir/2); }

# group: Offset vào một khoảng bằng lớp bảo vệ đến tim thép
offset_5 = Surface.Offset(surface=byJoinedSurfaces_2, distance=code_block_27)

code_block_28 = CodeBlock { -25; }

# group: Offset từ mặt dưới cột lên
offset_6 = Surface.Offset(surface=bottom_2, distance=code_block_28)

# group: Tạo đường thẳng từ đường giao các mặt phẳng
intersect_2 = Geometry.Intersect(geometry=offset_5, other=offset_6)

# group: Tạo thành 1 đường từ nhiều đường
byJoinedCurves_4 = PolyCurve.ByJoinedCurves(curves=intersect_2)

# group: Tạo vector vuông góc với các đường thẳng
normal_4 = Curve.Normal(curve=byJoinedCurves_4)

# group: Đổi hướng
reverse_3 = Vector.Reverse(vector=normal_4)

# group: Tạo cây thép
id_2 = Element.Id(element=select_top_column)
rebar_style_2 = RebarStyle("StirrupTie", EnumerationType="Autodesk.Revit.DB.Structure.RebarStyle, RevitAPI, Version=24.0.0.0, Culture=neutral, PublicKeyToken=null")
rebar_hook_orientation_2 = RebarHookOrientation("Right", EnumerationType="Autodesk.Revit.DB.Structure.RebarHookOrientation, RevitAPI, Version=24.0.0.0, Culture=neutral, PublicKeyToken=null")
rebar_hook_type_2 = RevitRebarHookType("Stirrup - 135 deg", ElementType="Autodesk.Revit.DB.Structure.RebarHookType, RevitAPI, Version=24.0.0.0, Culture=neutral, PublicKeyToken=null")
byCurve_2 = Rebar.ByCurve(curve=byJoinedCurves_4, hostElementId=id_2, rebarStyle=rebar_style_2, rebarBarType=stirrup, startHookOrientation=rebar_hook_orientation_2, endHookOrientation=rebar_hook_orientation_2, startHookType=rebar_hook_type_2, endHookType=rebar_hook_type_2, vector=reverse_3)

# group: Hiển thị 3D
current_2 = Document.Current()
activeView_2 = Document.ActiveView(document=current_2)
setSolidInView_2 = Custom[Rebar.SetSolidInView](rebarElements=byCurve_2, views=activeView_2)
setUnobscuredInView_2 = Custom[Rebar.SetUnobscuredInView](rebarElements=byCurve_2, views=activeView_2)

boolean = BoolSelector(false)

# group: Lọc lấy chiều dài
code_block_29 = CodeBlock { "Length"; }
getParameterValueByName = Element.GetParameterValueByName(element=select_top_column, parameterName=code_block_29)

beamHeight = StringInput("400")  # graph input
toNumber_4 = String.ToNumber(string=beamHeight)
code_block_30 = CodeBlock(Hightcolum=getParameterValueByName, Hightbeam=toNumber_4) { Hightcolum-Hightbeam; }

# group: Offset mặt phẳng từ chân cột lên 5L/6
code_block_31 = CodeBlock(a=code_block_30) { -5*a/6; }
offset_7 = Surface.Offset(surface=bottom_2, distance=code_block_31)

# group: Tạo đường thẳng từ đường giao các mặt phẳng
intersect_3 = Geometry.Intersect(geometry=offset_5, other=offset_7)

# group: Tạo thành 1 đường từ nhiều đường
byJoinedCurves_5 = PolyCurve.ByJoinedCurves(curves=intersect_3)

# group: Tạo vector vuông góc với các đường thẳng
normal_5 = Curve.Normal(curve=byJoinedCurves_5)

# group: Đổi hướng
reverse_4 = Vector.Reverse(vector=normal_5)

# group: Tạo cây thép
id_3 = Element.Id(element=select_top_column)
rebar_style_3 = RebarStyle("StirrupTie", EnumerationType="Autodesk.Revit.DB.Structure.RebarStyle, RevitAPI, Version=24.0.0.0, Culture=neutral, PublicKeyToken=null")
rebar_hook_orientation_3 = RebarHookOrientation("Right", EnumerationType="Autodesk.Revit.DB.Structure.RebarHookOrientation, RevitAPI, Version=24.0.0.0, Culture=neutral, PublicKeyToken=null")
rebar_hook_type_3 = RevitRebarHookType("Stirrup - 135 deg", ElementType="Autodesk.Revit.DB.Structure.RebarHookType, RevitAPI, Version=24.0.0.0, Culture=neutral, PublicKeyToken=null")
byCurve_3 = Rebar.ByCurve(curve=byJoinedCurves_5, hostElementId=id_3, rebarStyle=rebar_style_3, rebarBarType=stirrup, startHookOrientation=rebar_hook_orientation_3, endHookOrientation=rebar_hook_orientation_3, startHookType=rebar_hook_type_3, endHookType=rebar_hook_type_3, vector=reverse_4)

# group: Hiển thị 3D
current_3 = Document.Current()
activeView_3 = Document.ActiveView(document=current_3)
setSolidInView_3 = Custom[Rebar.SetSolidInView](rebarElements=byCurve_3, views=activeView_3)
setUnobscuredInView_3 = Custom[Rebar.SetUnobscuredInView](rebarElements=byCurve_3, views=activeView_3)

# group: L/6
code_block_32 = CodeBlock(a=code_block_30) { a/6; }

# group: Làm tròn lên 5
code_block_33 = CodeBlock(a=code_block_32) { a/5; }
code_block_34 = CodeBlock(a=code_block_33) { a-0.00001; }
ceiling = Math.Ceiling(number=code_block_34)
code_block_35 = CodeBlock(a=ceiling, b=code_block_28) { a*5+b; }

# group: Offset mặt phẳng từ chân cột lên L/6
code_block_36 = CodeBlock(a=code_block_35, b=code_block_28) { -a+b; }
offset_8 = Surface.Offset(surface=bottom_2, distance=code_block_36)

# group: Tạo đường thẳng từ đường giao các mặt phẳng
intersect_4 = Geometry.Intersect(geometry=offset_5, other=offset_8)

# group: Tạo thành 1 đường từ nhiều đường
byJoinedCurves_6 = PolyCurve.ByJoinedCurves(curves=intersect_4)

# group: Tạo vector vuông góc với các đường thẳng
normal_6 = Curve.Normal(curve=byJoinedCurves_6)

# group: Đổi hướng
reverse_5 = Vector.Reverse(vector=normal_6)

# group: Tạo cây thép
id_4 = Element.Id(element=select_top_column)
rebar_style_4 = RebarStyle("StirrupTie", EnumerationType="Autodesk.Revit.DB.Structure.RebarStyle, RevitAPI, Version=24.0.0.0, Culture=neutral, PublicKeyToken=null")
rebar_hook_orientation_4 = RebarHookOrientation("Right", EnumerationType="Autodesk.Revit.DB.Structure.RebarHookOrientation, RevitAPI, Version=24.0.0.0, Culture=neutral, PublicKeyToken=null")
rebar_hook_type_4 = RevitRebarHookType("Stirrup - 135 deg", ElementType="Autodesk.Revit.DB.Structure.RebarHookType, RevitAPI, Version=24.0.0.0, Culture=neutral, PublicKeyToken=null")
byCurve_4 = Rebar.ByCurve(curve=byJoinedCurves_6, hostElementId=id_4, rebarStyle=rebar_style_4, rebarBarType=stirrup, startHookOrientation=rebar_hook_orientation_4, endHookOrientation=rebar_hook_orientation_4, startHookType=rebar_hook_type_4, endHookType=rebar_hook_type_4, vector=reverse_5)

spacingStirrupCenterColumn = StringInput("100")  # graph input
toNumber_5 = String.ToNumber(string=spacingStirrupCenterColumn)
code_block_37 = CodeBlock(a=ceiling) { a*5; }

# group: 2/3L
code_block_38 = CodeBlock(a=code_block_30, b=code_block_37) { a-2*b; }

# group: Pakage(Dynamo for Rebar 2.0)
code_block_39 = CodeBlock { true; }
setLayoutAsMaximumSpacing = DynamoRebar.Rebar.SetLayoutAsMaximumSpacing(rebar=byCurve_4, spacing=toNumber_5, arrayLength=code_block_38, barsOnNormalSide=code_block_39, includeFirstBar=code_block_39, includeLastBar=code_block_39)

spacingStirrupBottomColumn = StringInput("200")  # graph input
toNumber_6 = String.ToNumber(string=spacingStirrupBottomColumn)

# group: 1/6L
code_block_40 = CodeBlock(a=code_block_30) { a/6; }

# group: Làm tròn lên 5
code_block_41 = CodeBlock(a=code_block_40) { a/5; }
code_block_42 = CodeBlock(a=code_block_41) { a-0.00001; }
ceiling_2 = Math.Ceiling(number=code_block_42)
code_block_43 = CodeBlock(a=ceiling_2, b=code_block_28) { a*5+b; }

# group: Pakage(Dynamo for Rebar 2.0)
code_block_44 = CodeBlock { true; }
setLayoutAsMaximumSpacing_2 = DynamoRebar.Rebar.SetLayoutAsMaximumSpacing(rebar=byCurve_2, spacing=toNumber_6, arrayLength=code_block_43, barsOnNormalSide=code_block_44, includeFirstBar=code_block_44, includeLastBar=code_block_44)

spacingStirrupTopColumn = StringInput("150")  # graph input
toNumber_7 = String.ToNumber(string=spacingStirrupTopColumn)

# group: Pakage(Dynamo for Rebar 2.0)
code_block_45 = CodeBlock { true; }
setLayoutAsMaximumSpacing_3 = DynamoRebar.Rebar.SetLayoutAsMaximumSpacing(rebar=byCurve_3, spacing=toNumber_7, arrayLength=code_block_43, barsOnNormalSide=code_block_45, includeFirstBar=code_block_45, includeLastBar=code_block_45)

# group: Hiển thị 3D
current_4 = Document.Current()
activeView_4 = Document.ActiveView(document=current_4)
setSolidInView_4 = Custom[Rebar.SetSolidInView](rebarElements=byCurve_4, views=activeView_4)
setUnobscuredInView_4 = Custom[Rebar.SetUnobscuredInView](rebarElements=byCurve_4, views=activeView_4)

code_block_46 = CodeBlock(a=sortByKey_3.sortedList) { a; }
setLayoutAsFixedNumber = Custom[Rebar.SetLayoutAsFixedNumber]()  # package BIM4Struc.Rebar; Sets the Layout Rule property of rebar set to FixedNumber.; unwired: rebarElement, arg1, RebarSetLength
setLayoutAsMaximumSpacing_4 = Custom[Rebar.SetLayoutAsMaximumSpacing](rebarElement=byCurve_4, Spacing=toNumber_5, RebarSetLength=code_block_38, barsOnNormalSide=code_block_39, IncludeFirstBar=code_block_39, IncludeLastBar=code_block_39, InputInMM=code_block_39)  # package BIM4Struc.Rebar; Sets the Layout Rule property of rebar set to Maximum Spacing
